# Grasshopper definition ghpython_intro_01.gh (Grasshopper 1.0.8)

py3 = Python3Script(length=Slider(1, range=1..5))  # -> out, pt; inputs length: Double
# ---------- py3: Python ----------
""" 
This is how you import a library 
Rhino.Geometry is what we'll use for Rhino, however there is also rhinoscriptsyntex
Check out the documentation for Rhino Common:
https://developer.rhino3d.com/api/rhinocommon/
"""
import Rhino.Geometry as rg

# This is a "input", coming from your gh doc. 
print ("The input is: ", length)

# "out" is a reserved variable for ghpython, make sure it's always there

# 0D 
pt = rg.Point3d(1,1,0) # this is a Point3d a Point in 3D cartesian space
vec = rg.Vector3d(1,1,0) # this is a Vector3d a Point in 3D cartesian space
vec *= length
# Try add another "Output" as vec, and see what will happen

# 1D 
line = rg.LineCurve(pt, pt+vec)
domain = rg.Interval(0, 100) # this is a interval, a finite 1D space of real numbers
print ("The normamlize parameter on the axes:", domain.NormalizedParameterAt(20))
print ("The parameter on the axes:", domain.ParameterAt(0.5))

# 2D
# Plane is technically two-dimensional, however it can already be use to map 3d cartesian space
pln = rg.Plane(
    pt+vec,
    rg.Vector3d.XAxis,
    rg.Vector3d.YAxis
)

# Try to find the NurbsSurface.CreateFromPlane in the API doc
srf = rg.NurbsSurface.CreateFromPlane(
    pln,
    rg.Interval(-1, 1),
    rg.Interval(-1, 1),
    1,
    1,
    2,
    2
)

# 3D
box = rg.Box(
    pln,
    rg.Interval(-1, 1),
    rg.Interval(-1, 1),
    rg.Interval(1, 2)
)
# ---------- end py3 ----------

edges = Python3Script(segments=Slider(3, range=3..12), radius=Slider(4.1, range=1..5), loop=Slider(0, range=0..10))  # -> out, edges, trippy_edges; inputs segments: Int32, radius: Double, loop: Int32
# ---------- edges: Python ----------
import Rhino.Geometry as rg
# Here we need to import math and itertools 
import math as m

# pairwise is not in itertools until python 3.10, so if you need it you'll have to do it like this
def pairwise(iterable):
    # pairwise('ABCDEFG') → AB BC CD DE EF FG

    iterator = iter(iterable)
    a = next(iterator, None)

    for b in iterator:
        yield a, b
        a = b

# Let's draw a polygon
corners = []
for i in range(segments+1):
    # get the normalized parameter
    t = i/(segments)
    print ("corner", i)
    print (i, t)
    
    theta = t*m.tau # tau = 2*pi
    print ("Angle in radian: ", theta)
    print ("Angle in degrees: ", m.degrees(theta))
    
    corner = rg.Point3d(
        radius*m.cos(theta),
        radius*m.sin(theta),
        0
    )
    corners.append(corner)

# Connect the dots
edges = []

# say pairwise is not avaliabe
for i, corner in enumerate(corners[:-1]):
    edges.append(
        rg.LineCurve(
            corner,
            corners[i+1]
        )
    )

# Trippy
def loop_polygon(edges: list[rg.LineCurve]):
    new_edges = []
    corners = []

    for edge in edges:
        # get the interval of th linear space of the edge 
        domain = edge.Domain

        # get the specific point on this edge
        pt = edge.PointAt(domain.ParameterAt(0.1)) 
        corners.append(pt)
    
    # repeat the first conrer
    corners.append(corners[0])

    for i, corner in enumerate(corners[:-1]):
        new_edges.append(
            rg.LineCurve(
                corner,
                corners[i+1]
            )
    )
    return new_edges

# run it in loops
starting_edges = edges
trippy_edges = []

for i in range(loop):
    starting_edges = loop_polygon(starting_edges)
    trippy_edges.extend(starting_edges)
# ---------- end edges ----------

edges_2 = Python3Script(loops=Slider(10, range=1..12), freq=Slider(6, range=0..6))  # -> out, circles; inputs loops: Int32, freq: Int32
# ---------- edges_2: Python ----------
import Rhino.Geometry as rg
# Here we need to import math and itertools 
import math as m


# let's create a function that draws a circle
def draw_circle(resolution: int = 10, radius: int = 1):
    pts = [] 

    for i in range(resolution):
        theta = i/(resolution-1)*m.tau
        pts.append(
            rg.Point3d(
                radius*m.cos(theta),
                radius*m.sin(theta),
                0
            )
        )

    return rg.Curve.CreateInterpolatedCurve(
        pts,
        3
    )

# set the output list
circles = []

for i in range(loops):
    circle = draw_circle(radius=i+1)
    circles.append(circle)

# # with a twist
# def draw_cool_circle(resolution: int = 10, radius: int = 1):
#     pts = [] 

#     for i in range(resolution):
#         theta = i/(resolution-1)*m.tau
        
#         # play with the radius
#         r = radius + m.cos(theta*freq)

#         pts.append(
#             rg.Point3d(
#                 r*m.cos(theta),
#                 r*m.sin(theta),
#                 0
#             )
#         )

#     return rg.Curve.CreateInterpolatedCurve(
#         pts,
#         3
#     )

# # set the output list
# circles = []

# for i in range(loops):
#     circle = draw_cool_circle(resolution=100, radius=i+1)
#     circles.append(circle)

# # more passion, more energy!
# def draw_even_cooler_circle(resolution: int = 10, radius: int = 1):
#     pts = [] 

#     shift = 0
#     if radius%2 == 0:
#         shift = m.pi

#     for i in range(resolution):
#         theta = i/(resolution-1)*m.tau
        
#         # play with the radius

#         r = radius + m.cos(theta*freq+shift)*0.5

#         pts.append(
#             rg.Point3d(
#                 r*m.cos(theta),
#                 r*m.sin(theta),
#                 0
#             )
#         )

#     return rg.Curve.CreateInterpolatedCurve(
#         pts,
#         3
#     )

# # set the output list
# circles = []

# for i in range(loops):
#     circle = draw_even_cooler_circle(resolution=100, radius=i+1)
#     circles.append(circle)
# ---------- end edges_2 ----------
