# Grasshopper definition 201_robot_motion.ghx (Grasshopper 1.0.8)

# ---- group: 180 rotation
py3 = Python3Script(res="100")  # -> out, st, ed, section; inputs res: Int32
# ---------- py3: Python ----------
import Rhino.Geometry as rg
import math as m 

def remap(value, old_min, old_max, new_min, new_max):
  return (value - old_min) * (new_max - new_min) / (
      old_max - old_min
  ) + new_min

st = []
ed = []


for i in range(res):
    t = i/(res-1)
    
    pln = rg.Plane(
        rg.Point3d(remap(t, 0, 1, 0, 50), -5, 0),
        rg.Vector3d.XAxis,
        rg.Vector3d.YAxis
    )

    t = abs(abs(t-0.5)-0.5)*2
    print (t)
    angle = remap(t, 0, 1, 0, m.pi)

    pln.Rotate(
        angle,
        rg.Vector3d.ZAxis,
        pln.Origin
    )

    st.append(pln.PointAt(0, 1))
    ed.append(pln.PointAt(0, -1))

section = [rg.LineCurve(s,e) for s, e in zip(st,ed)]
# ---------- end py3 ----------
preview = CustomPreview(Geometry=py3.st, Material=ColourSwatch(SwatchColor=RGB(0, 123, 255)))
preview_2 = CustomPreview(Geometry=py3.ed, Material=ColourSwatch(SwatchColor=RGB(221, 0, 255)))

# ---- group: 360 rotation
py3_2 = Python3Script(res="100")  # -> out, st, ed, section; inputs res: Int32
# ---------- py3_2: Python ----------
import Rhino.Geometry as rg
import math as m 

def remap(value, old_min, old_max, new_min, new_max):
  return (value - old_min) * (new_max - new_min) / (
      old_max - old_min
  ) + new_min

st = []
ed = []


for i in range(res):
    t = i/(res-1)
    
    pln = rg.Plane(
        rg.Point3d(remap(t, 0, 1, 0, 50), 0, 0),
        rg.Vector3d.XAxis,
        rg.Vector3d.YAxis
    )

    angle = remap(t, 0, 1, 0, 2*m.pi)

    pln.Rotate(
        angle,
        rg.Vector3d.ZAxis,
        pln.Origin
    )

    st.append(pln.PointAt(0, 1))
    ed.append(pln.PointAt(0, -1))

section = [rg.LineCurve(s,e) for s, e in zip(st,ed)]
# ---------- end py3_2 ----------
preview_3 = CustomPreview(Geometry=py3_2.st, Material=ColourSwatch(SwatchColor=RGB(0, 123, 255)))
preview_4 = CustomPreview(Geometry=py3_2.ed, Material=ColourSwatch(SwatchColor=RGB(221, 0, 255)))

# ----
crv = Curve(<curve referenced from the Rhino model>)
py3_3 = Python3Script()  # -> out, targets, viz; inputs crv: Curve
# ---------- py3_3: Python ----------
import Rhino.Geometry as rg
import math as m
import numpy as np

# draw a curve
if not crv:
    crv = rg.LineCurve(
        rg.Point3d(0,0,0),
        rg.Point3d(50,0,0)
    )

def preview_strokes(plns):
    pts_a = []
    pts_b = []

    for pln in plns:
        pts_a.append(pln.PointAt(0,1,0))
        pts_b.append(pln.PointAt(0,-1,0))
    
    ca = rg.Curve.CreateInterpolatedCurve(pts_a, 3)
    cb = rg.Curve.CreateInterpolatedCurve(pts_b, 3)

    return rg.NurbsSurface.CreateRuledSurface(ca, cb)

    
def stroke(crv, res, angle=0):
    targets = []

    crv.Domain = rg.Interval(0,1)
    
    for t in np.linspace(crv.Domain.Min, crv.Domain.Max, res+1):
        origin = crv.PointAt(t)
        tangent = crv.TangentAt(t)

        angle_t = abs(abs(t-0.5)-0.5)*2

        yaxis = rg.Vector3d.CrossProduct(tangent, rg.Vector3d.ZAxis)
        xaxis = tangent
        pln = rg.Plane(
                origin,
                xaxis,
                yaxis
        )

        pln.Rotate(
            m.radians(180*angle_t),
            pln.ZAxis,
            pln.Origin
        )

        pln.Rotate(
            m.radians(angle*angle_t),
            -pln.YAxis,
            pln.Origin
        )
        
        targets.append(pln)
    return targets



targets = stroke(crv, 20, 30)
viz = preview_strokes(targets)
# ---------- end py3_3 ----------
data = Data(py3_3.targets)
data_2 = Data(py3_3.viz)

data_3 = Data(py3.section)
data_4 = Data(py3_2.section)
