# Grasshopper definition 261015_101_brick_to_robot_IA01.gh (Grasshopper 1.0.8)
# plug-ins: Moonlight

moonlight = Moonlight(Mode=False)

# ---- group: This is needed only ONCE in the GH definition
enable_auto_reload = Python3Script()  # -> ok
# ---------- enable_auto_reload: Python ----------
"""
------------------------------
Using VS Code as Python editor
------------------------------

The simplest way to start using VS Code as our editor, is
to place our Python code in files located IN THE SAME FOLDER as our Grasshopper file.

After we have done that, we need 2 steps: 

1. Enable the COMPAS reloader on one component. This tells Grasshopper to watch for changes in the Pythoh files and reload if changed.
2. Every other component that uses Python code from external files needs to start with a method to ensure Grasshopper knows where to load the files from.

"""
# r: compas
# venv: mas-2627

from compas_rhino.devtools import DevTools
DevTools.enable_reloader()
# ---------- end enable_auto_reload ----------

# ----
python_3_script = Python3Script(
    n=Slider(9, range=0..100),
    z=Slider(12, range=0..100),
    l=Slider(32, range=0..100),
    b=Slider(15, range=0..100),
    h=Slider(10, range=0..10))  # -> points, bricks, frame; inputs n: Int32, z: Int32, l: Double, b: Double, h: Double
# ---------- python_3_script: Python ----------
from compas.geometry import Point, Frame, Box
import math as m
from compas_rhino.conversions import box_to_rhino

points = []
bricks = []
frame = []
angle_step = m.tau / n
r = 50

for k in range(z):
    for i in range(n):

        if k%2 == 0:
            angle = angle_step * i

        else:
            angle = (i * angle_step) + angle_step/2

        x = r * m.cos(angle)
        y = r * m.sin(angle)
        z = k *h

        pt = Point(x,y,z)
        points.append(pt)

                # Calculate local orientation vectors so bricks curve with the cylinder
        xaxis = [m.cos(angle + m.pi/2), m.sin(angle + m.pi/2), 0] # Tangent to ring
        yaxis = [m.cos(angle), m.sin(angle), 0]                  # Radial from center
        
        f = Frame(pt, xaxis, yaxis) # Create oriented frame at the point
        brick = Box(l, b, h, f)      # Brick using your GH l, b, h slider variables
        
        # Convert directly to Rhino geometry and append to flat lists
        brick_rhino = box_to_rhino(brick)
        bricks.append(brick_rhino)
        points.append(pt)

        frame.append(f)
# ---------- end python_3_script ----------
preview = CustomPreview(
    Geometry=python_3_script.bricks,
    Material={diffuse=RGB(197, 130, 64), emission=RGB(68, 53, 68), shine=0.5, specular=RGB(255, 254, 254), transparency=0})

python_3_script_2 = Python3Script(
    x=Slider(2, range=0..10),
    z=Slider(30, range=0..100),
    w=Slider(15, range=0..100),
    h=Slider(10, range=0..10),
    l=Slider(32, range=0..100))  # -> bricks, frames; inputs x: Int32, z: Int32, w: Double, h: Double, l: Double
# ---------- python_3_script_2: Python ----------
import Rhino.Geometry as rg
import math as m
from compas.geometry import Box, Frame, Point, Vector

bricks = []
frames = []
gap = 1  # Define your mortar gap thickness here

for k in range(z):
    # Calculate the row's shared center (including the gaps)
    total_row_width = x * w + (x - 1) * gap
    row_center_x = total_row_width / 2.0
    row_center_z = k * h
    row_centroid = Point(row_center_x, 0, row_center_z)
    
    # Calculate rotation angle
    t = k / (z - 1) if z > 1 else 0
    a = t * m.tau
    axis = Vector(0, 0, 1)

    for i in range(x):
        # Shift brick centers outward by the gap amount
        brick_center_x = (i * (w + gap)) + (w / 2.0)
        pt = Point(brick_center_x, 0, k * (h))
        
        f = Frame(pt,[1, 0, 0], [0, -1, 0])
        # Shrink the box width slightly so the physical gap appears
        box = Box(w - gap, l, h, f)
        box.rotate(a, axis, row_centroid)
        f.rotate(a, axis, row_centroid)

        bricks.append(box)
        frames.append(f)
# ---------- end python_3_script_2 ----------
compas_draw = COMPASDraw(cg=python_3_script_2.bricks)  # -> rg
#   port cg: The COMPAS geometry or datastructure to be drawn.
#   port rg: The Rhino geometry object.
# ---------- compas_draw: Python ----------
# r: compas>=2.14.1
"""
Draws COMPAS geometry in Grasshopper.
"""

from typing import Any

import Grasshopper

from compas.scene import SceneObject


class CompasToRhinoGeometry(Grasshopper.Kernel.GH_ScriptInstance):
    def RunScript(self, cg):
        if not cg:
            return None

        return SceneObject(item=cg).draw()
# ---------- end compas_draw ----------
preview_2 = CustomPreview(
    Geometry=compas_draw,
    Material={diffuse=RGB(197, 130, 64), emission=RGB(68, 53, 68), shine=0.5, specular=RGB(255, 254, 254), transparency=0})

# ----
# Generate Geometry
number_slider = Slider(20, range=0..30)
gap = Slider(5, range=0..10)
reference_curve = Curve(<curve referenced from the Rhino model>)
brick_wall = Python3Script(crv=reference_curve, num_layers=number_slider, gap=gap)  # -> bricks, geometries, frames; inputs crv: Curve, num_layers: Int32, gap: Double
# ---------- brick_wall: Python ----------
# r: compas
# venv: mas-2627
from compas_rhino.devtools import DevTools
DevTools.ensure_path()

# 0. Import everything we will need
import math
from compas.geometry import Box
from compas.geometry import Point
from compas.geometry import Frame
from compas_rhino.conversions import curve_to_compas
from compas_rhino.conversions import curve_to_rhino
from compas.geometry import cross_vectors


# ..also import our module "brick_wall.py", that needs to be in the same folder as our GH file
from brick_wall import Brick

# 1. Start with an empty list of bricks to be created

bricks = []

# 2. Create points on curve curve

# convert the curve to a compas geometry

compas_crv = curve_to_compas(crv)

# divide the curve by the points

length = (Brick.LENGTH + gap)/2
params, points = compas_crv.divide_by_length(length, True) # unpack the list 


for i in range(num_layers):
    for j, (param, pt) in enumerate(zip(params, points)):

        if i % 2 == j % 2:

            tangent = compas_crv.tangent_at(param)
            normal = cross_vectors(tangent, [0,0,1])
            pt.z = i * Brick.HEIGHT + Brick.HEIGHT/2
            f = Frame(pt, xaxis = tangent , yaxis = normal)
            my_brick = Brick(f)
            bricks.append(my_brick)


# Visualize and store brick data

geometries =[]
frames = []

for brick in bricks:

    geometries.append(brick.draw())
    frames.append(brick.get_pick_frame())

# list comprehension

geometries = [brick.draw() for brick in bricks]
frames = [brick.get_pick_frame() for brick in bricks]
# ---------- end brick_wall ----------
compas_draw_2 = COMPASDraw(cg=brick_wall.geometries)  # -> rg; same code as compas_draw

compas_draw_3 = COMPASDraw(cg=python_3_script_2.frames)  # -> rg; same code as compas_draw

point = ValueList({"origin", "xaxis", "xypoint"}, selected="xypoint")
capture = Button()
capture_wobj = CaptureWobj(robot_ip="192.168.10.10", point_name=point, capture=capture)  # -> wobj_origin, wobj_xaxis, wobj_xypoint, info
# ---------- capture_wobj: Python ----------
"""
Capture the 3 points that define the work object (robot base) plane.

Jog the TCP to a point, pick its name (origin / xaxis / xypoint) and press capture.
The TCP position (robot base frame, mm) is saved to wobj_calibration.json next to
this .ghx file, so the points survive closing Grasshopper.
"""
import os
import sys
import json
import time

import scriptcontext as sc
import Rhino.Geometry as rg

NAMES = ["origin", "xaxis", "xypoint"]

gh_dir = os.path.dirname(ghenv.Component.OnPingDocument().FilePath)
src_dir = os.path.join(gh_dir, "src")
if src_dir not in sys.path:
    sys.path.append(src_dir)
import simple_comm as com

path = os.path.join(gh_dir, "wobj_calibration.json")

data = {}
if os.path.exists(path):
    with open(path) as f:
        data = json.load(f)

# keep the last status in sticky, so the message survives the button being released
status_key = "capture_status_" + str(ghenv.Component.InstanceGuid)

if capture:
    if point_name not in NAMES:
        sc.sticky[status_key] = "pick origin / xaxis / xypoint"
    else:
        try:
            x, y, z = list(com.listen_to_robot(robot_ip)["pose"])[:3]  # metres, robot base frame
            data[point_name] = [round(x * 1000, 2), round(y * 1000, 2), round(z * 1000, 2)]  # -> mm
            with open(path, "w") as f:
                json.dump(data, f, indent=2)
            sc.sticky[status_key] = "{} captured {}".format(point_name, time.strftime("%H:%M:%S"))
        except Exception as e:
            print(e)
            sc.sticky[status_key] = "robot not reachable"

ghenv.Component.Message = sc.sticky.get(status_key, "")

def pt(name):
    return rg.Point3d(*data[name]) if name in data else None

wobj_origin, wobj_xaxis, wobj_xypoint = pt("origin"), pt("xaxis"), pt("xypoint")
info = json.dumps(data, indent=2)
# ---------- end capture_wobj ----------

vector_2pt = Vector2Pt(PointA=capture_wobj.wobj_origin, PointB=capture_wobj.wobj_xypoint, Unitize=False)  # -> Vector, Length
distance = Distance(PointA=capture_wobj.wobj_origin, PointB=capture_wobj.wobj_xypoint)
distance_2 = Distance(PointA=capture_wobj.wobj_origin, PointB=capture_wobj.wobj_xaxis)
vector_2pt_2 = Vector2Pt(PointA=capture_wobj.wobj_origin, PointB=capture_wobj.wobj_xaxis, Unitize=False)  # -> Vector, Length
construct_plane = ConstructPlane(Origin=capture_wobj.wobj_origin, XAxis=vector_2pt_2.Vector, YAxis=vector_2pt.Vector)
rectangle = Rectangle(Plane=construct_plane, XSize=distance_2, YSize=distance, Radius=0)  # -> Rectangle, Length

# ----
# Transform geometry to robobase
fine_adjust_z_mm = Slider(45, range=-5..500)
transform = Python3Script(
    way_planes=python_3_script_2.frames,
    wobj_origin=capture_wobj.wobj_origin,
    wobj_xaxis=capture_wobj.wobj_xaxis,
    wobj_xypoint=capture_wobj.wobj_xypoint,
    z_safe_margin=fine_adjust_z_mm)  # -> out, flatten(transformed_frames); inputs way_planes: list, wobj_origin: Point3d, wobj_xaxis: Point3d, wobj_xypoint: Point3d, z_safe_margin: Double
# ---------- transform: Python ----------
from compas.geometry import Frame, Transformation, Translation, Vector
#in this step we transform our way planes to robot space
#the rhino co-ordinate system is rather abstract in the physical world
#the robot base plane assumed the base frame of robot is the origin
#but rhino does not know that
#thus we transform things from our design space(Rhino World XY) to Robot Base Plane that we measure

def set_robot_base(origin, xaxis, xypoint):
    """
    set a base plane representing the robot working object plane
    """
     # 1. Extracted the vectors from the corner origin
    vec_x =  xaxis - origin
    vec_y =  xypoint - origin
    
    # 2. Calculated the center point (halfway along X and Y)
    center_origin = origin + vec_x * 0.5 + vec_y * 0.5

    robot_base = Frame(center_origin, vec_x, vec_y)
    print (robot_base)
    return (robot_base)

def rhino_to_robot_space(rhino_plane,robot_base_plane):

    """
    Transform the objects from Rhino world XY plane to robot work object plane
    """
    T_matrix = Transformation.from_frame_to_frame(Frame.worldXY(), robot_base_plane)
    robot_plane = rhino_plane.transformed(T_matrix)
    return robot_plane

def set_z_safe_margin(planes_to_adjust, safety_margin):
    adjusted = []
    T = Translation.from_vector(Vector(0, 0, safety_margin))
    for f in planes_to_adjust:
        adjusted.append(f.transformed(T))
    return adjusted

# ===== Robot base is set =====
robot_base =  set_robot_base(wobj_origin, wobj_xaxis, wobj_xypoint)

# ===== Set safety margin for Z height ======
safe_planes = set_z_safe_margin(way_planes, z_safe_margin)


# ===== Transforming the rhino planes into robot planes =====
transformed_frames = []
for plane in safe_planes: 
    transformed_frames.append(rhino_to_robot_space(plane, robot_base))
# ---------- end transform ----------
compas_draw_4 = COMPASDraw(cg=transform.transformed_frames)  # -> rg; same code as compas_draw

point_2 = ValueList({"origin", "xaxis", "xypoint"}, selected="xaxis")
capture_2 = Button()
capture_pick = CapturePick(robot_ip="192.168.10.10", point_name=point_2, capture=capture_2)  # -> origin, xaxis_pt, xy_pt, info
# ---------- capture_pick: Python ----------
"""
Capture the 3 points that define the pick frame at the brick pick-up location.

Jog the TCP to a point, pick its name (origin / xaxis / xypoint) and press capture.
The TCP position (robot base frame, mm) is saved to pick_calibration.json next to
this .ghx file, so the points survive closing Grasshopper.
"""
import os
import sys
import json
import time

import scriptcontext as sc
import Rhino.Geometry as rg

NAMES = ["origin", "xaxis", "xypoint"]

gh_dir = os.path.dirname(ghenv.Component.OnPingDocument().FilePath)
src_dir = os.path.join(gh_dir, "src")
if src_dir not in sys.path:
    sys.path.append(src_dir)
import simple_comm as com

path = os.path.join(gh_dir, "pick_calibration.json")

data = {}
if os.path.exists(path):
    with open(path) as f:
        data = json.load(f)

# keep the last status in sticky, so the message survives the button being released
status_key = "capture_status_" + str(ghenv.Component.InstanceGuid)

if capture:
    if point_name not in NAMES:
        sc.sticky[status_key] = "pick origin / xaxis / xypoint"
    else:
        try:
            x, y, z = list(com.listen_to_robot(robot_ip)["pose"])[:3]  # metres, robot base frame
            data[point_name] = [round(x * 1000, 2), round(y * 1000, 2), round(z * 1000, 2)]  # -> mm
            with open(path, "w") as f:
                json.dump(data, f, indent=2)
            sc.sticky[status_key] = "{} captured {}".format(point_name, time.strftime("%H:%M:%S"))
        except Exception as e:
            print(e)
            sc.sticky[status_key] = "robot not reachable"

ghenv.Component.Message = sc.sticky.get(status_key, "")

def pt(name):
    return rg.Point3d(*data[name]) if name in data else None

origin, xaxis_pt, xy_pt = pt("origin"), pt("xaxis"), pt("xypoint")
info = json.dumps(data, indent=2)
# ---------- end capture_pick ----------
pick_calibration = Panel(capture_pick.info)
py3 = Python3Script(origin=capture_pick.origin, xaxis_pt=capture_pick.xaxis_pt, xy_pt=capture_pick.xy_pt, h=Slider(15, range=0..100))  # -> out, pick_frames, pt; inputs origin: Point3d, xaxis_pt: Point3d, xy_pt: Point3d
# ---------- py3: Python ----------
from compas.geometry import Frame, Point, Vector
from compas_rhino.conversions import point_to_compas

# Convert Rhino points to COMPAS points
origin = point_to_compas(origin)
xaxis_pt = point_to_compas(xaxis_pt)
xy_pt = point_to_compas(xy_pt) # Assuming this is your Y-axis point

# Define the X and Y direction vectors
vx = Vector.from_start_end(origin, xaxis_pt)
vy = Vector.from_start_end(origin, xy_pt)

# Calculate the center point of the rectangle
center = origin + vx * 0.5 + vy * 0.5
center.z += h

# Define the pick frame at the center
pick_frames = Frame(center, -vx, vy)
pt = center
# ---------- end py3 ----------
compas_draw_5 = COMPASDraw(cg=py3.pick_frames)  # -> rg; same code as compas_draw

vector_2pt_3 = Vector2Pt(PointA=capture_pick.origin, PointB=capture_pick.xy_pt, Unitize=False)  # -> Vector, Length
distance_3 = Distance(PointA=capture_pick.origin, PointB=capture_pick.xy_pt)
distance_4 = Distance(PointA=capture_pick.origin, PointB=capture_pick.xaxis_pt)
vector_2pt_4 = Vector2Pt(PointA=capture_pick.origin, PointB=capture_pick.xaxis_pt, Unitize=False)  # -> Vector, Length
construct_plane_2 = ConstructPlane(Origin=capture_pick.origin, XAxis=vector_2pt_4.Vector, YAxis=vector_2pt_3.Vector)
rectangle_2 = Rectangle(Plane=construct_plane_2, XSize=distance_4, YSize=distance_3, Radius=0)  # -> Rectangle, Length

# ----
# Measure the TCP
panel = Panel("-0.98")
pt = ConstructPoint(XCoordinate="-0.24", YCoordinate=panel, ZCoordinate="129.8")

python_3_script_3 = Python3Script(
    pt=capture_pick.origin,
    n_x=Slider(3, range=0..10),
    n_y=Slider(5, range=0..100),
    n_z=Slider(3, range=0..10),
    l=Slider(2, range=0..10))  # -> out, clean_frames, points, depot_frame; inputs pt: Point3d, n_x: Int32, n_y: Int32, n_z: Int32
# ---------- python_3_script_3: Python ----------
from compas.geometry import Point, Frame, Vector
from compas.geometry import Polygon
from compas_rhino.conversions import point_to_compas
import math as m

# Rename your input reference point to avoid overwriting it
ref_pt = point_to_compas(pt)  

r_frames = []
points = []
l = 32
w = 15
h = 32
offset_x = 28
offset_y = 15

# i iterates over x-axis, j iterates over y-axis
for k in range(n_z):
    for j in range(n_y):
        for i in range(n_x):

            # Calculate coordinates relative to the original reference point
            x = ref_pt.x  - j*30 - offset_y
            y = ref_pt.y +  i*50 + offset_x
            z = ref_pt.z +  (k+1)*12 + h

            
            # Create the grid point and frame
            grid_pt = Point(x, y, z)
            # Keeps X normal, flips Y, which forces the Z-axis to point downwards
            f = Frame(grid_pt, [1, 0, 0], [0, -1, 0])
 
            r_frames.append(f)
            frames = r_frames[ : :-1]


# 1. ALWAYS copy the input list to prevent accumulation bugs
clean_frames = list(frames)

depot_frame = clean_frames[7]  # or whichever index you are targeting
# Use .copy() so you don't accidentally lower the height of the original frame 7
depot_frame = depot_frame.copy() 
depot_frame.point.z -= (10/2 + 2)
depot_frame.rotate(m.radians(90), axis=depot_frame.zaxis, point=depot_frame.point)


d = 12


for i in range(l):
    
    current_frame = depot_frame.copy()
    
    current_frame.point.z -= i * d
    
    insert_index = ((i + 1) * 15) + i
    
    if insert_index <= len(clean_frames):
        clean_frames.insert(insert_index, current_frame)

points = []
for f in clean_frames:
    points.append(f.point)

a = clean_frames
# ---------- end python_3_script_3 ----------
compas_draw_6 = COMPASDraw(cg=python_3_script_3.points)  # -> rg; same code as compas_draw

point_3 = Point(<point referenced from the Rhino model>)
compas_draw_7 = COMPASDraw(cg=python_3_script_3.clean_frames)  # -> rg; same code as compas_draw
python_3_script_4 = Python3Script(pt=point_3)  # -> f; inputs pt: Point3d
# ---------- python_3_script_4: Python ----------
from compas.geometry import Point, Frame
from compas_rhino.conversions import point_to_compas

compas_pt = point_to_compas(pt)
f = Frame(compas_pt, [1, 0, 0], [0, -1, 0])
# ---------- end python_3_script_4 ----------
points = PointList(Points=compas_draw_6, Size=Slider(3, range=0..100))

number_slider_2 = Slider(0.1, range=0..0.1)
compas = Python3Script(
    way_frames=transform.transformed_frames,
    tcp_measured=pt,
    a=number_slider_2,
    v=Slider(0.5, range=0..1),
    pickup_frames=python_3_script_3.clean_frames,
    dump_frame=python_3_script_4)  # -> out, vis_frames, vis_planes, script; inputs way_frames: list, tcp_measured: Point3d, a: Double, v: Double, pickup_frames: list
# ---------- compas: Python ----------
from imp import reload
import sys
import os

#get current file path
path = ghenv.Component.OnPingDocument().FilePath
#get parent directory of the parent directory
parentdir = os.path.dirname(path)
#get src folder which contains classes
dire = os.path.join(parentdir,'src')

sys.path.append(dire)

import simple_ur_script as ur
reload(ur)

import utils 
reload(utils)

import simple_comm as com
reload(com)

import compas.geometry as cg
import math as m

# ===== Set global constants =======

IO = 0 # Global constant
sd = 50

# =================================

script = "" #create empty string

def pickup_brick(script, pick_frame):

    frames = []

    # Translate frame to "safe" location
    safe_pick_frame = pick_frame.copy()
    safe_pick_frame.point.z += sd

    # Move to safe frame
    script += ur.move_l(safe_pick_frame, a, v)

    # Move to pick location
    script += ur.move_l(pick_frame, a, v)

    # Activate gripper
    script += ur.set_digital_out(IO, True)
    script += ur.sleep(1.5)

    # Move back to safe plane
    script += ur.move_l(safe_pick_frame, a, v)

    frames.extend([safe_pick_frame, pick_frame, safe_pick_frame])

    return script, frames


def place_brick(script, place_frame):
    frames = []
    
    # Safe frame for placing
    safe_place_frame = place_frame.copy()
    safe_place_frame.point.z += sd

    # Add to the path: go to the safe plane
    script += ur.move_l(safe_place_frame, a, v)

    # Add to the path: go to the place plane
    script += ur.move_l(place_frame, a, v)
    
    # Add to the path: turn off the vacuum and wait 1 second (hold the brick)
    script += ur.set_digital_out(IO, False)
    script += ur.sleep(1.5)
    
    # Add to the path: go back to the safe plane
    script += ur.move_l(safe_place_frame, a, v)

    frames.extend([safe_place_frame, place_frame, safe_place_frame])
    
    return script, frames


def depot_action(script, depot_frame, dump_frame):
    frames = []

    # 1. & 2. Copy the depot frame and raise its Z position by 20 units
    safe_depot_frame = depot_frame.copy()
    safe_depot_frame.point.z += 20

    # 3. UR Linear motions: approach safe position, then drop down to the depot point
    script += ur.move_l(safe_depot_frame, a, v)
    script += ur.move_l(depot_frame, a, v)

    # 4. Trigger I/O to TRUE (Grip/Activate)
    script += ur.set_digital_out(IO, True)
    script += ur.sleep(1.5)

    # 5. Move back up to the safe depot clearance height
    script += ur.move_l(safe_depot_frame, a, v)
    
    # 6. Move to the custom dump plane inputted from Grasshopper
    script += ur.move_l(dump_frame, a, v)
    
    # 7. Trigger I/O to FALSE (Release/Open)
    script += ur.set_digital_out(IO, False)
    script += ur.sleep(1.5)

    # Keep track of the generated motion sequence path for visual feedback
    frames.extend([safe_depot_frame, depot_frame, safe_depot_frame, dump_frame])

    return script, frames


#if value given for tcp measured, then add line to script, otherwise it will take current tcp from robot
if tcp_measured is not None:
    script += ur.set_tcp_by_angles(tcp_measured.X, tcp_measured.Y, tcp_measured.Z, m.radians(0.0), m.radians(0.0), m.radians(45))


vis_frames = []

# ===== Generate pick, place, and depot sequence =====
for i in range(len(way_frames)):
    
    # 1. Grab the current place frame
    current_place_frame = way_frames[i]
    
    # 2. Cycle through the pickup frames smoothly (0 to 39, wrapping back)
    pickup_index = i % len(pickup_frames)
    current_pick_frame = pickup_frames[pickup_index]

    # 3. Generate the pickup script actions
    script, pif = pickup_brick(script, current_pick_frame)
    vis_frames.extend(pif)
    
    # 4. Generate the placement script actions
    script, place_frames_list = place_brick(script, current_place_frame)
    vis_frames.extend(place_frames_list)
    
    # 5. Check if we have completed a batch of 15 pairs
    if (i + 1) % 15 == 0:
        # Define your targeted depot frame (the 15th index in the pick list)
        # Note: adjust this index choice if you want it tracking a shifting position
        target_depot_frame = pickup_frames[15] 
        
        # Inject the depot action using your custom dump_frame input
        script, depot_frames_list = depot_action(script, target_depot_frame, dump_frame)
        vis_frames.extend(depot_frames_list)

# Format the script to make it sendable
script = com.concatenate_script(script)

# Visualize
from compas_rhino import conversions
import Rhino.Geometry as rg

vis_planes = [conversions.frame_to_rhino(frame) for frame in vis_frames]
# ---------- end compas ----------
compas_draw_8 = COMPASDraw(cg=compas.vis_frames)  # -> rg; same code as compas_draw
pline = PolyLine(Vertices=compas.vis_planes, Closed=False)
points_2 = PointList(Points=compas.vis_planes, Size=Slider(5, range=0..100))

# ----
# Measure the TCP
# Generate Geometry
# Transform geometry to robobase
# Convert Planes to URScript
# Measure robo base
# Send to Robot
# robo_base_rhino for reference
# Measure pick up location
# pickup_base_rhino for reference
wobj_calibration = Panel(capture_wobj.info)
panel_2 = Panel(compas.script)

py3_2 = Python3Script(script=compas.script, ip_address="192.168.10.10", send=Button())  # -> out, a; inputs script: String, ip_address: String, send: Boolean
# ---------- py3_2: Python ----------
import simple_comm as com

if send:
    com.send_script(script,ip_address)
# ---------- end py3_2 ----------
