# Grasshopper definition Brick Pile.gh (Grasshopper 1.0.8)

brick_dimensions = Python3Script()  # -> out, bricks
# ---------- brick_dimensions: Python ----------
# r: compas
# venv: mas-2627
from compas_rhino.devtools import DevTools
DevTools.ensure_path()

from brick_wall import Brick

bricks = []
for c in range(3):
    b = Brick()
    b.configuration(c)
    bricks.append(b)
# ---------- end brick_dimensions ----------
brick_setup = Python3Script(brick_config=brick_dimensions.bricks)  # -> out, a; inputs brick_config: list; unedited script template
