# Grasshopper definition 101_brick_to_robot_Mike.gh (Grasshopper 1.0.8)

# ---- group: This is needed only ONCE in the GH definition
enable_auto_reload = Python3Script()  # -> ok
# ---------- enable_auto_reload: Python ----------
"""
------------------------------
Using VS Code as Python editor
------------------------------

The simplest way to start using VS Code as our editor, is
to place our Python code in files located IN THE SAME FOLDER as our Grasshopper file.

After we have done that, we need 2 steps: 

1. Enable the COMPAS reloader on one component. This tells Grasshopper to watch for changes in the Pythoh files and reload if changed.
2. Every other component that uses Python code from external files needs to start with a method to ensure Grasshopper knows where to load the files from.

"""
# r: compas
# venv: mas-2627

from compas_rhino.devtools import DevTools
DevTools.enable_reloader()
# ---------- end enable_auto_reload ----------

# ----
gap = Slider(7.9, range=0..10)
# Generate Geometry
curve = Curve(<curve referenced from the Rhino model>)
brick_wall = Python3Script(crv=curve, num_layers=Slider(9, range=0..30), gap=gap)  # -> para, bricks, geometries, frames; inputs crv: Curve, num_layers: Int32, gap: Double
# ---------- brick_wall: Python ----------
# r: compas
# venv: mas-2627
from compas_rhino.devtools import DevTools
DevTools.ensure_path()

# 0. Import everything we will need
import math
from compas_rhino.conversions import curve_to_compas
import ghpythonlib.treehelpers as th
from compas.geometry import Curve   
from compas.geometry import Box
from compas.geometry import Point, Vector
from compas.geometry import Frame


# ..also import our module "brick_wall.py", that needs to be in the same folder as our GH file
from brick_wall import Brick

# 1. Start with an empty list of bricks to be created
bricks = []
frames = []
# 2. Create points on curve curve
crv = curve_to_compas(crv)
t,p = crv.divide_by_length((Brick.LENGTH + gap)/2, True) # Boolean to set if we also return the exact points as well. If not it will just return params
# Since there is a gap, we would need to include it in length calculation so that our bricks would be placed in the right spots
para = list(t)

for r in range(num_layers):

    # Ensure odd layers keep odd bricks, even layers keep even bricks 
    tang = [crv.tangent_at(para) for i, para in enumerate(t) if r % 2 == i % 2]
    # or if abs(r - i) % 2 == 0
    
    # tang = []
    # for i, para in enumerate(t):
    #     if abs(r - i) % 2 == 0:
    #         tang.append(crv.tangent_at(para))

    # 1. I want odd rows with odd bricks, even rows with even bricks
    # 2. Therefore, abs(row_no - brick_no) must be divisible by 2
    # Using list comprehension methods, we can then extract the tangent vectors at t and pts sorted

    pts = [pt for j, pt in enumerate(p) if r % 2 == j % 2]
    # or if abs(r - j) % 2 == 0
    # Adjust the height of brick laid given its row

    for pp in pts:
        pp.z = r*Brick.HEIGHT
    # Establish its different qualities based on the values
    norm = Vector.cross_vectors([Vector.Zaxis() for i in range(len(tang))], tang)
    subframes = [Frame(pt, tt, nn) for (pt,tt,nn) in zip(pts,tang,norm)]
    subbricks = [Brick(f) for f in subframes]
    bricks.append(subbricks)
    frames.append(subframes)


geometries = th.list_to_tree([[b.draw() for b in subbricks] for subbricks in bricks])
frames = th.list_to_tree([[f for f in subframes] for subframes in frames])
# Visualize and store brick data
# ---------- end brick_wall ----------
panel = Panel(brick_wall.para)
compas_draw = COMPASDraw(cg=brick_wall.geometries)  # -> rg
#   port cg: The COMPAS geometry or datastructure to be drawn.
#   port rg: The Rhino geometry object.
# ---------- compas_draw: Python ----------
# r: compas>=2.14.1
"""
Draws COMPAS geometry in Grasshopper.
"""

from typing import Any

import Grasshopper

from compas.scene import SceneObject


class CompasToRhinoGeometry(Grasshopper.Kernel.GH_ScriptInstance):
    def RunScript(self, cg):
        if not cg:
            return None

        return SceneObject(item=cg).draw()
# ---------- end compas_draw ----------
compas_draw_2 = COMPASDraw(cg=brick_wall.frames)  # -> rg; same code as compas_draw

# ----
# Measure work object
point = ValueList({"origin", "xaxis", "xypoint"}, selected="xypoint")
capture = Button()
capture_wobj = CaptureWobj(robot_ip="192.168.10.10", point_name=point, capture=capture)  # -> wobj_origin, wobj_xaxis, wobj_xypoint, info
# ---------- capture_wobj: Python ----------
"""
Capture the 3 points that define the work object (robot base) plane.

Jog the TCP to a point, pick its name (origin / xaxis / xypoint) and press capture.
The TCP position (robot base frame, mm) is saved to wobj_calibration.json next to
this .ghx file, so the points survive closing Grasshopper.
"""
import os
import sys
import json
import time

import scriptcontext as sc
import Rhino.Geometry as rg

NAMES = ["origin", "xaxis", "xypoint"]

gh_dir = os.path.dirname(ghenv.Component.OnPingDocument().FilePath)
src_dir = os.path.join(gh_dir, "src")
if src_dir not in sys.path:
    sys.path.append(src_dir)
import simple_comm as com

path = os.path.join(gh_dir, "wobj_calibration.json")

data = {}
if os.path.exists(path):
    with open(path) as f:
        data = json.load(f)

# keep the last status in sticky, so the message survives the button being released
status_key = "capture_status_" + str(ghenv.Component.InstanceGuid)

if capture:
    if point_name not in NAMES:
        sc.sticky[status_key] = "pick origin / xaxis / xypoint"
    else:
        try:
            x, y, z = list(com.listen_to_robot(robot_ip)["pose"])[:3]  # metres, robot base frame
            data[point_name] = [round(x * 1000, 2), round(y * 1000, 2), round(z * 1000, 2)]  # -> mm
            with open(path, "w") as f:
                json.dump(data, f, indent=2)
            sc.sticky[status_key] = "{} captured {}".format(point_name, time.strftime("%H:%M:%S"))
        except Exception as e:
            print(e)
            sc.sticky[status_key] = "robot not reachable"

ghenv.Component.Message = sc.sticky.get(status_key, "")

def pt(name):
    return rg.Point3d(*data[name]) if name in data else None

wobj_origin, wobj_xaxis, wobj_xypoint = pt("origin"), pt("xaxis"), pt("xypoint")
info = json.dumps(data, indent=2)
# ---------- end capture_wobj ----------
wobj_calibration = Panel(capture_wobj.info)

shift = ShiftList(List=panel, Shift=1, Wrap=True)
subtraction = Subtraction(A=panel, B=shift)
panel_2 = Panel(subtraction)
fine_adjust_z_mm = Slider(5, range=-5..10)
lng = ListLength(List=brick_wall.frames)
py3 = Python3Script(list_len=lng, no_per_row=Slider(35, range=0..100))  # -> out, tray_grid; unedited script template

# ----
# Measure slide top location
point_2 = ValueList({"origin", "xaxis", "xypoint"}, selected="xypoint")
capture_2 = Button()
capture_pick = CapturePick(robot_ip="192.168.10.10", point_name=point_2, capture=capture_2)  # -> origin, xaxis_pt, xy_pt, info
# ---------- capture_pick: Python ----------
"""
Capture the 3 points that define the pick frame at the brick pick-up location.

Jog the TCP to a point, pick its name (origin / xaxis / xypoint) and press capture.
The TCP position (robot base frame, mm) is saved to pick_calibration.json next to
this .ghx file, so the points survive closing Grasshopper.
"""
import os
import sys
import json
import time

import scriptcontext as sc
import Rhino.Geometry as rg

NAMES = ["origin", "xaxis", "xypoint"]

gh_dir = os.path.dirname(ghenv.Component.OnPingDocument().FilePath)
src_dir = os.path.join(gh_dir, "src")
if src_dir not in sys.path:
    sys.path.append(src_dir)
import simple_comm as com

path = os.path.join(gh_dir, "place_slide_calibration.json")

data = {}
if os.path.exists(path):
    with open(path) as f:
        data = json.load(f)

# keep the last status in sticky, so the message survives the button being released
status_key = "capture_status_" + str(ghenv.Component.InstanceGuid)

if capture:
    if point_name not in NAMES:
        sc.sticky[status_key] = "pick origin / xaxis / xypoint"
    else:
        try:
            x, y, z = list(com.listen_to_robot(robot_ip)["pose"])[:3]  # metres, robot base frame
            data[point_name] = [round(x * 1000, 2), round(y * 1000, 2), round(z * 1000, 2)]  # -> mm
            with open(path, "w") as f:
                json.dump(data, f, indent=2)
            sc.sticky[status_key] = "{} captured {}".format(point_name, time.strftime("%H:%M:%S"))
        except Exception as e:
            print(e)
            sc.sticky[status_key] = "robot not reachable"

ghenv.Component.Message = sc.sticky.get(status_key, "")

def pt(name):
    return rg.Point3d(*data[name]) if name in data else None

origin, xaxis_pt, xy_pt = pt("origin"), pt("xaxis"), pt("xypoint")
info = json.dumps(data, indent=2)
# ---------- end capture_pick ----------
pick_calibration = Panel(capture_pick.info)
py3_2 = Python3Script(origin=capture_pick.origin, xaxis_pt=capture_pick.xaxis_pt, xy_pt=capture_pick.xy_pt)  # -> out, pick_frame; inputs origin: Point3d, xaxis_pt: Point3d, xy_pt: Point3d
# ---------- py3_2: Python ----------
from compas.geometry import Frame, Point
from compas.geometry import Rotation

from compas_rhino.conversions import point_to_compas

origin = point_to_compas(origin)
xaxis_pt = point_to_compas(xaxis_pt)
xy_pt = point_to_compas(xy_pt)

#define pick frame
pick_frame = Frame(origin, xaxis_pt - origin, xy_pt - origin)
# ---------- end py3_2 ----------
compas_draw_3 = COMPASDraw(cg=py3_2.pick_frame)  # -> rg; same code as compas_draw

# ----
# Measure slide bottom location 1
point_3 = ValueList({"origin", "xaxis", "xypoint"}, selected="xypoint")
capture_3 = Button()
capture_pick_2 = CapturePick(robot_ip="192.168.10.10", point_name=point_3, capture=capture_3)  # -> origin, xaxis_pt, xy_pt, info
# ---------- capture_pick_2: Python ----------
"""
Capture the 3 points that define the pick frame at the brick pick-up location.

Jog the TCP to a point, pick its name (origin / xaxis / xypoint) and press capture.
The TCP position (robot base frame, mm) is saved to pick_calibration.json next to
this .ghx file, so the points survive closing Grasshopper.
"""
import os
import sys
import json
import time

import scriptcontext as sc
import Rhino.Geometry as rg

NAMES = ["origin", "xaxis", "xypoint"]

gh_dir = os.path.dirname(ghenv.Component.OnPingDocument().FilePath)
src_dir = os.path.join(gh_dir, "src")
if src_dir not in sys.path:
    sys.path.append(src_dir)
import simple_comm as com

path = os.path.join(gh_dir, "pick_slide_calibration_1.json")

data = {}
if os.path.exists(path):
    with open(path) as f:
        data = json.load(f)

# keep the last status in sticky, so the message survives the button being released
status_key = "capture_status_" + str(ghenv.Component.InstanceGuid)

if capture:
    if point_name not in NAMES:
        sc.sticky[status_key] = "pick origin / xaxis / xypoint"
    else:
        try:
            x, y, z = list(com.listen_to_robot(robot_ip)["pose"])[:3]  # metres, robot base frame
            data[point_name] = [round(x * 1000, 2), round(y * 1000, 2), round(z * 1000, 2)]  # -> mm
            with open(path, "w") as f:
                json.dump(data, f, indent=2)
            sc.sticky[status_key] = "{} captured {}".format(point_name, time.strftime("%H:%M:%S"))
        except Exception as e:
            print(e)
            sc.sticky[status_key] = "robot not reachable"

ghenv.Component.Message = sc.sticky.get(status_key, "")

def pt(name):
    return rg.Point3d(*data[name]) if name in data else None

origin, xaxis_pt, xy_pt = pt("origin"), pt("xaxis"), pt("xypoint")
info = json.dumps(data, indent=2)
# ---------- end capture_pick_2 ----------
pick_calibration_2 = Panel(capture_pick_2.info)
py3_3 = Python3Script(origin=capture_pick_2.origin, xaxis_pt=capture_pick_2.xaxis_pt, xy_pt=capture_pick_2.xy_pt)  # -> out, pick_frame; inputs origin: Point3d, xaxis_pt: Point3d, xy_pt: Point3d; same code as py3_2
compas_draw_4 = COMPASDraw(cg=py3_3.pick_frame)  # -> rg; same code as compas_draw

# ----
# Measure pick up location
point_4 = ValueList({"origin", "xaxis", "xypoint"}, selected="xypoint")
capture_4 = Button()
capture_pick_3 = CapturePick(robot_ip="192.168.10.10", point_name=point_4, capture=capture_4)  # -> origin, xaxis_pt, xy_pt, info
# ---------- capture_pick_3: Python ----------
"""
Capture the 3 points that define the pick frame at the brick pick-up location.

Jog the TCP to a point, pick its name (origin / xaxis / xypoint) and press capture.
The TCP position (robot base frame, mm) is saved to pick_calibration.json next to
this .ghx file, so the points survive closing Grasshopper.
"""
import os
import sys
import json
import time

import scriptcontext as sc
import Rhino.Geometry as rg

NAMES = ["origin", "xaxis", "xypoint"]

gh_dir = os.path.dirname(ghenv.Component.OnPingDocument().FilePath)
src_dir = os.path.join(gh_dir, "src")
if src_dir not in sys.path:
    sys.path.append(src_dir)
import simple_comm as com

path = os.path.join(gh_dir, "pick_tray_calibration.json")

data = {}
if os.path.exists(path):
    with open(path) as f:
        data = json.load(f)

# keep the last status in sticky, so the message survives the button being released
status_key = "capture_status_" + str(ghenv.Component.InstanceGuid)

if capture:
    if point_name not in NAMES:
        sc.sticky[status_key] = "pick origin / xaxis / xypoint"
    else:
        try:
            x, y, z = list(com.listen_to_robot(robot_ip)["pose"])[:3]  # metres, robot base frame
            data[point_name] = [round(x * 1000, 2), round(y * 1000, 2), round(z * 1000, 2)]  # -> mm
            with open(path, "w") as f:
                json.dump(data, f, indent=2)
            sc.sticky[status_key] = "{} captured {}".format(point_name, time.strftime("%H:%M:%S"))
        except Exception as e:
            print(e)
            sc.sticky[status_key] = "robot not reachable"

ghenv.Component.Message = sc.sticky.get(status_key, "")

def pt(name):
    return rg.Point3d(*data[name]) if name in data else None

origin, xaxis_pt, xy_pt = pt("origin"), pt("xaxis"), pt("xypoint")
info = json.dumps(data, indent=2)
# ---------- end capture_pick_3 ----------
pick_calibration_3 = Panel(capture_pick_3.info)
py3_4 = Python3Script(origin=capture_pick_3.origin, xaxis_pt=capture_pick_3.xaxis_pt, xy_pt=capture_pick_3.xy_pt)  # -> out, pick_frame; inputs origin: Point3d, xaxis_pt: Point3d, xy_pt: Point3d; same code as py3_2
compas_draw_5 = COMPASDraw(cg=py3_4.pick_frame)  # -> rg; same code as compas_draw

# ----
# Measure slide bottom location 1
point_5 = ValueList({"origin", "xaxis", "xypoint"}, selected="origin")
capture_5 = Button()
capture_pick_4 = CapturePick(robot_ip="192.168.10.10", point_name=point_5, capture=capture_5)  # -> origin, xaxis_pt, xy_pt, info; same code as capture_pick_2
pick_calibration_4 = Panel(capture_pick_4.info)
py3_5 = Python3Script(origin=capture_pick_4.origin, xaxis_pt=capture_pick_4.xaxis_pt, xy_pt=capture_pick_4.xy_pt)  # -> out, pick_frame; inputs origin: Point3d, xaxis_pt: Point3d, xy_pt: Point3d; same code as py3_2
compas_draw_6 = COMPASDraw(cg=py3_5.pick_frame)  # -> rg; same code as compas_draw

# ----
# Measure and set TCP Gripper
panel_3 = Panel("0.07")
pt = ConstructPoint(XCoordinate=panel_3, YCoordinate="-0.06", ZCoordinate="74.33")

# ----
# Measure and set TCP Suction
panel_4 = Panel("0.07")
pt_2 = ConstructPoint(XCoordinate=panel_4, YCoordinate="-0.06", ZCoordinate="74.33")

# ----
# Transform from Rhino to Robot Space
transform_geom = Python3Script(
    way_planes=brick_wall.frames,
    wobj_origin=capture_wobj.wobj_origin,
    wobj_xaxis=capture_wobj.wobj_xaxis,
    wobj_xypoint=capture_wobj.wobj_xypoint,
    z_safe_margin=fine_adjust_z_mm)  # -> out, transformed_frames; inputs way_planes: tree, wobj_origin: Point3d, wobj_xaxis: Point3d, wobj_xypoint: Point3d, z_safe_margin: Double
# ---------- transform_geom: Python ----------
from compas.geometry import Frame, Transformation, Translation, Vector
from ghpythonlib import treehelpers as th
#in this step we transform our way planes to robot space
#the rhino co-ordinate system is rather abstract in the physical world
#the robot base plane assumed the base frame of robot is the origin
#but rhino does not know that
#thus we transform things from our design space(Rhino World XY) to Robot Base Plane that we measure

def set_robot_base(origin, xaxis, xypoint):
    """
    set a base plane representing the robot working object plane
    """
    robot_base = Frame(origin, xaxis - origin, xypoint - origin)
    print (robot_base)
    return (robot_base)

def rhino_to_robot_space(rhino_plane,robot_base_plane):
    """
    Transform the objects from Rhino world XY plane to robot work object plane
    """
    T_matrix = Transformation.from_frame_to_frame(Frame.worldXY(), robot_base_plane)
    robot_plane = rhino_plane.transformed(T_matrix)
    return robot_plane

def set_z_safe_margin(planes_to_adjust, safety_margin):
    adjusted = []
    T = Translation.from_vector(Vector(0, 0, safety_margin))
    for f in planes_to_adjust:
        adjusted.append(f.transformed(T))
    return adjusted

# ===== Tree conversion to List =====
way_planes = th.tree_to_list(way_planes)

# ===== Robot base is set =====
robot_base =  set_robot_base(wobj_origin, wobj_xaxis, wobj_xypoint)

# ===== Set safety margin for Z height ======
safe_planes = [set_z_safe_margin(wy, z_safe_margin) for wy in way_planes]

# ===== Transforming the rhino planes into robot planes =====
transformed_frames = []
for plane in safe_planes: 
    sub_transformed = []
    for pln in plane:
        sub_transformed.append(rhino_to_robot_space(pln, robot_base))
    transformed_frames.append(sub_transformed)

transformed_frames = th.list_to_tree(transformed_frames)
# ---------- end transform_geom ----------
transform_tray = Python3Script(
    way_planes=brick_wall.frames,
    wobj_origin=capture_wobj.wobj_origin,
    wobj_xaxis=capture_wobj.wobj_xaxis,
    wobj_xypoint=capture_wobj.wobj_xypoint,
    z_safe_margin=fine_adjust_z_mm)  # -> out, transformed_frames; inputs way_planes: tree, wobj_origin: Point3d, wobj_xaxis: Point3d, wobj_xypoint: Point3d, z_safe_margin: Double; same code as transform_geom
compas_draw_7 = COMPASDraw(cg=transform_geom.transformed_frames)  # -> rg; same code as compas_draw

# ----
# Convert Planes to URScript
number_slider = Slider(50, range=0..100)
number_slider_2 = Slider(5, range=0..5)
number_slider_3 = Slider(5, range=0..5)
compas = Python3Script(
    way_frames=transform_geom.transformed_frames,
    safe_distance=number_slider,
    tcp_measured=pt_2,
    tcp2_measured=pt,
    acceleration=number_slider_2,
    velocity=number_slider_3,
    pick_frame=py3_4.pick_frame,
    place_slide_frame=py3_2.pick_frame,
    pick_slide_frame=py3_3.pick_frame,
    pick_slide_2_frame=compas_draw_6,
    sleep_time=Slider(0.4, range=0..1))  # -> out, vis_frames, vis_planes, script; inputs way_frames: tree, safe_distance: Double, tcp_measured: Point3d, acceleration: Double, velocity: Double, tray_pts: tree, sleep_time: Double
# ---------- compas: Python ----------
from imp import reload
import sys
import os
import ghpythonlib.treehelpers as th

#get current file path
path = ghenv.Component.OnPingDocument().FilePath
#get parent directory of the parent directory
parentdir = os.path.dirname(path)
#get src folder which contains classes
dire = os.path.join(parentdir,'src')

sys.path.append(dire)

import simple_ur_script as ur
reload(ur)

import utils 
reload(utils)

import simple_comm as com
reload(com)

import compas.geometry as cg
import math as m

# ===== Set global constants =======

IO = 4 # Global constant
# IO Off: Gripper Closed, Suction Off
# IO On: Gripper Open, Suction On
# check IO number before setting
SAFE_DIST = safe_distance
SUCTION_ANGLES = (
    m.radians(-30.0),
    m.radians(0.0),
    m.radians(45.0)
)
GRIPPER_ANGLES = (
    m.radians(0.0),
    m.radians(0.0),
    m.radians(0.0)
)

script = ''
vis_frames = []

# =================================

def set_suction_tcp(script):
    """Set TCP to Vacuum Suction Tool Tip"""
    suction_script = ""
    suction_script += ur.set_tcp_by_angles(
        tcp_measured.X,
        tcp_measured.Y,
        tcp_measured.Z,
        *SUCTION_ANGLES
    )
    return suction_script

def set_gripper_tcp(script):
    """Set TCP to Gripper Tool Tip"""
    gripper_script = ""
    script += ur.set_tcp_by_angles(
        tcp2_measured.X,
        tcp2_measured.Y,
        tcp2_measured.Z,
        *SUCTION_ANGLES
    )
    return gripper_script

def safety_frame(frame, safety_distance):
    T = cg.Translation.from_vector(safety_distance * -frame.zaxis)
    # since Z Axis is pointing down, we need to reverse it by multiplying by a negative
    lifted = frame.translated(T)
    return(T)

def reset_frame(script):
    reset_script = ""
    reset_script += ur.move_j([m.radians(-120.13), m.radians(-112.74), m.radians(67.99), m.radians(-45.70), m.radians(-90.48), m.radians(-341.94)],1, 1)
    return reset_script

def pickup_brick_tray(script,pick_up_frame):
    
    pickbrick_script = ""
    # Translate frame to "safe" location
    above_pick_tray = safety_frame(pick_up_frame, SAFE_DIST)
    # Move to safe frame
    pickbrick_script += ur.move_l(above_pick_tray, acceleration, velocity)
    # Move to pick location
    pickbrick_script += ur.move_l(pick_up_frame, acceleration, velocity)
    # Add to the path: turn on the vacuum and wait 
    pickbrick_script += ur.set_digital_out(IO, True)
    pickbrick_script += ur.sleep(sleep_time)
    # Move back to safe plane
    pickbrick_script += ur.move_l(above_pick_tray, acceleration, velocity)
    # Move J in case of faulting
    pickbrick_script += reset_frame(script)  
    picktray_frames = [above_pick_tray, pick_up_frame, above_pick_tray]

    return pickbrick_script, picktray_frames

def place_brick_slide(script, place_slide_frame):
    
    placeslide_script = ""
    # Safe frame for placing
    above_slide_top = safety_frame(place_slide_frame, SAFE_DIST)
    # Add to the path: go to the safe plane
    placeslide_script += ur.move_l(above_slide_top, acceleration, velocity)
    # Add to the path: go to the place plane
    placeslide_script += ur.move_l(place_slide_frame, acceleration, velocity)
    # Add to the path: turn off the vacuum and wait 
    placeslide_script += ur.set_digital_out(IO, False)
    placeslide_script += ur.sleep(sleep_time)
    # Add to the path: go back to the safe plane
    placeslide_script += ur.move_l(above_slide_top, acceleration, velocity)
    # Move J in case of faulting
    placeslide_script += reset_frame(script)   

    placeslide_frames = [above_slide_top, place_slide_frame, above_slide_top]

    return placeslide_script, placeslide_frames

def pick_brick_slide(script, f1, f2, orient):
    pick_slide_frame = f1 if orient == 0 else f2
    pickslide_script = ""
    # Safe frame for picking
    above_slide_bottom = safety_frame(pick_slide_frame, SAFE_DIST)
    # Add to the path: open gripper and wait
    pickslide_script += ur.set_digital_out(IO, True)
    pickslide_script += ur.sleep(sleep_time) 
    # Add to the path: go to the safe plane
    pickslide_script += ur.move_l(above_slide_bottom, acceleration, velocity)    
    # Add to the path: go to the place plane
    pickslide_script += ur.move_l(pick_slide_frame, acceleration, velocity)    
    # Add to the path: close gripper and wait
    pickslide_script += ur.set_digital_out(IO, False)
    pickslide_script += ur.sleep(sleep_time) 
    # Add to the path: go back to the safe plane
    pickslide_script += ur.move_l(above_slide_bottom, acceleration, velocity)
    # Move J in case of faulting
    pickslide_script += reset_frame(script)   
    
    pickslide_frames = [above_slide_bottom, pick_slide_frame, above_slide_bottom]

    return pickslide_script, pickslide_frames

def place_position(script, position_frame):
    
    place_script = ""
    # Safe frame for placing
    above_place_position = safety_frame(position_frame, SAFE_DIST)
    # Add to the path: go to the safe plane
    place_script += ur.move_l(above_place_position, acceleration, velocity)    
    # Add to the path: go to the place plane
    place_script += ur.move_l(position_frame, acceleration, velocity)    
    # Add to the path: open gripper and wait
    place_script += ur.set_digital_out(IO, True)
    place_script += ur.sleep(sleep_time) 
    # Add to the path: go back to the safe plane
    place_script += ur.move_l(above_place_position, acceleration, velocity)  
    # Add to the path: close gripper and wait
    place_script += ur.set_digital_out(IO, False)
    place_script += ur.sleep(sleep_time)

    place_frames = [above_place_position, position_frame, above_place_position]

    return place_script, place_frames


script = ""
vis_frames = []
way_frames = th.tree_to_list(way_frames)

#if value given for tcp measured, then add line to script, otherwise it will take current tcp from robot
for num_wy, sub_wy in enumerate(way_frames):
    
    for n_way, wy in enumerate(sub_wy):
        
        if tcp_measured is not None:
            
            set_suction = set_suction_tcp(script)         
            script += set_suction
            print('hi')
            pickbrick_script, picktray_frames = pickup_brick_tray(script, pick_frame)
            script += pickbrick_script
            vis_frames.extend(picktray_frames)
            print('bye')
            placeslide_script, placeslide_frames = place_brick_slide(script, place_slide_frame)
            script += placeslide_script
            vis_frames.extend(placeslide_frames)
            print('hello')
            set_gripper = set_gripper_tcp(script)
            script += set_gripper
            print('goodbye')
            pickslide_script, pickslide_frames = pick_brick_slide(script, pick_slide_frame, orientation(num_wy))
            script += pickslide_script
            vis_frames.extend(pickslide_frames)

    


# Format the script to make it sendable
script = com.concatenate_script(script)


# Visualize
from compas_rhino import conversions
import Rhino.Geometry as rg

vis_planes = [conversions.frame_to_rhino(frame) for frame in vis_frames]
# ---------- end compas ----------
compas_draw_8 = COMPASDraw(cg=compas.vis_frames)  # -> rg; same code as compas_draw
points = PointList(Points=compas.vis_planes, Size=Slider(7, range=0..100))
panel_5 = Panel(compas.script)

# ---- group: Send UR script to Robot!
# Send to Robot!
button = Button()
py3_6 = Python3Script(script=compas.script, ip_address="192.168.10.10", send=button)  # -> out, a; inputs script: String, ip_address: String, send: Boolean
# ---------- py3_6: Python ----------
import simple_comm as com

if send:
    com.send_script(script,ip_address)
# ---------- end py3_6 ----------
