# Grasshopper definition Robotic Tower.gh (Grasshopper 1.0.8)

number_slider = Slider(594, range=0..1000)
min_radius = Slider(75, range=0..200)
factor = Slider(3, range=0..10)
list = ValueList({"Config 1": 0, "Config 2": 1, "Config 3": 2}, selected="Config 1")
number_slider_2 = Slider(420, range=0..1000)
min_radius_2 = Slider(100, range=0..100)
brick_dimensions = Python3Script(orientation=list)  # -> out, length, width, height; unedited script template
expression = Expression(x=min_radius, y=factor, Expression="x*y")
pt = ConstructPoint(XCoordinate=expr("x/2", number_slider_2), YCoordinate=expr("x/2", number_slider), ZCoordinate=0)
rectangle = Rectangle(Plane=PlaneXY(0, 0, 0), XSize=number_slider_2, YSize=number_slider, Radius=0)  # -> Rectangle, Length
diagrid = Python3Script(x_bound=number_slider_2, y_bound=number_slider, offset=min_radius_2, spacing=min_radius)  # -> out, flatten(pts); inputs x_bound: Double, y_bound: Double
# ---------- diagrid: Python ----------
import math as m
import Rhino.Geometry as rg
import ghpythonlib.treehelpers as th

x_dim = (x_bound - 2*offset)//spacing*spacing
y_dim = (y_bound - 2*offset)//spacing*spacing
off_x = (x_bound - x_dim)/2
off_y = (y_bound - y_dim)/2

x_count = int(x_dim // spacing) + 1
y_count = int(y_dim // spacing) + 1

pts = [
    [
        rg.Point3d(off_x + (spacing * col), off_y + (spacing * row), 0.0)
        for col in range(x_count)
        if col % 2 == row % 2  # Checkerboard condition evaluated per point
    ]
    for row in range(y_count)
]
pts = th.list_to_tree(pts)
# ---------- end diagrid ----------
