# Grasshopper definition Robotic Wall 2.gh (Grasshopper 1.0.8)

list = ValueList({"Config 1": 0, "Config 2": 1, "Config 3": 2}, selected="Config 1")
list_2 = ValueList({"Config 1": 0, "Config 2": 1, "Config 3": 2}, selected="Config 2")
number_slider = Slider(420, range=0..1000)
number_slider_2 = Slider(594, range=0..1000)
no_layers = Slider(10, range=0..10)
brick_dimensions = Python3Script(orientation=list)  # -> out, length, width, height, orient
# ---------- brick_dimensions: Python ----------
# r: compas
# venv: mas-2627
from compas_rhino.devtools import DevTools
DevTools.ensure_path()

from brick_wall import Brick

samplebrick = Brick()
samplebrick.configuration(orientation)

length = samplebrick.length
width = samplebrick.width
height = samplebrick.height
orient = orientation
# ---------- end brick_dimensions ----------
brick_dimensions_2 = Python3Script(orientation=list_2)  # -> out, length, width, height, orient; same code as brick_dimensions

# ---- group: This is needed only ONCE in the GH definition
enable_auto_reload = Python3Script()  # -> ok
# ---------- enable_auto_reload: Python ----------
"""
------------------------------
Using VS Code as Python editor
------------------------------

The simplest way to start using VS Code as our editor, is
to place our Python code in files located IN THE SAME FOLDER as our Grasshopper file.

After we have done that, we need 2 steps: 

1. Enable the COMPAS reloader on one component. This tells Grasshopper to watch for changes in the Pythoh files and reload if changed.
2. Every other component that uses Python code from external files needs to start with a method to ensure Grasshopper knows where to load the files from.

"""
# r: compas
# venv: mas-2627

from compas_rhino.devtools import DevTools
DevTools.enable_reloader()
# ---------- end enable_auto_reload ----------

# ----
lamcp = LAMCPBridge(enable=Toggle(True))  # -> status; inputs enable: Boolean, port: Int32
#   port enable: Toggle to start (True) or stop (False) the local HTTP server.
#   port port: Port to listen on (loopback only). Defaults to 8765.
#   port status: Current server status string.
# ---------- lamcp: Python ----------
"""
LAMCP Bridge: local HTTP server inside Rhino 8 / Grasshopper CPython.

Exposes `POST /exec` (JSON: `{"code": "...", "timeout": 30}`) which
exec()s `code` and returns
`{"stdout": "...", "stderr": "...", "result": "...", "error": null|str}`.

Pair with the `lamcp` FastMCP server, which translates Claude's
`run_python_script` MCP tool calls into POSTs to this endpoint.

Binds to 127.0.0.1 only. NEVER expose beyond localhost â€” it exec()s
arbitrary Python with full Rhino API access.

LAMCP v0.1.0
"""

import contextlib
import io
import json
import threading
import traceback
from http.server import BaseHTTPRequestHandler
from http.server import HTTPServer

import Grasshopper
import scriptcontext as sc


SHARED_GLOBALS_KEY = "_lamcp_bridge_globals"
SERVER_KEY = "_lamcp_bridge_server"


def _exec_code(code, timeout):
    """Run `code` on the HTTP-server thread and capture stdout/stderr/result.

    NOTE: this is intentionally NOT marshalled to Rhino's UI thread for the
    spike â€” `Rhino.RhinoApp.InvokeOnUiThread` was queueing actions that
    never fired in Rhino 8 CPython. Most read-only RhinoCommon access is
    safe cross-thread; mutations may crash. Add Eto-based marshalling
    back here when we need it.
    """
    out = io.StringIO()
    err = io.StringIO()
    g = sc.sticky.setdefault(SHARED_GLOBALS_KEY, {"__name__": "__lamcp_bridge__"})
    error_text = None
    result_repr = None
    try:
        with contextlib.redirect_stdout(out), contextlib.redirect_stderr(err):
            exec(code, g, g)
            result_repr = repr(g.get("_"))
    except BaseException:
        error_text = traceback.format_exc()

    return {
        "stdout": out.getvalue(),
        "stderr": err.getvalue(),
        "result": result_repr,
        "error": error_text,
    }


class _ExecHandler(BaseHTTPRequestHandler):
    # Silence default request logging so it doesn't clog the Rhino command line.
    def log_message(self, fmt, *args):
        pass

    def _send(self, code, payload):
        body = json.dumps(payload).encode("utf-8")
        self.send_response(code)
        self.send_header("Content-Type", "application/json")
        self.send_header("Content-Length", str(len(body)))
        self.end_headers()
        self.wfile.write(body)

    def do_GET(self):
        if self.path == "/health":
            self._send(200, {"status": "ok"})
        else:
            self._send(404, {"error": "not found"})

    def do_POST(self):
        if self.path != "/exec":
            self._send(404, {"error": "not found"})
            return
        length = int(self.headers.get("Content-Length", "0"))
        try:
            raw = self.rfile.read(length).decode("utf-8")
            body = json.loads(raw)
            code = body.get("code", "")
            timeout = float(body.get("timeout", 30.0))
        except Exception as exc:
            self._send(400, {"error": "bad request: " + repr(exc)})
            return
        result = _exec_code(code, timeout)
        self._send(200, result)


def _start_server(port):
    server = HTTPServer(("127.0.0.1", port), _ExecHandler)
    thread = threading.Thread(
        target=server.serve_forever, daemon=True, name="lamcp-bridge"
    )
    thread.start()
    return {"server": server, "thread": thread, "port": port}


def _stop_server(state):
    try:
        state["server"].shutdown()
        state["server"].server_close()
    except Exception:
        pass


class LamcpBridgeComponent(Grasshopper.Kernel.GH_ScriptInstance):
    def RunScript(self, enable: bool, port: int):
        port = int(port) if port else 8765

        state = sc.sticky.get(SERVER_KEY)

        if not enable:
            if state is not None:
                _stop_server(state)
                del sc.sticky[SERVER_KEY]
            return "stopped"

        # Already running on the requested port: no-op.
        if (
            state is not None
            and state.get("port") == port
            and state["thread"].is_alive()
        ):
            return "listening on http://127.0.0.1:{}".format(port)

        # Port changed or server died: tear down and restart.
        if state is not None:
            _stop_server(state)
            del sc.sticky[SERVER_KEY]

        try:
            sc.sticky[SERVER_KEY] = _start_server(port)
        except OSError as exc:
            ghenv.Component.AddRuntimeMessage(  # noqa: F821
                Grasshopper.Kernel.GH_RuntimeMessageLevel.Error,
                "Failed to bind 127.0.0.1:{}: {}".format(port, exc),
            )
            return "error: {}".format(exc)

        return "listening on http://127.0.0.1:{}".format(port)
# ---------- end lamcp ----------
rectangle = Rectangle(Plane=PlaneXY(0, 0, 0), XSize=number_slider, YSize=number_slider_2, Radius=0)  # -> Rectangle, Length
pt = ConstructPoint(XCoordinate=expr("x/2", number_slider), YCoordinate=expr("x/2", number_slider_2), ZCoordinate=0)
panel = Panel(lamcp)
lines_pts = LinesPts(C=rectangle.Rectangle, D=Slider(25, range=0..100), N=Slider(100, range=0..100))  # -> P, L, C_2
shift = ShiftList(List=lines_pts.L, Shift=1, Wrap=True)
rad = Radians(Degrees=Slider(30, range=0..1000))
rad_2 = Radians(Degrees=Slider(0, range=0..1000))
boundary = BoundarySurfaces(Edges=lines_pts.C_2)
index = ItemIndex(List=lines_pts.P, Item=lines_pts.P)
mesh_uv = MeshSurface(Surface=boundary, UCount=5, VCount=5, Overhang=True, Equalize=False)
shift_and_subtract = ShiftAndSubtract(L=lines_pts.L, I="-1")  # -> L_2, L_3
shift_2 = ShiftList(List=index, Shift=1, Wrap=True)  # -> simplify(List)
collider = Collider(Objects=lines_pts.P, Radii=brick_dimensions.length, IgnoreA=index, IgnoreB=shift_2, Strength=Slider(10, range=0..100))
clampangle = ClampAngle(LineA=shift_and_subtract.L_2, LineB=shift_and_subtract.L_3, UpperLimit=rad, LowerLimit=rad_2, Strength=1)
onmesh = OnMesh(Points=lines_pts.P, Mesh=mesh_uv, Strength=Slider(100, range=0..100000))
length_line = LengthLine(Line=lines_pts.L, Length=brick_dimensions.length, Strength=Slider(100, range=0..100))
merge = Merge(Data1=onmesh, Data2=length_line, Data3=collider, Data4=clampangle)  # -> flatten(Result)
expression = Expression(Expression="Format(\"{0}, {1}\", x, y)")
expression_2 = Expression(
    one_length=brick_dimensions.length,
    two_width=brick_dimensions_2.width,
    gap=Slider(4, range=0..10),
    Expression="one_length+two_width+gap")
expression_3 = Expression(h1=brick_dimensions.height, h2=brick_dimensions_2.height, Expression="h1+h2")
series = Series(Start=0, Step=1, Count=no_layers)
bouncysolver = BouncySolver(
    GoalObjects=flatten(merge),
    Reset=Button(),
    Threshold=1e-15,
    Tolerance=0.0001,
    Damping=Slider(0.084, range=0..1),
    Iterations=10,
    On=Toggle(True))  # -> I, V, O
multiplication = Multiplication(A=expression_3, B=series)
nurbs = NurbsCurve(Vertices=bouncysolver.V, Degree=3, Periodic=False)  # -> reparameterize(Curve), Length, Domain
Z = UnitZ(Factor=multiplication)
divlength = DivideLength(Curve=nurbs.Curve, Length=expr("x/2", expression_2))  # -> Points, Tangents, Parameters
shift_and_subtract_2 = ShiftAndSubtract(L=divlength.Parameters, I="-1")  # -> L_2, L_3
subtraction = Subtraction(A=shift_and_subtract_2.L_3, B=shift_and_subtract_2.L_2)
avr = Average(Input=subtraction)
remap = RemapNumbers(Value=divlength.Parameters, Source=Domain(0, 1), Target=Domain(0, 1))  # -> Mapped, Clipped
move = Move(Geometry=nurbs.Curve, Motion=graft(Z))  # -> Geometry, Transform
division = Division(A=avr, B=no_layers)
graph = GraphMapper(
    x0=0,
    x1=1,
    y0=0,
    y1=1,
    container_name="Sinc",
    Equation_X0=0.7009896636,
    Equation_X1=0.893904984,
    Equation_Y0=0.7812812328,
    Equation_Y1=0.3614065647)
cluster = Cluster(h1=brick_dimensions.height, h2=brick_dimensions_2.height)
series_2 = Series(Start=0, Step=division, Count=no_layers)
Z_2 = UnitZ(Factor=cluster)
expression_4 = Expression(t=divlength.Parameters, dl=graft(series_2), Expression="(t+dl)%1.0")
eval = EvaluateCurve(Curve=reparameterize(simplify(move.Geometry)), Parameter=simplify(expression_4))  # -> Point, Tangent, Angle
group = Group(Geometry=eval.Point)
move_2 = Move(Motion=Vector(0, 0, 10))  # -> Geometry, Transform

# ==== cluster LinesPts
C = ClusterInput()
D = ClusterInput()
N = ClusterInput()
offset = OffsetCurve(Curve=C, Distance=expr("-x", D), Corners=1)
cp = ControlPoints(Curve=offset)  # -> Points, Weights, Knots
cull_i = CullIndex(List=cp.Points, Indices="-1", Wrap=True)
index = ItemIndex(List=cull_i, Item=cull_i)
equals = Equality(FirstNumber=expr("x%2", index), SecondNumber=0)  # -> Equality, Inequality
cull = CullPattern(List=cull_i, CullPattern=equals.Equality)
pline = PolyLine(Vertices=cull, Closed=False)
divide = DivideCurve(Curve=pline, Count=N, Kinks=False)  # -> Points, Tangents, Parameters
shift_and_subtract = ShiftAndSubtract(L=divide.Points, I="-1")  # -> L_2, L_3
ln = Line(StartPoint=shift_and_subtract.L_2, EndPoint=shift_and_subtract.L_3)
C_2 = ClusterOutput(offset)
P = ClusterOutput(divide.Points)
L = ClusterOutput(ln)

# ==== cluster Cluster
h1 = ClusterInput()
h2 = ClusterInput()
expression = Expression(h1=h1, h2=h2, Expression="1/2*(abs(h1-h2))")
expression_2 = Expression(h1=h1, h2=h2, Expression="1/2*(h1+h2)")
expression_3 = Expression(h1=h1, h2=h2, Expression="max(h1,h2)")
merge = Merge(Data1=0, Data2=expression, Data3=expression_2, Data4=expression_3)
R = ClusterOutput(merge)

# ==== cluster ShiftAndSubtract
L = ClusterInput()
I = ClusterInput()
shift = ShiftList(List=L, Shift=1, Wrap=True)
cull_i = CullIndex(List=L, Indices=I, Wrap=True)
cull_i_2 = CullIndex(List=shift, Indices=I, Wrap=True)
L_2 = ClusterOutput(cull_i)
L_3 = ClusterOutput(cull_i_2)
