# Grasshopper definition Robotic Wall.gh (Grasshopper 1.0.8)

# ---- group: Brick Dimensions
number_slider = Slider(32, range=0..100)
number_slider_2 = Slider(15.2, range=0..100)
number_slider_3 = Slider(9.85, range=0..100)

# ----
resolution_grid = Slider(2, range=0..10)
base_space_curve = Python3Script(
    x_bound=Slider(420, range=0..1000),
    y_bound=Slider(594, range=0..1000),
    offset_x=Slider(50, range=0..1000),
    offset_y=Slider(50, range=0..1000),
    division=Slider(150, range=0..1000))  # -> out, dwg_midpt, base, basecrv, crvpts, crvlines; inputs x_bound: Double, y_bound: Double, offset_x: Double, offset_y: Double, division: Int32
# ---------- base_space_curve: Python ----------
import Rhino.Geometry as rg

length = x_bound - 2*offset_x
height = y_bound - 2*offset_y
basept = rg.Point3d(offset_x, offset_y, 0.0)
base = rg.Rectangle3d(rg.Plane(rg.Point3d(0.0,0.0,0.0),rg.Vector3d.ZAxis),x_bound,y_bound)
base = base.ToNurbsCurve()

# 2. Drawing the Base Curve
dwg_midpt = rg.Point3d(x_bound/2, y_bound/2, 0.0)
basecrv = rg.Ellipse(
    rg.Plane(dwg_midpt,rg.Vector3d.ZAxis), 
    (length - 2*offset_x)/2, 
    (height - 2*offset_y)/2
    )
basecrv = basecrv.ToNurbsCurve()

# 3. Drawing the individual lines and points
basecrv.Domain = rg.Interval(0.0,1.0)
crvpts = [basecrv.PointAt(n/division) for n in range(division)]
ts = [n/division for n in range(division)]
print(ts)
print(type((crvpts[0])))
crvlines = [rg.Line(crvpts[i%division], crvpts[(i+1)%division]) for i, p in enumerate(crvpts)]
# ---------- end base_space_curve ----------
rad = Radians(Degrees=Slider(0, range=0..1000))
rad_2 = Radians(Degrees=Slider(30, range=0..1000))
crv = Curve(base_space_curve.base)
line = Line(base_space_curve.crvlines)

# ---- group: Restricts Length of the Curve
resolution_guide_curve = Slider(32, range=0..32)
length_line = LengthLine(Line=line, Strength=Slider(100, range=0..100))

# ---- group: Ensures that there is a distance between points
repelling_radii = Slider(32, range=0..50)
index = ItemIndex(List=line, Item=line)
series = Series(Start=0, Step=1, Count=Slider(3, range=0..10))
shift = ShiftList(List=index, Shift=1, Wrap=True)  # -> simplify(List)
line_2 = Line(line)
collider = Collider(Objects=line_2, Radii=repelling_radii, IgnoreA=index, IgnoreB=shift, Strength=Slider(10, range=0..100))

# ---- group: Angle Restriction for Curve
number_slider_4 = Slider(1000, range=0..1000)
shift_2 = ShiftList(List=line_2, Shift=1, Wrap=True)
angle = Angle(LineA=line_2, LineB=shift_2, RestAngle=Slider(10, range=0..100), Strength=number_slider_4)

# ----
boundary = BoundarySurfaces(Edges=base_space_curve.base)
dim = Dimensions(Surface=boundary)  # -> UDimension, VDimension
integer_division = IntegerDivision(A=dim.UDimension, B=resolution_grid)
integer_division_2 = IntegerDivision(A=dim.UDimension, B=resolution_grid)
clampangle = ClampAngle(LineA=line_2, LineB=shift_2, UpperLimit=rad_2, LowerLimit=rad, Strength=number_slider_4)
mesh_uv = MeshSurface(Surface=boundary, UCount=integer_division, VCount=integer_division_2, Overhang=True, Equalize=False)
demesh = DeconstructMesh(Mesh=mesh_uv)  # -> Vertices, Faces, Colours, Normals
onmesh = OnMesh(Points=base_space_curve.crvpts, Mesh=mesh_uv, Strength=Slider(100, range=0..100000))
merge = Merge(Data1=onmesh, Data2=length_line, Data3=collider, Data4=clampangle)  # -> flatten(Result)

bouncysolver = BouncySolver(
    GoalObjects=flatten(merge),
    Reset=Button(),
    Threshold=1e-15,
    Tolerance=0.0001,
    Damping=Slider(0.084, range=0..1),
    Iterations=10,
    On=Toggle(False))  # -> I, V, O
pt_internalised_from_bouncy_solver = Point([Point(347.9761132, 297, 0), Point(353.6631426, 313.2608284, 0), Point(369.1093594, 324.0960232, 0), Point(386.6487595, 332.289928, 0), Point(396.4631049, 348.0712564, 0), Point(395.0897512, 366.7644697, 0)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])

dam = DataDam(DataA=pt_internalised_from_bouncy_solver, BufferDelay=10000000, BufferMode=0)
list = ValueList({"Config 1": 0, "Config 2": 1, "Config 3": 2}, selected="Config 2")
brick_paths = Python3Script(
    pts=dam,
    work_pt=base_space_curve.dwg_midpt,
    no_layers=Slider(50, range=0..100),
    freq=Slider(1, range=0..10),
    deg=Slider(10, range=0..100),
    orientation=list)  # -> out, pts, t_v, profile, tree_pts, line_prof, profiles; inputs pts: list of Point3d, work_pt: Point3d, no_layers: Int32, freq: Int32, deg: Int32, orientation: Int32
# ---------- brick_paths: Python ----------
from compas_rhino.devtools import DevTools
DevTools.ensure_path()
DevTools.enable_reloader()

# 0. Import everything we will need
import math as m
import ghpythonlib.treehelpers as th
from compas_rhino.conversions import point_to_compas
from compas_rhino.geometry import RhinoNurbsCurve
from compas.geometry import Translation
from compas.geometry import Vector, Line
from compas.geometry import Frame
from brick_wall import Brick

# 0. Provide contextual definitions and set up essential variables
def remap(t, omin, omax, nmin, nmax):
    return (t-omin)/(omax-omin)*(nmax-nmin)+nmin

workspace_pt = point_to_compas(work_pt)

pts = [point_to_compas(pt) for pt in pts]
profile = RhinoNurbsCurve.from_points(pts, degree=deg, is_periodic=True)
result = [profile.closest_point(p, True) for p in pts]
cp, ct = list(zip(*result))
samplebrick = Brick()
samplebrick.configuration(orientation)

# 1. Setting up the main variables 
# a) Identify how far each point on curve is from the centre 
d_v = [Vector.from_start_end(p, workspace_pt) for p in cp]
for ddv in d_v:
    ddv.unitize()
# b) Generate essential tangent/normal vectors
t_v = [profile.tangent_at(t) for t in ct]
n_v = Vector.cross_vectors([Vector.Zaxis() for t in ct], t_v)
for n in n_v:
    n.unitize()
# c) Map vector values to possible offsets in subsequent curves
c_v = Vector.cross_vectors(t_v, d_v)
m_v = [mg.length for mg in c_v]
mg_v = [remap(m, min(m_v), max(m_v), 1, samplebrick.width) for m in m_v]
# d) Assign signs to the remapped values
s_v = [c.z / abs(c.z) if c.z != 0 else 1.0 for c in c_v]
amp_v = [s*m for (s,m) in zip(s_v,mg_v)]

# 2. Generating points per layer
# a) Establishing empty list to add point lists into
tree_pts = []
# tree_lines = []
for r in range(no_layers):
    # b1) Create copies of point list per layer
    copypts = [p.copy() for p in cp]
    # b2) Establish formula for calculating sinusoidal angle
    theta = r/(no_layers-1)*2*m.pi
    # b3) Assign force magnitude moving point dependent on position to centre and its index
    f_v = [amp*m.sin(freq*theta+(a)) for a, amp in enumerate(amp_v)]
    # b4) Apply force magnitude on unit normal vector assigned to each point
    m_v = [n*fv for (n,fv) in zip(n_v, f_v)]
    # b5) Translate each point by that force vector
    transf = [Translation.from_vector(v) for v in m_v]
    # b6) Translate each point by the height they belong to (change out list members)
    for p, pp in enumerate(copypts):
        pp.transform(transf[p])
        pp.z = r*samplebrick.height
    # sub_lines = [Line(copypts[ip%len(copypts)], copypts[(ip+1)%len(copypts)]) for ip, p in enumerate(copypts)]       
    # b7) Add new point list to tree_pts
    tree_pts.append(copypts)
    # tree_lines.append(sub_lines)

# 3. Creation of Curves
profiles = [RhinoNurbsCurve.from_points(p, degree=deg, is_periodic=True) for p in tree_pts]
profiles = th.list_to_tree(profiles)
# line_prof = th.list_to_tree(tree_lines)
tree_pts = th.list_to_tree(tree_pts)
# ---------- end brick_paths ----------
dom = ConstructDomain(DomainStart=Slider(0.5, range=0..1), DomainEnd=1)
xy = XYPlane(Origin=base_space_curve.dwg_midpt)
draw = COMPASDraw(cg=brick_paths.profiles)  # -> rg
#   port cg: The COMPAS geometry or datastructure to be drawn.
#   port rg: The Rhino geometry object.
# ---------- draw: Python ----------
# r: compas>=2.14.1
"""
Draws COMPAS geometry in Grasshopper.
"""

from typing import Any

import Grasshopper

from compas.scene import SceneObject


class CompasToRhinoGeometry(Grasshopper.Kernel.GH_ScriptInstance):
    def RunScript(self, cg):
        if not cg:
            return None

        return SceneObject(item=cg).draw()
# ---------- end draw ----------
lng = ListLength(List=draw)
range = Range(Domain=Domain(0, 1), Steps=expr("x-1", lng))
graph = GraphMapper(
    range,
    x0=0,
    x1=1,
    y0=0,
    y1=1,
    container_name="Bezier",
    cpx=[0, 0.2521742582, 0.5108695626, 1],
    cpy=[0.2072464228, 0.4043477178, 0.09329712391, 0.07481873035])
bnd = Bounds(Numbers=graph)
remap = RemapNumbers(Value=graph, Source=bnd, Target=dom)  # -> Mapped, Clipped

number_slider_5 = Slider(13, range=0..100)  # disabled
draw_2 = COMPASDraw(cg=brick_paths.pts)  # -> rg; disabled; same code as draw
draw_3 = COMPASDraw(cg=brick_paths.t_v)  # -> rg; disabled; same code as draw
vdisex = VectorDisplayEx(Point=draw_2, Vector=draw_3, Colour=RGB(0, 0, 0), Width=number_slider_5)  # disabled

number_slider_6 = Slider(6, range=0..10)
gap = Slider(5, range=0..10)
crv_2 = Curve(reparameterize(draw))
scale_nu = ScaleNU(Geometry=crv_2, Plane=xy, ScaleX=remap.Mapped, ScaleY=remap.Mapped, ScaleZ=1)  # -> Geometry, Transform
crv_3 = Curve(reparameterize(scale_nu.Geometry))
check_script = Python3Script(crv=crv_3)  # -> out; inputs crv: list
# ---------- check_script: Python ----------
# r: compas
# venv: mas-2627
# Inputs : crv (List Access, no type hint) = the same course curves that go into Brick wall
# Outputs: out
import math as m
from compas_rhino.conversions import curve_to_compas, point_to_compas

out = []
for i, rc in enumerate(crv):
    c = curve_to_compas(rc)
    nc = c.native_curve
    d0, d1 = nc.Domain.T0, nc.Domain.T1
    out.append("--- course {} ---".format(i))

    # 1. r.length()
    out.append("compas domain: {} | Rhino domain: {:.4f} .. {:.4f}".format(c.domain, d0, d1))
    try:
        out.append("c.length() = {:.3f} | nc.GetLength() = {:.3f}".format(c.length(), nc.GetLength()))
    except Exception as e:
        out.append("c.length() FAILED ({!r}) -> use nc.GetLength() instead".format(e))

    # 2. is point_at(t) normalised (0..1) or the raw Rhino parameter?
    p = c.point_at(0.5)
    is_norm = p.distance_to_point(point_to_compas(nc.PointAt(d0 + 0.5 * (d1 - d0)))) < 1e-6
    is_raw = p.distance_to_point(point_to_compas(nc.PointAt(0.5))) < 1e-6
    if is_norm and is_raw:
        out.append("point_at(t): Rhino domain is already 0..1, both readings agree (OK)")
    elif is_norm:
        out.append("point_at(t): t is NORMALISED 0..1 (OK, as the script assumes)")
    elif is_raw:
        out.append("point_at(t): t is the RAW Rhino parameter -> the script's t in [0,1] is wrong for this curve")
    else:
        out.append("point_at(t): neither reading matches - stop and inspect")

    # 3. does the course wrap cleanly at the seam?
    out.append("closed: {} | periodic: {}".format(nc.IsClosed, nc.IsPeriodic))
    out.append("gap between point_at(0) and point_at(1): {:.6f} mm".format(
        c.point_at(0.0).distance_to_point(c.point_at(1.0))))
    out.append("tangent angle between t=0 and t=1: {:.4f} deg".format(
        m.degrees(c.tangent_at(0.0).angle(c.tangent_at(1.0)))))
    e = 1e-4
    out.append("chord across seam {:.4f} mm vs chord at t=0.5 {:.4f} mm".format(
        c.point_at(1.0 - e).distance_to_point(c.point_at(e)),
        c.point_at(0.5 - e).distance_to_point(c.point_at(0.5 + e))))
    print(out)
# ---------- end check_script ----------
brick_wall = Python3Script(
    crv=crv_3,
    orientation=list,
    max_ang=Slider(0, range=0..100),
    gap=gap,
    mid_pt=base_space_curve.dwg_midpt,
    resolution=number_slider_6,
    march_res=Slider(250, range=0..1000),
    sampling=Slider(100, range=0..100))  # -> out, param_list, rot_list, frames, samplebrick; inputs crv: list of Curve, max_ang: Double, gap: Double, mid_pt: Point3d, resolution: Int32, sampling: Int32
# ---------- brick_wall: Python ----------
# r: compas
# venv: mas-2627
from compas_rhino.devtools import DevTools
DevTools.ensure_path()
DevTools.enable_reloader()

# 0. Import everything we will need
import math as m
from compas_rhino.conversions import point_to_compas,curve_to_compas
import ghpythonlib.treehelpers as th
from compas.geometry import Polygon
from compas.geometry import Point, Vector
from compas.geometry import Frame

# ..also import our module "brick_wall.py", that needs to be in the same folder as our GH file
from brick_wall import Brick

# 0. Provide contextual definitions and set up essential variables
def remap(t, omin, omax, nmin, nmax):
    return (t-omin)/(omax-omin)*(nmax-nmin)+nmin

def frame_at(r, t):
    target_pt = r.point_at(t)
    tangent_v = r.tangent_at(t)
    frame_v = Frame(target_pt, tangent_v, Vector.cross(Vector.Zaxis(), tangent_v))
    direct_v = mid_pt - target_pt
    direct_v.z = 0.0
    direct_v.unitize()
    mag = Vector.cross(tangent_v, direct_v).z
    rot_mag = m.copysign(remap(1 - abs(mag), 0.0, 1.0, 0.0, m.radians(max_ang)), mag)
    frame_v.rotate(rot_mag, Vector.Zaxis(), target_pt)
    return frame_v, rot_mag

def blocked(frame_v, kept, sx, sy):
    return any(Brick.clash(k, frame_v, sx, sy) for k in reversed(kept))


def place_course(r, t_start, sx, sy):
    sub_t, sub_rot, sub_frm = [], [], []
    t = t_start
    frame_v, rot_mag = frame_at(r, t % 1.0)
    while True:
        sub_t.append(t % 1.0)
        sub_rot.append(rot_mag)
        sub_frm.append(frame_v)
        t_lo, t_hi = t, t
        while t_hi < t_start + 1.0:
            t_lo, t_hi = t_hi, min(t_hi + 1.0 / march_res, t_start + 1.0)
            if not blocked(frame_at(r, t_hi % 1.0)[0], sub_frm, sx, sy):
                break
        else:
            break
        for _ in range(sampling):
            t_mid = 0.5 * (t_lo + t_hi)
            if blocked(frame_at(r, t_mid % 1.0)[0], sub_frm, sx, sy):
                t_lo = t_mid
            else:
                t_hi = t_mid
        t = t_hi
        frame_v, rot_mag = frame_at(r, t % 1.0)
    return sub_t, sub_rot, sub_frm

crv = [curve_to_compas(c) for c in crv]

mid_pt = point_to_compas(mid_pt)
frames = []

# 2.
samplebrick = Brick()
samplebrick.configuration(orientation)
size_x = samplebrick.length + gap
size_y = samplebrick.width + gap

def seam_gap(course_frames):
    return Brick.slack(course_frames[-1], course_frames[0], size_x, size_y)

seam_tol = 0.5
spread_steps = 6
param_list = []
rot_list = []
gap_list = []

for ci, r in enumerate(crv):
    sub_t, sub_rot, sub_frm = ([] for i in range(3))
    # start offset per course (replaces the i % resolution offset that Frame Culling used)
    t_start = (ci % resolution) / resolution * (size_x / r.length())

    # 1. walk with the base gap
    best = place_course(r, t_start, size_x, size_y)
    best_gap = gap
    n0 = len(best[2])
    best_seam = seam_gap(best[2]) if n0 > 2 else 0.0
    if n0 > 2 and best_seam > seam_tol:
        lo, hi = gap, gap + 2.0 * best_seam / n0
        for _ in range(spread_steps):
            g = 0.5 * (lo + hi)
            trial = place_course(r, t_start, samplebrick.length + g, samplebrick.width + g)
            if len(trial[2]) >= n0:
                lo = g
                s = seam_gap(trial[2])
                if 0.0 <= s < best_seam:            
                    best, best_gap, best_seam = trial, g, s
            else:
                hi = g

    param_list.append(best[0])
    rot_list.append(best[1])
    frames.append(best[2])
    gap_list.append(best_gap)

param_list = th.list_to_tree(param_list)
rot_list = th.list_to_tree(rot_list)
frames = th.list_to_tree(frames)
# ---------- end brick_wall ----------
panel = Panel(check_script)
frame_culling = Python3Script(frames=brick_wall.frames, samplebrick=brick_wall.samplebrick, resolution=number_slider_6, gap=gap)  # -> out, sel_frames; inputs frames: tree, resolution: Int32, gap: Double; disabled
# ---------- frame_culling: Python ----------
# r: compas
# venv: mas-2627
from compas_rhino.devtools import DevTools
DevTools.ensure_path()
DevTools.enable_reloader()

# 0. Import everything we will need
import math as m
from compas_rhino.conversions import point_to_compas,curve_to_compas
import ghpythonlib.treehelpers as th
from compas.geometry import Polygon
from compas.geometry import Point, Vector
from compas.geometry import Frame

from brick_wall import Brick

frames = th.tree_to_list(frames)
size_x = samplebrick.length + gap
size_y = samplebrick.width + gap

sel_frames = []
for i, f in enumerate(frames):
    sub_sel_frames = []
    for g in f:
        if not any(Brick.clash(k, g, size_x, size_y) for k in sub_sel_frames):
            sub_sel_frames.append(g)
    sel_frames.append(sub_sel_frames)
sel_frames = th.list_to_tree(sel_frames)
# ---------- end frame_culling ----------
brick_drawing = Python3Script(frames=frame_culling.sel_frames, samplebrick=brick_wall.samplebrick)  # -> out, draw_bricks; inputs frames: tree; disabled
# ---------- brick_drawing: Python ----------
# r: compas
# venv: mas-2627
from compas_rhino.devtools import DevTools
DevTools.ensure_path()

# 0. Import everything we will need
import math as m
from compas_rhino.conversions import point_to_compas,curve_to_compas
import ghpythonlib.treehelpers as th
from compas.geometry import Polygon
from compas.geometry import Point, Vector
from compas.geometry import Frame

from brick_wall import Brick

frames = th.tree_to_list(frames)

bricks = []
for sel_f in frames:
    sub_bricks = []
    for sel_b in sel_f:
        b = Brick(sel_b)
        b.configuration(samplebrick.get_config())
        sub_bricks.append(b)
    bricks.append(sub_bricks)

draw_bricks = [[brick.draw() for brick in sb] for sb in bricks]
draw_bricks = th.list_to_tree(draw_bricks)
# ---------- end brick_drawing ----------
report = Python3Script(frames=frame_culling.sel_frames, samplebrick=brick_wall.samplebrick, gap=gap)  # -> out, report; inputs frames: tree, gap: Double; disabled
# ---------- report: Python ----------
# r: compas
# venv: mas-2627
from compas_rhino.devtools import DevTools
DevTools.ensure_path()
DevTools.enable_reloader()

import ghpythonlib.treehelpers as th
from brick_wall import Brick

frames = th.tree_to_list(frames)
size_x = samplebrick.length + gap
size_y = samplebrick.width + gap

def slack(f1, f2):
    """Centre distance minus the exact touching distance along the chord (0 = touching)."""
    d = f2.point - f1.point
    u = d.unitized()
    best = None
    for ax in (f1.xaxis, f1.yaxis, f2.xaxis, f2.yaxis):
        c = abs(u.dot(ax))
        if c > 1e-9:
            reach = sum(size_x/2 * abs(ax.dot(f.xaxis)) + size_y/2 * abs(ax.dot(f.yaxis)) for f in (f1, f2))
            best = reach / c if best is None else min(best, reach / c)
    return d.length - best

report = []
for i, c in enumerate(frames):
    n = len(c)
    clashes = sum(Brick.clash(c[a], c[b], size_x, size_y) for a in range(n) for b in range(a + 1, n))
    gaps = [slack(c[a], c[(a + 1) % n]) for a in range(n)]      # last entry = seam (last -> first)
    report.append("course {}: {} bricks | clashing pairs {} | mean gap {:.2f} | worst gap {:.2f} | seam gap {:.2f}".format(
        i, n, clashes, sum(gaps[:-1]) / (n - 1), max(gaps[:-1]), gaps[-1]))
# ---------- end report ----------
draw_4 = COMPASDraw(cg=brick_drawing.draw_bricks)  # -> rg; disabled; same code as draw
