# Grasshopper definition kleine_tor_alva.gh (Grasshopper 1.0.8)

py3 = Python3Script()  # -> out, layers, mesh
# ---------- py3: Python ----------
import Rhino.Geometry as rg
import numpy as np
import math as m

class Column:
    def __init__(self, axis: rg.Curve, radius_base: float, radius_top: float):
        self.axis = axis
        # reparameterize axis
        self.axis.Domain = rg.Interval(0,1)
        self.r_base = radius_base
        self.r_top = radius_top
        self.height = axis.PointAtEnd.Z - axis.PointAtStart.Z
        self.radius_bezier = self.gen_radius_bezier()

    def gen_radius_bezier(self) -> rg.BezierCurve:
        pts = [
            rg.Point2d(0, 0),
            rg.Point2d(0.6, 3),
            rg.Point2d(0.9, 5),
            rg.Point2d(1.0, 0.5)
        ]
        return rg.BezierCurve(pts)

    def get_radius(self, tz) -> float:
        # power
        # tz = m.pow(tz, 3)
        # return self.r_base*(1-tz) + self.r_top*(tz)

        # beizer curve
        bezier = self.radius_bezier.PointAt(tz)
        amp = 10
        return self.r_base*(1-tz) + self.r_top*(tz) + bezier.Y*amp

    def get_pattern(self, angle, tz) -> float:
        a = angle
        freq = 4
        amp = 5

        # shift angle
        shift = m.pow(tz, 2.5)
        shift *= m.pi
        
        # fade out amp
        fade = m.pow(tz,1)
        # amp *= fade
        # pattern = m.cos((a+shift)*freq)*amp

        # blend multiple freq
        freqs = [3, 8, 4]
        set_freqs = [m.cos((a+shift)*f)*(amp+3*(1-tz)) for f in freqs]
        t_sets = [t for t in np.linspace(0,1,len(freqs))]
        pattern = np.interp(tz, t_sets, set_freqs)
        
        # add reverse pattern
        set_freqs = [m.cos((a-shift)*f)*(amp+3*tz) for f in freqs]
        r_pattern = np.interp(tz, t_sets, set_freqs)

        # try different blend
        pattern = (pattern + r_pattern)*.5
        pattern = max(pattern, r_pattern)
        # pattern = min(pattern, r_pattern)
        # pattern = pattern*(1-tz) + r_pattern*tz

        return pattern

    def get_point(self, angle, tz) -> rg.Point3d:
        """
        Get point on the column at certain angle and height

        Args:
        angle: angle of the point in radians
        tz: normalize parameter of the height along the axis

        Returns:
        The list of polylinecurve for each layer
        """
        radius = self.get_radius(tz)
        radius += self.get_pattern(angle, tz)
        origin = self.axis.PointAt(tz)
        vector = rg.Vector3d(
            radius*m.cos(angle),
            radius*m.sin(angle),
            0
        )
        return origin+vector

    def print_paths(self, resolution: int, layer_height: float) -> list[int, list[rg.PolylineCurve]]:
        """
        Generate print path of the columns

        Args:
        resolution: division around the circumference
        layer_height: distance between vertical layers in mm.

        Returns:
        The list of polylinecurve for each layer
        """

        lh = int(self.height // layer_height)
        layers = []

        for tz in np.linspace(0, 1, lh+1, endpoint=True)[1:]:
            pts = []
            for angle in np.linspace(0, 2*np.pi, resolution+1, endpoint=True)[:-1]:
                pts.append(self.get_point(angle, tz))
            
            layers.append(
                pts
            )
        return lh, layers
    
    @ staticmethod
    def to_mesh(crvs: list[rg.PolylineCurve], closed: bool = True) -> rg.Mesh:
        mesh = rg.Mesh()
        for layer in crvs:
            for pt in layer:
                mesh.Vertices.Add(pt)
        
        idx = np.array(range(mesh.Vertices.Count))
        idx = idx.reshape(len(crvs), len(layers))

        if closed:
            faces = np.stack([
                idx[:-1],                             # Top-left
                np.roll(idx[:-1], -1, axis=1),        # Top-right
                idx[1:],                              # Bottom-left
                np.roll(idx[1:], -1, axis=1)          # Bottom-right
            ], axis=-1).reshape(-1, 4)
        else:
            faces = np.lib.stride_tricks.sliding_window_view(
                idx, window_shape=(2, 2)
            ).reshape(-1, 4)
        
        for f in faces:
            mesh.Faces.AddFace(
                int(f[0]),
                int(f[1]),
                int(f[3]),
                int(f[2])
            )

        mesh.Compact()
        mesh.RebuildNormals()
        return mesh

            


if __name__ == "__main__":
    axis = rg.LineCurve(
        rg.Point3d(0,0,0),
        rg.Point3d(10,10,300)
    )
    r1 = 10
    r2 = 10

    column = Column(axis, r1, r2)
    layer_count, layers = column.print_paths(150, 2)
    mesh = Column.to_mesh(layers, closed=True)
# ---------- end py3 ----------
preview = CustomPreview(
    Geometry=py3.mesh,
    Material={diffuse=RGB(221, 160, 221), emission=RGB(66, 48, 66), shine=0.5, specular=RGB(255, 255, 255), transparency=0})
python_3_script = Python3Script()  # -> out, layers, flatten(mesh)
# ---------- python_3_script: Python ----------
import Rhino.Geometry as rg
import math as m
import numpy as np

class Column:
    
    def __init__(self, axis: rg.Curve, radius_base: float, radius_top: float):

        self.axis = axis
        self.radius_base = radius_base
        self.radius_top = radius_top
        self.height = axis.PointAtEnd.Z - axis.PointAtStart.Z
        # Reparametrize the curve
        self.axis.Domain = rg.Interval(0.0 , 1.0)


    def get_point(self, angle: float, tz: float) -> rg.Point3d:

        """
        Args:
            angle: angle in polar coord.in radians
            tz: parameter on axis

        """

        origin = self.axis.PointAt(tz)
        radius = self.get_radius_wave(angle, tz, 2, 5)

        pt = rg.Point3d(
            origin.X + m.cos(angle) * radius,
            origin.Y + m.sin(angle) * radius,
            origin.Z
        )

        return pt


    def get_radius(self, angle: float, tz: float) -> float:
        return self.radius_base * (1-tz) + self.radius_top * tz

    def get_radius_bezier(self, tz: float) -> float:
        bezier = rg.BezierCurve(
            [
                rg.Point2d(-5,-5),
                rg.Point2d(0.2,8),
                rg.Point2d(0.8,-0.5),
                rg.Point2d(0.2,1)
            ]
        )

        radius = self.radius_base * (1 - tz) + self.radius_top * (tz)
        radius += bezier.PointAt(tz).Y * 5
        return radius

    def get_radius_wave(self, angle: float, tz: float, freq: int, amp: float) -> float:

        # rotate

        # shift = tz * m.radians(135)
        # angle += shift
        
        # fade
        # amp =  m.sqrt(1 - tz) * amp

        # radius = self.get_radius(angle,tz) + (m.cos(angle*freq) * amp)
        # return radius

        # blend wave frequency
        # freq1 = 3
        # freq2 = 5

        # _r1 = m.cos(angle*freq1) * amp
        # _r2 = m.cos(angle*freq2) * amp

        # radius = self.get_radius(angle,tz) + _r1*(1-tz) + _r2*(tz)
        # return radius

        # rotate in both directions
        shift = tz * m.radians(360)

        _r1 = self.get_radius(angle, tz) + m.cos((angle+2*shift)*freq)*amp
        _r2 = self.get_radius(angle, tz) + m.cos((angle-shift) * freq)*amp
        radius =  _r1*(1-tz) + _r2*(tz)
        return radius



    def get_layers(self, layer_height : float, res_u: int) -> list[int, list[rg.Point3d]]:

        layers_count = int(self.height // layer_height) + 1

        layers = []

        for tz in np.linspace(0, 1, layers_count)[1: ]:
            layer = []
            for angle in np.linspace(0, m.tau, res_u)[ : -1 ]:
                pt = (self.get_point(angle, tz))
                layer.append(pt)

            layers.append(layer)

        return layers

    @staticmethod
    def get_mesh(layers: list[list[rg.Point3d]], closed: bool) -> rg.Mesh:
        mesh = rg.Mesh()

        for layer in layers:
            for pt in layer:
                mesh.Vertices.Add(pt)

        idx = np.array(range(mesh.Vertices.Count))
        idx = idx.reshape(len(layers),len(layer))

        if closed:
            faces = np.stack([
                idx[:-1],
                np.roll(idx[:-1], -1, axis = 1),
                np.roll(idx[1:], -1, axis = 1),
                idx[1:]

            ], axis = -1).reshape(-1,4)
            print(faces)

        else:
            faces = np.lib.stride_tricks.sliding_window_view(
                idx, window_shape=(2,2)
            ).reshape(-1,4)

            print(faces)

        for face in faces:
            mesh.Faces.AddFace(
            *[int(f) for f in face]
            )

        mesh.Compact()
        mesh.RebuildNormals()
        
        return mesh

        

if __name__ == "__main__":

    axis = rg.LineCurve(
        rg.Point3d(150, 150,0),
        rg.Point3d(150,150,100)
    )


    my_column = Column(axis,30,30)
    layers = my_column.get_layers(2,75)

    mesh = Column.get_mesh(layers, closed = True)

    import ghpythonlib.treehelpers as tree
    layers = tree.list_to_tree(layers)
# ---------- end python_3_script ----------
bezier_span = BezierSpan()  # -> Curve, Length, Domain
mesh = Mesh(python_3_script.mesh)
range = Range(Domain=Domain(0, 1), Steps=10)
polyline = PolyLine(Vertices=python_3_script.layers, Closed=False)  # -> flatten(Polyline)
custom_preview = CustomPreview(
    Geometry=mesh,
    Material={diffuse=RGB(221, 160, 221), emission=RGB(66, 48, 66), shine=0.5, specular=RGB(255, 255, 255), transparency=0})
quick_graph = QuickGraph(range, SortOrder=0)
reverse_list = ReverseList(List=polyline)
loft = Loft(Curves=reverse_list, Options={Adjust=False, Closed=False, LoftEnds=0, LoftSimp=0, LoftType=0, Rebuild=10, Refit=0.01})
custom_preview_2 = CustomPreview(
    Geometry=loft,
    Material={diffuse=RGB(221, 160, 221), emission=RGB(66, 48, 66), shine=0.5, specular=RGB(255, 255, 255), transparency=0})
