# Grasshopper definition 261108_gh_to_vscode.gh (Grasshopper 1.0.8)

# ---- group: This is needed only ONCE in the GH definition
enable_auto_reload = Python3Script()  # -> ok
# ---------- enable_auto_reload: Python ----------
"""
------------------------------
Using VS Code as Python editor
------------------------------

The simplest way to start using VS Code as our editor, is
to place our Python code in files located IN THE SAME FOLDER as our Grasshopper file.

After we have done that, we need 2 steps: 

1. Enable the COMPAS reloader on one component. This tells Grasshopper to watch for changes in the Pythoh files and reload if changed.
2. Every other component that uses Python code from external files needs to start with a method to ensure Grasshopper knows where to load the files from.

"""
# r: compas
# venv: mas-2627

from compas_rhino.devtools import DevTools
DevTools.enable_reloader()
# ---------- end enable_auto_reload ----------

# ---- group: Base curve from Rhino
base_curve = Curve(<curve referenced from the Rhino model>)

# ----
number_slider = Slider(0.9, range=0..10)
unit_z = UnitZ(Factor=number_slider)
move = Move(Geometry=base_curve, Motion=unit_z)  # -> Geometry, Transform

# ---- group: moving base curves in z direction / Layer height
number_slider_2 = Slider(5, range=0..10)

# ---- group: moving base curves in z direction
number_slider_3 = Slider(8, range=0..100)
series = Series(Start=0, Step=number_slider_2, Count=number_slider_3)
unit_z_2 = UnitZ(Factor=series)
move_2 = Move(Geometry=base_curve, Motion=unit_z_2)  # -> Geometry, Transform

# ---- group: Total height
# Number of print layers
multiplication = Multiplication(A=number_slider_2, B=number_slider_3)
panel = Panel(multiplication)

# ---- group: Select alternate curves
dispatch = Dispatch(List=move_2.Geometry, DispatchPattern=[True, False])  # -> ListA, ListB

# ---- group: Tail for print start
curve = Curve(<curve referenced from the Rhino model>)
unit_z_3 = UnitZ(Factor=number_slider)
move_3 = Move(Geometry=curve, Motion=unit_z_3)  # -> Geometry, Transform

# ----
odd_curves = Curve(dispatch.ListB)
even_curves = Curve(dispatch.ListA)
number_slider_4 = Slider(8, range=0..10)

# ---- group: Divide curve into points
number_slider_5 = Slider(30, range=0..100)
divide_curve = DivideCurve(Curve=even_curves, Count=number_slider_5, Kinks=False)  # -> Points, Tangents, Parameters

divide_curve_2 = DivideCurve(Curve=odd_curves, Count=number_slider_5, Kinks=False)  # -> Points, Tangents, Parameters

# ---- group: Odd and even points
dispatch_2 = Dispatch(List=divide_curve.Points, DispatchPattern=[True, False])  # -> ListA, ListB

dispatch_3 = Dispatch(List=divide_curve_2.Points, DispatchPattern=[True, False])  # -> ListA, ListB

# ----
list_item = ListItem(List=even_curves, Index=0, Wrap=True)
divide_curve_3 = DivideCurve(Curve=list_item, Count=Slider(40, range=0..100), Kinks=False)  # -> Points, Tangents, Parameters
polyline = PolyLine(Vertices=divide_curve_3.Points, Closed=Slider(1, range=0..1))  # -> flatten(Polyline)

odd_curves_odd_points = Point(dispatch_3.ListB)
odd_curves_odd_points_2 = Point(dispatch_2.ListB)
odd_curves_even_points = Point(dispatch_2.ListA)
odd_curves_even_points_2 = Point(dispatch_3.ListA)

# ---- group: MOve alternate points down
unit_z_4 = UnitZ(Factor=number_slider_4)
move_4 = Move(Geometry=odd_curves_odd_points_2, Motion=unit_z_4)  # -> Geometry, Transform

# ---- group: Move alternate points up
unit_z_5 = UnitZ(Factor=number_slider_4)
move_5 = Move(Geometry=odd_curves_even_points_2, Motion=unit_z_5)  # -> Geometry, Transform

# ----
weave = Weave(Pattern=[0, 1], Stream0=odd_curves_even_points, Stream1=move_4.Geometry, NullGaps=False)
weave_2 = Weave(Pattern=[0, 1], Stream0=move_5.Geometry, Stream1=odd_curves_odd_points, NullGaps=False)

# ---- group: polyline for even zig zag curves
polyline_2 = PolyLine(Vertices=weave, Closed=Slider(1, range=0..1))  # -> flatten(Polyline)

polyline_3 = PolyLine(Vertices=weave_2, Closed=Slider(1, range=0..1))  # -> flatten(Polyline)

# ---- group: all curves
merge = Merge(Data1=polyline, Data2=polyline_2, Data3=polyline_3)  # -> flatten(Result)

# ---- group: Sort curves based on their layer height
evaluate_curve = EvaluateCurve(Curve=merge, Parameter=Slider(0.5, range=0..1))  # -> Point, Tangent, Angle
deconstruct = Deconstruct(Point=evaluate_curve.Point)  # -> XComponent, YComponent, ZComponent
sort_list = SortList(Keys=deconstruct.ZComponent, ValuesValuesA=merge)  # -> Keys, ValuesValuesA

# ---- group: All print layers
merge_2 = Merge(Data1=move_3.Geometry, Data2=sort_list.ValuesValuesA)  # -> flatten(Result)

# ----
# Export
list_item_2 = ListItem(List=merge_2, Index=0, Wrap=True)  # -> Item, Item1

# ---- group: convert to compas polylines
python_3_script = Python3Script(r_curves=merge_2)  # -> flatten(compas_polylines); inputs r_curves: list
# ---------- python_3_script: Python ----------
from compas_rhino.conversions import curve_to_compas
from compas_rhino.conversions import curve_to_compas_polyline


# compas_curves = []

# for curve in r_curves:
#     c_curve = curve_to_compas(curve)
#     compas_curves.append(c_curve)

compas_polylines = []

for c in r_curves:
    p_curve = curve_to_compas_polyline(c)
    compas_polylines.append(p_curve)
# ---------- end python_3_script ----------

# ----
safety_distance_mm = Slider(100, range=10..300)
blend_radius_mm = Slider(0, range=0..5)
speed_mm_s = Slider(8, range=1..50)
printpath = Printpath(layers=python_3_script, speed=speed_mm_s, blend_radius=blend_radius_mm, safety_distance=safety_distance_mm)  # -> printpath, summary; inputs layers: list
# ---------- printpath: Python ----------
# r: compas
# venv: mas-2627
"""
Turn the layers into printpoints and a PrintPath, in work object coordinates.
Safety points are added here, before any transform to the robot base.
"""
import os
import sys

from compas.geometry import Frame, Vector


# Find source folder
gh_dir = os.path.dirname(ghenv.Component.OnPingDocument().FilePath)
src_dir = os.path.join(gh_dir, "..", "..", "src")
if src_dir not in sys.path:
    sys.path.append(src_dir)
from print_class import PrintPoint, PrintPath

# ===== One printpoint per point =====
# world XY orientation for every point: a tangent frame would turn the wrist 360 degrees each layer
printpoints = []
for layer_index, layer in enumerate(layers):
    for point in layer.points:
        frame = Frame(point, -Vector.Xaxis(), Vector.Yaxis())
        printpoints.append(PrintPoint(frame, layer_index, speed, blend_radius, True))

# ===== Path with a travel point above the start and the end =====
printpath = PrintPath(printpoints)
printpath.add_safety_before(safety_distance, speed)
printpath.add_safety_after(safety_distance, speed)

summary = f"{len(printpoints)} printpoints in {len(layers)} layers, plus 2 safety points"
# ---------- end printpath ----------
panel_2 = Panel(printpath.summary)

save = Button()
save_2 = Save(printpath=printpath.printpath, save=save, out_path="data/out_printpoints_trial02.json")  # -> status
# ---------- save_2: Python ----------
# r: compas
# venv: mas-2627
"""
On button press, write the printpath to data/out_printpoints.json next to this .ghx file.
send_to_robot.py reads that file.
"""
import json
import os

import scriptcontext as sc

gh_dir = os.path.dirname(ghenv.Component.OnPingDocument().FilePath)

# keep the last status in sticky, so the message survives the button being released
status_key = "save_status_" + str(ghenv.Component.InstanceGuid)

if save:
    if printpath is None:
        sc.sticky[status_key] = "nothing to save: no printpath"
    else:
        path = os.path.normpath(os.path.join(gh_dir, out_path))
        os.makedirs(os.path.dirname(path), exist_ok=True)
        with open(path, "w") as f:
            json.dump(printpath.to_dict(), f, indent=2)
        sc.sticky[status_key] = f"saved {len(printpath)} printpoints to {path}"

status = sc.sticky.get(status_key, "")
ghenv.Component.Message = "saved" if status.startswith("saved") else status
# ---------- end save_2 ----------

preview = Preview(printpath=printpath.printpath)  # -> path, travel, planes
# ---------- preview: Python ----------
# r: compas
# venv: mas-2627
"""
Draw the printpath: path = the whole polyline, travel = extruder-off segments,
safety = extruder-off points, axes = small x and y axis of each frame.
"""
import Rhino.Geometry as rg
from compas_rhino.conversions import frame_to_rhino_plane, point_to_rhino

AXIS_LENGTH = 5.0  # mm

points = printpath.printpoints
planes = [frame_to_rhino_plane(printpoint.frame) for printpoint in points]

# ===== Whole path =====
polyline = rg.Polyline()
for plane in planes:
    polyline.Add(plane.Origin.X, plane.Origin.Y, plane.Origin.Z)
path = polyline.ToPolylineCurve()

# ===== Extruder off: a segment prints only if both of its points have the extruder on =====
safety = [point_to_rhino(printpoint.frame.point) for printpoint in points if not printpoint.is_extruder_on]
travel = []
for i in range(len(points) - 1):
    if not (points[i].is_extruder_on and points[i + 1].is_extruder_on):
        travel.append(rg.Line(planes[i].Origin, planes[i + 1].Origin))
# ---------- end preview ----------
plane = Plane(preview.planes)
preview_2 = CustomPreview(Geometry=preview.travel, Material=ColourSwatch(SwatchColor=RGB(230, 40, 40)))
# TEMP
preview_3 = CustomPreview(Geometry=preview.path, Material=ColourSwatch(SwatchColor=RGB(0, 170, 80)))

panel_3 = Panel(save_2)
