# Grasshopper definition design.gh (Grasshopper 1.0.8)

# ---- group: This is needed only ONCE in the GH definition
enable_auto_reload = Python3Script()  # -> ok
# ---------- enable_auto_reload: Python ----------
"""
------------------------------
Using VS Code as Python editor
------------------------------

The simplest way to start using VS Code as our editor, is
to place our Python code in files located IN THE SAME FOLDER as our Grasshopper file.

After we have done that, we need 2 steps: 

1. Enable the COMPAS reloader on one component. This tells Grasshopper to watch for changes in the Pythoh files and reload if changed.
2. Every other component that uses Python code from external files needs to start with a method to ensure Grasshopper knows where to load the files from.

"""
# r: compas
# venv: mas-2627

from compas_rhino.devtools import DevTools
DevTools.enable_reloader()
# ---------- end enable_auto_reload ----------

# ----
# \\ Print sample 01
number_slider = Slider(198, range=0..1000)
construct_point = ConstructPoint(XCoordinate=number_slider, YCoordinate=Slider(150, range=0..1000), ZCoordinate=Slider(0, range=0..10))

# ---- group: Total Height
number_slider_2 = Slider(125, range=0..1000)

# ---- group: Layer thickness
number_slider_3 = Slider(5, range=0..10)

# ----
circle = Circle(Plane=construct_point, Radius=Slider(35, range=0..100))

# ---- group: total height
panel = Panel("0 to 125")

# ----
division = Division(A=number_slider_2, B=number_slider_3)
range = Range(Domain=panel, Steps=expr("x-1", division))
unit_z = UnitZ(Factor=range)

# ---- group: Input curve
curve = Curve(<curve referenced from the Rhino model>)

# ---- group: creating base curves
series = Series(Start=0, Step=Slider(3, range=0..10), Count=Slider(3, range=0..10))
unit_z_2 = UnitZ(Factor=series)
move = Move(Geometry=circle, Motion=unit_z_2)  # -> Geometry, Transform

# ---- group: Total Height
number_slider_4 = Slider(35, range=0..1000)

# ---- group: Layer thickness
number_slider_5 = Slider(4, range=0..10)

# ---- group: Nozzle thickness
number_slider_6 = Slider(1.5, range=0..10)

# ---- group: total height
# Number of print layers
panel_2 = Panel("0 to 50")

# ----
division_2 = Division(A=number_slider_4, B=number_slider_6)
range_2 = Range(Domain=panel_2, Steps=expr("x-1", division_2))
unit_z_3 = UnitZ(Factor=range_2)

# ---- group: Input curve
curve_2 = Curve(<curve referenced from the Rhino model>)

# ---- group: Move the layers
move_2 = Move(Geometry=curve_2, Motion=unit_z_3)  # -> Geometry, Transform

# ---- group: Divide the curves into number of points
divide_curve = DivideCurve(Curve=flatten(move_2.Geometry), Count=Slider(90, range=0..100), Kinks=False)  # -> Points, Tangents, Parameters

# ---- group: Move factor = layer height
number_slider_7 = Slider(4, range=-11..11.01)
unit_z_4 = UnitZ(Factor=number_slider_7)

# ----
# Move the odd points outwards or upwards to get a pattern
number_slider_8 = Slider(2, range=0..10)
unit_z_5 = UnitZ(Factor=number_slider_8)

evaluate_curve = EvaluateCurve(Curve=graft(move_2.Geometry), Parameter=divide_curve.Parameters)  # -> Point, Tangent, Angle
amplitude = Amplitude(Vector=evaluate_curve.Tangent, Amplitude=number_slider_8)

speed_mm_s = Slider(14, range=1..50)
safety_distance_mm = Slider(100, range=10..300)
blend_radius_mm = Slider(0.5, range=0..5)
save = Button()

# ----
# Export
# Move the odd points outwards or upwards to get a pattern
# Dispatch points to list of points at even and odd indices
# Number of print layers
number_slider_9 = Slider(8, range=0..10)
unit_z_6 = UnitZ(Factor=number_slider_9)
move_3 = Move(Geometry=circle, Motion=unit_z_6)  # -> Geometry, Transform
curve_3 = Curve(move.Geometry)
divide_curve_2 = DivideCurve(Curve=flatten(curve_3), Count=Slider(10, range=0..100), Kinks=False)  # -> Points, Tangents, Parameters

# ---- group: Move the layers
move_4 = Move(Geometry=move_3.Geometry, Motion=unit_z)  # -> Geometry, Transform

# ---- group: Divide the curves into number of points
divide_curve_3 = DivideCurve(Curve=flatten(move_4.Geometry), Count=Slider(20, range=0..100), Kinks=False)  # -> Points, Tangents, Parameters

# ----
evaluate_curve_2 = EvaluateCurve(Curve=graft(move_4.Geometry), Parameter=divide_curve_3.Parameters)  # -> Point, Tangent, Angle
amplitude_2 = Amplitude(Vector=evaluate_curve_2.Tangent, Amplitude=number_slider_7)

# ---- group: base curve
polyline = PolyLine(Vertices=divide_curve_2.Points, Closed=Slider(1, range=0..1))  # -> flatten(Polyline)

# ----
panel_3 = Panel("""True
False""")

# ---- group: Dispatch list to even and odd points
dispatch = Dispatch(List=divide_curve_3.Points, DispatchPattern=panel_3)  # -> ListA, ListB

# ----
odd_points = Point(dispatch.ListB)
even_points = Point(dispatch.ListA)

move_5 = Move(Geometry=even_points, Motion=unit_z_4)  # -> Geometry, Transform

# ---- group: Weave the list back
weave = Weave(Pattern=[0, 1], Stream0=even_points, Stream1=move_5.Geometry, NullGaps=False)

# ---- group: Polylines as print path
polyline_2 = PolyLine(Vertices=weave, Closed=Slider(1, range=0..1))  # -> flatten(Polyline)

# ----
merge = Merge(Data1=polyline, Data2=polyline_2)  # -> flatten(Result)

# ---- group: convert rhino polyliness to compas lines
python_3_script = Python3Script(r_curves=merge)  # -> flatten(compas_polylines); inputs r_curves: list
# ---------- python_3_script: Python ----------
from compas_rhino.conversions import curve_to_compas
from compas_rhino.conversions import curve_to_compas_polyline


# compas_curves = []

# for curve in r_curves:
#     c_curve = curve_to_compas(curve)
#     compas_curves.append(c_curve)

compas_polylines = []

for c in r_curves:
    p_curve = curve_to_compas_polyline(c)
    compas_polylines.append(p_curve)
# ---------- end python_3_script ----------

# ---- group: generaate print paths and print outputs
speed_mm_s_2 = Slider(14, range=1..50)
safety_distance_mm_2 = Slider(100, range=10..300)
blend_radius_mm_2 = Slider(0.5, range=0..5)
printpath = Printpath(layers=python_3_script, speed=speed_mm_s_2, blend_radius=blend_radius_mm_2, safety_distance=safety_distance_mm_2)  # -> printpath, summary; inputs layers: list
# ---------- printpath: Python ----------
# r: compas
# venv: mas-2627
"""
Turn the layers into printpoints and a PrintPath, in work object coordinates.
Safety points are added here, before any transform to the robot base.
"""
import os
import sys

from compas.geometry import Frame, Vector


# Find source folder
gh_dir = os.path.dirname(ghenv.Component.OnPingDocument().FilePath)
src_dir = os.path.join(gh_dir, "..", "..", "src")
if src_dir not in sys.path:
    sys.path.append(src_dir)
from print_class import PrintPoint, PrintPath

# ===== One printpoint per point =====
# world XY orientation for every point: a tangent frame would turn the wrist 360 degrees each layer
printpoints = []
for layer_index, layer in enumerate(layers):
    for point in layer.points:
        frame = Frame(point, -Vector.Xaxis(), Vector.Yaxis())
        printpoints.append(PrintPoint(frame, layer_index, speed, blend_radius, True))

# ===== Path with a travel point above the start and the end =====
printpath = PrintPath(printpoints)
printpath.add_safety_before(safety_distance, speed)
printpath.add_safety_after(safety_distance, speed)

summary = f"{len(printpoints)} printpoints in {len(layers)} layers, plus 2 safety points"
# ---------- end printpath ----------
panel_4 = Panel(printpath.summary)

# ----
save_2 = Button()
preview = Preview(printpath=printpath.printpath)  # -> path, travel, planes
# ---------- preview: Python ----------
# r: compas
# venv: mas-2627
"""
Draw the printpath: path = the whole polyline, travel = extruder-off segments,
safety = extruder-off points, axes = small x and y axis of each frame.
"""
import Rhino.Geometry as rg
from compas_rhino.conversions import frame_to_rhino_plane, point_to_rhino

AXIS_LENGTH = 5.0  # mm

points = printpath.printpoints
planes = [frame_to_rhino_plane(printpoint.frame) for printpoint in points]

# ===== Whole path =====
polyline = rg.Polyline()
for plane in planes:
    polyline.Add(plane.Origin.X, plane.Origin.Y, plane.Origin.Z)
path = polyline.ToPolylineCurve()

# ===== Extruder off: a segment prints only if both of its points have the extruder on =====
safety = [point_to_rhino(printpoint.frame.point) for printpoint in points if not printpoint.is_extruder_on]
travel = []
for i in range(len(points) - 1):
    if not (points[i].is_extruder_on and points[i + 1].is_extruder_on):
        travel.append(rg.Line(planes[i].Origin, planes[i + 1].Origin))
# ---------- end preview ----------
save_3 = Save(printpath=printpath.printpath, save=save_2, out_path="data/out_printpoints_trial01.json")  # -> status
# ---------- save_3: Python ----------
# r: compas
# venv: mas-2627
"""
On button press, write the printpath to data/out_printpoints.json next to this .ghx file.
send_to_robot.py reads that file.
"""
import json
import os

import scriptcontext as sc

gh_dir = os.path.dirname(ghenv.Component.OnPingDocument().FilePath)

# keep the last status in sticky, so the message survives the button being released
status_key = "save_status_" + str(ghenv.Component.InstanceGuid)

if save:
    if printpath is None:
        sc.sticky[status_key] = "nothing to save: no printpath"
    else:
        path = os.path.normpath(os.path.join(gh_dir, out_path))
        os.makedirs(os.path.dirname(path), exist_ok=True)
        with open(path, "w") as f:
            json.dump(printpath.to_dict(), f, indent=2)
        sc.sticky[status_key] = f"saved {len(printpath)} printpoints to {path}"

status = sc.sticky.get(status_key, "")
ghenv.Component.Message = "saved" if status.startswith("saved") else status
# ---------- end save_3 ----------
plane = Plane(preview.planes)
preview_2 = CustomPreview(Geometry=preview.travel, Material=ColourSwatch(SwatchColor=RGB(230, 40, 40)))
panel_5 = Panel(save_3)
# TEMP
preview_3 = CustomPreview(Geometry=preview.path, Material=ColourSwatch(SwatchColor=RGB(0, 170, 80)))

panel_6 = Panel("""True
False""")

# ---- group: Dispatch list to even and odd points
# Dispatch points to list of points at even and odd indices
dispatch_2 = Dispatch(List=divide_curve.Points, DispatchPattern=panel_6)  # -> ListA, ListB

# ----
odd_points_2 = Point(dispatch_2.ListB)
even_points_2 = Point(dispatch_2.ListA)

move_6 = Move(Geometry=odd_points_2, Motion=unit_z_5)  # -> Geometry, Transform

# ---- group: Weave the list back
weave_2 = Weave(Pattern=[0, 1], Stream0=even_points_2, Stream1=move_6.Geometry, NullGaps=False)

# ---- group: Interpolate the points to get print path
interpolate = Interpolate(Vertices=weave_2, Degree=3, Periodic=Slider(1, range=0..1), KnotStyle=1)  # -> Curve, Length, Domain

# ----
polyline_3 = PolyLine(Vertices=weave_2, Closed=Slider(1, range=0..1))  # -> flatten(Polyline)
python_3_script_2 = Python3Script(r_curves=polyline_3)  # -> flatten(compas_polylines); inputs r_curves: list; same code as python_3_script
printpath_2 = Printpath(layers=python_3_script_2, speed=speed_mm_s, blend_radius=blend_radius_mm, safety_distance=safety_distance_mm)  # -> printpath, summary; inputs layers: list; same code as printpath
panel_7 = Panel(printpath_2.summary)
preview_4 = Preview(printpath=printpath_2.printpath)  # -> path, travel, planes; same code as preview
save_4 = Save(printpath=printpath_2.printpath, save=save, out_path="data/out_printpoints_trial01.json")  # -> status; same code as save_3
plane_2 = Plane(preview_4.planes)
# Export
preview_5 = CustomPreview(Geometry=preview_4.travel, Material=ColourSwatch(SwatchColor=RGB(230, 40, 40)))
panel_8 = Panel(save_4)
preview_6 = CustomPreview(Geometry=preview_4.path, Material=ColourSwatch(SwatchColor=RGB(0, 170, 80)))
