# Grasshopper definition design_iterations.gh (Grasshopper 1.0.8)

# ---- group: DESIGN
point_spacing_mm = Slider(6, range=1..50)  # disabled
layer_height_mm = Slider(1, range=0.5..10)  # disabled
height_mm = Slider(50, range=1..500)  # disabled
radius_mm = Slider(50, range=5..200)  # disabled

center_x_mm = Slider(0, range=-500..500)  # disabled
center_y_mm = Slider(0, range=-500..500)  # disabled
fine_adjust_z_mm = Slider(0, range=-5..5)  # disabled

# design: "slice" a cylinder
slice_cylinder = SliceCylinder(
    radius=radius_mm,
    height=height_mm,
    layer_height=layer_height_mm,
    point_spacing=point_spacing_mm,
    center_x=center_x_mm,
    center_y=center_y_mm,
    fine_adjust_z=fine_adjust_z_mm)  # -> layers; disabled
# ---------- slice_cylinder: Python ----------
# r: compas
# venv: mas-2627
"""
Slice a cylinder into layers, in work object coordinates (Rhino world XY = work object).
One closed compas Polyline per layer. Units: mm.
center_x, center_y: where the cylinder stands on the work object.
fine_adjust_z: shifts all layers up/down, to tune the nozzle height above the bed (0 = first layer at z = 0).
"""
import math

from compas.geometry import Point
from compas.geometry import Polyline

# ===== How many layers, how many points per layer =====
layer_count = int(height / layer_height)
points_per_layer = round(2 * math.pi * radius / point_spacing)

# ===== One closed polyline per layer =====
layers = []
for i in range(layer_count):
    z = i * layer_height + fine_adjust_z
    points = []
    for j in range(points_per_layer + 1):  # one extra point: back to the start to close the ring
        angle = 2 * math.pi * (j % points_per_layer) / points_per_layer
        points.append(Point(center_x + radius * math.cos(angle), center_y + radius * math.sin(angle), z))
    layers.append(Polyline(points))
# ---------- end slice_cylinder ----------

# ---- group: PRINTPATH
# generate printpath: printpoints and path
safety_distance_mm = Slider(100, range=10..300)  # disabled
blend_radius_mm = Slider(0.5, range=0..5)  # disabled
speed_mm_s = Slider(10, range=1..50)  # disabled
printpath = Printpath(layers=slice_cylinder, speed=speed_mm_s, blend_radius=blend_radius_mm, safety_distance=safety_distance_mm)  # -> printpath, summary; inputs layers: list; disabled
# ---------- printpath: Python ----------
# r: compas
# venv: mas-2627
"""
Turn the layers into printpoints and a PrintPath, in work object coordinates.
Safety points are added here, before any transform to the robot base.
"""
import os
import sys

from compas.geometry import Frame, Vector


# Find source folder
gh_dir = os.path.dirname(ghenv.Component.OnPingDocument().FilePath)
src_dir = os.path.join(gh_dir, "..", "..", "src")
if src_dir not in sys.path:
    sys.path.append(src_dir)
from print_class import PrintPoint, PrintPath

# ===== One printpoint per point =====
# world XY orientation for every point: a tangent frame would turn the wrist 360 degrees each layer
printpoints = []
for layer_index, layer in enumerate(layers):
    for point in layer.points:
        frame = Frame(point, -Vector.Xaxis(), Vector.Yaxis())
        printpoints.append(PrintPoint(frame, layer_index, speed, blend_radius, True))

# ===== Path with a travel point above the start and the end =====
printpath = PrintPath(printpoints)
printpath.add_safety_before(safety_distance, speed)
printpath.add_safety_after(safety_distance, speed)

summary = f"{len(printpoints)} printpoints in {len(layers)} layers, plus 2 safety points"
# ---------- end printpath ----------
panel = Panel(printpath.summary)  # disabled

# ----
draw = COMPASDraw(cg=slice_cylinder)  # -> rg; disabled
#   port cg: The COMPAS geometry or datastructure to be drawn.
#   port rg: The Rhino geometry object.
# ---------- draw: Python ----------
# r: compas>=2.14.1
"""
Draws COMPAS geometry in Grasshopper.
"""

from typing import Any

import Grasshopper

from compas.scene import SceneObject


class CompasToRhinoGeometry(Grasshopper.Kernel.GH_ScriptInstance):
    def RunScript(self, cg):
        if not cg:
            return None

        return SceneObject(item=cg).draw()
# ---------- end draw ----------

# ---- group: object_position_on_printbed
pt = ConstructPoint(XCoordinate=Slider(0.5, range=0..1), YCoordinate=Slider(0.5, range=0..1), ZCoordinate=0)

# ---- group: object_rotation
number_slider = Slider(75, range=0..360)

# ----
# parameters
number_slider_2 = Slider(1.2, range=0..10)

# ---- group: This is needed only ONCE in the GH definition
enable_auto_reload = Python3Script()  # -> ok
# ---------- enable_auto_reload: Python ----------
"""
------------------------------
Using VS Code as Python editor
------------------------------

The simplest way to start using VS Code as our editor, is
to place our Python code in files located IN THE SAME FOLDER as our Grasshopper file.

After we have done that, we need 2 steps: 

1. Enable the COMPAS reloader on one component. This tells Grasshopper to watch for changes in the Pythoh files and reload if changed.
2. Every other component that uses Python code from external files needs to start with a method to ensure Grasshopper knows where to load the files from.

"""
# r: compas
# venv: mas-2627

from compas_rhino.devtools import DevTools
DevTools.enable_reloader()
# ---------- end enable_auto_reload ----------

# ----
# parameters
number_slider_3 = Slider(2, range=0..20)
number_slider_4 = Slider(50, range=0..1000)
number_slider_5 = Slider(50, range=0..1000)
number_slider_6 = Slider(2.85, range=0..10)
number_slider_7 = Slider(50, range=0..1000)
number_slider_8 = Slider(100, range=0..1000)

flower_pot = Python3Script(
    lh=number_slider_2,
    radii_bot=Slider(50, range=0..100),
    radii_top=Slider(50, range=0..100),
    reso=Slider(100, range=0..100),
    f1=Slider(4, range=0..10),
    f2=Slider(9, range=0..10),
    s_angle=Slider(60, range=0..1000),
    amplitude=Slider(5.412, range=0..10))  # -> out, layer_info, mesh, spiral; inputs lh: Double, reso: Int32, f1: Int32, f2: Int32, amplitude: Double
# ---------- flower_pot: Python ----------
import Rhino.Geometry as rg
import math as m
import numpy as np


class Column:
    
    def __init__(self, axis: rg.Curve, radius_base: float, radius_top: float):
        # define axis and reparam it
        self.axis = axis
        self.axis.Domain = rg.Interval(0.0,1.0)
        # define radius of bottom
        self.radius_base = radius_base
        # define radius of top
        self.radius_top = radius_top
        # define height of column
        self.height = axis.PointAtEnd.Z - axis.PointAtStart.Z

    def get_point(self, angle: float, tz: float) -> rg.Point3d:
        """
        Args:
            angle: angle in polar coordinates in radians
            tz: parameter on axis

        Returns:
            rg.Point3d point on the column

        """
        # call Point3d origin at given parameter tz
        origin = self.axis.PointAt(tz)
        # call float radius at given parameter tz with defined frequency and amplitude
        radius = self.get_radius_wave(angle, tz, f1, f2, amplitude)
        # radius = self.get_radius_bezier(tz)
        pt = rg.Point3d(
            origin.X + m.cos(angle) * radius,
            origin.Y + m.sin(angle) * radius,
            origin.Z
        )
        return pt

    # define the overall radial distance of a point from the centre of the axis
    def get_radius(self, tz: float) -> float:
        radius = self.radius_base * (1 - tz) + self.radius_top * tz
        return radius

    def get_radius_bezier(self, tz: float) -> float:
        bezier = rg.BezierCurve(
            [
                rg.Point2d(0.0, 10),
                rg.Point2d(5.0, 5.0),
                rg.Point2d(3.2, 7.0),
                rg.Point2d(3.0, 11.0)
            ]
        )
        print(bezier.PointAt(tz))
        radius = self.radius_base * (1 - tz) + self.radius_top * tz
        radius += bezier.PointAt(tz).Y * amplitude
        # print(radius)
        return radius

    # define the sinusoidal radial distance of a point given its original radial distance from axis
    def get_radius_wave(self, angle: float, tz: float, freq1: int, freq2: int, amp: float) -> float:
        
        # radius = self.get_radius(tz) * m.cos(angle * freq)
        # ABOVE WOULD BE USED FOR ORDINARY SINUSOIDAL MANIPULATION
        
        # shift = tz * m.radians(120)
        # angle += shift
        # amp = pow(tz, 2) * amp
        # freq1, freq2 = 8, 5
        # _r1, _r2 = m.cos(angle * freq1) * amp, m.cos(angle * freq2) * amp
        # radius = self.get_radius(tz) + _r1 * (1 - tz) + _r2 * (tz)

        shift = tz * m.radians(s_angle)
        a1, a2 = angle + shift, angle - shift
        # Option to provide two extremes of angle shifts to blend with
        # Option to provide two extremes of frequency values to blend with
        _r1 = self.get_radius(tz) + m.cos(a1 * freq1) * amp
        _r2 = self.get_radius(tz) - m.cos(a2 * freq2) * amp
        # Option to provide two extremes of radial values to blend with
        radius = _r1 * (1 - tz) + _r2 * (tz)
        # Blended radii to take into account of all options

        return radius
    
    def get_layers(self, layer_height: float, res_u: int) -> list[list[rg.Point3d]]:
        layer_count = int(self.height / layer_height) if self.height % layer_height == 0 else int(self.height // layer_height + 1)
        real_layer_height = self.height/layer_count
        curves = [rg.PolylineCurve([self.get_point(angle, tz) for angle in np.linspace(0, m.tau , res_u)]) for tz in np.linspace(0, 1, layer_count)]
        # above is option if we bake the layers as a list of Polylines instead of Points
        layers = [[self.get_point(angle, tz) for angle in np.linspace(0, m.tau , res_u)] for tz in np.linspace(0, 1, layer_count)]
        
        # for every angle within resolution per layer, for every layer in all layers, create a collection of points, and assign it to a polyline
        # alternate method:
        # layers = []
        # for tz in np.linspace(0, 1, layer_count)[1:]:
            # layer = []
            # for angle in np.linspace(0, m.tau, res_u)[:-1]:
                # pt = self.get_point(angle, tz)
                # layer.append(pt)
            # layers.append(layer)
        # return layer
            
        return [curves, layers]

    @ staticmethod
    # staticmethod: decorator for method whereby method can work without self
    # meaning you do not have to create an object first before using it
    # since it does not possess a self quality
    def to_mesh(crvs: list[rg.PolylineCurve], closed: bool = True) -> rg.Mesh:
        mesh = rg.Mesh()
        for layer in crvs:
            # layer.ToArray() produces a list of Point3d (each layer of points)
            for pt in layer.ToArray():
                # first add each point to the mesh
                mesh.Vertices.Add(pt)
        id_x = np.array(range(mesh.Vertices.Count))
        # id_x returns a list of all the ids of the points, from 0 on to the last
        # id_x = id_x.reshape(len(crvs), layer.PointCount)
        id_x = id_x.reshape(len(crvs), len(crvs[0].ToArray()))
        # matrix.reshape(r, c) whereby r = rows, c = columns
        # reshape partitions full list into a nested list
        # each list inside contains the ids per layer
        # layer called here is the last one
        # since the loop has ended, then the last layer is relevant
        
        
        if closed:

            # PRINT GROUP BELOW TO SEE!
            # print(id_x[:-1])
            # print("\n")
            # print(np.roll(id_x[:-1], -1, axis = 1))
            # print("\n")
            # print(id_x[1:])
            # print("\n")
            # print(np.roll(id_x[1:], -1, axis = 1))

            faces = np.stack([
                id_x[:-1],                          # 1. Top Left Corner
                # Selects all rows except the last one
                # [0, 1, 2, 3]
                # [4, 5, 6, 7]
                # ------------
                # [-8, -7, -6, -5]

                np.roll(id_x[:-1], -1, axis = 1),   # 2. Top Right Corner
                # Shifts the list backward, with initial first element as last element
                # [1, 2, 3, 0]
                # [5, 6, 7, 4]
                # ------------
                # [-7, -6, -5, -8]

                np.roll(id_x[1:], -1, axis = 1),     # 3. Bottom Right Corner
                # Shifts the list backward, with initial first element as last element
                # [5, 6, 7, 4]
                # [9, 10, 11, 8]
                # ------------
                # [-7, -6, -5, -8]
                # [1, 2, 3, 0]

                id_x[1:]                           # 4. Bottom Left Corner
                # Selects all rows except for the first one
                # [4, 5, 6, 7]
                # [8, 9, 10, 11]
                # ------------
                # [-8, -7, -6, -5]
                # [0, 1, 2, 3]

            ], axis = -1).reshape(-1, 4)
            # axis = -1: refers to dimension of last array/row
            # outputs 3D shape of (rows, columns, number of tuples)
            # reshape, -1 calculates size of dimension based on total number of elements and other specified dimensions
            # reshape(-1, 4) flattens into 2D array, each element a tuple of 4 elements
            # print(faces)
        else:
            faces = np.lib.stride_tricks.sliding_window_view(
                id_x, window_shape = (2, 2)
            ).reshape(-1, 4)

        # building a quadrilateral face:
        # given a matrix [0, 1, 2, 3], we want to create it in the order
        # top left [0], top right [1], bottom right [3], bottom left [2] 
        
        for face in faces:
            # print([int(f) for f in face]) numpy output
            # print(*[int(f) for f in face]) int ouput
            mesh.Faces.AddFace(*[int(f) for f in face])
        mesh.Compact()
        mesh.RebuildNormals()
        return mesh

if __name__ == "__main__":
    axis = rg.LineCurve(
        rg.Point3d(0.0, 0.0, 0.0),
        rg.Point3d(0.0, 0.0, 100.0)
    )    
    
    col = Column(axis, radii_bot, radii_top)
    overall_info = col.get_layers(lh, reso)
    layer_info = overall_info[1]
    curvies = overall_info[0]

    mesh = Column.to_mesh(curvies, closed = True)
    pt_set = [l[:-1] for l in layer_info]
    spiral = rg.PolylineCurve([p for ps in pt_set for p in ps])
            
    
    import ghpythonlib.treehelpers as th
    layer_info = th.list_to_tree(layer_info)
# ---------- end flower_pot ----------

# ----
# design: "slice" a cylinder
spiral = Python3Script(
    x_rad=number_slider_4,
    y_rad=number_slider_5,
    layer_h=number_slider_6,
    h=number_slider_8,
    resolution=number_slider_7,
    step=number_slider_3)  # -> out, pts, layer; inputs resolution: Int32
# ---------- spiral: Python ----------
import math as m
from compas.geometry import Point, Vector, Frame, Polyline

n_turns = int(h//layer_h)
d_ang = m.tau / resolution
d_h = h / (resolution * n_turns)
l_h = h / n_turns

pts = [Point(
    x_rad * m.cos(d_ang * i), 
    y_rad * m.sin(d_ang * i),
    (i//resolution * l_h) + layer_h * (1 + (0.5 * (i % step)))
    ) 
for i in range(n_turns * resolution)
]


layer = Polyline(pts)
# ---------- end spiral ----------

expression = Expression(x=number_slider_2, f=Slider(0.6, range=0..1), Expression="x*f")

# ----
# design: "slice" a cylinder
spiral_2 = Python3Script(
    x_rad=number_slider_4,
    y_rad=number_slider_5,
    layer_h=number_slider_6,
    h=number_slider_8,
    resolution=number_slider_7,
    floor_h=expression)  # -> out, layer; inputs resolution: Int32
# ---------- spiral_2: Python ----------
import math as m
from compas.geometry import Point, Vector, Frame, Polyline

n_turns = int(h//layer_h)
d_ang = m.tau / resolution
d_h = h / (resolution * n_turns)

pts = [Point(
    x_rad * m.cos(d_ang * i), 
    y_rad * m.sin(d_ang * i),
    (i * d_h) + floor_h
    ) 
for i in range(n_turns * resolution)
]

layer = Polyline(pts)

# frames = [Frame(
#     p,
#     Vector.Xaxis(),
#     Vector.Yaxis()
# )
# for p in pts]
# ---------- end spiral_2 ----------
draw_2 = COMPASDraw(cg=spiral_2.layer)  # -> rg; same code as draw

# ---- group: printbed_position
printbed_position = _4PointSurface(
    CornerA="535.57,-65.74,-9.79",
    CornerB="535.54,528.09,-10.52",
    CornerC="136.49,527.66,-10.90",
    CornerD="228.17,-67.26,-9.86")

# ----
to_spiral_points = To_spiral_points(L=flower_pot.layer_info, A=number_slider_2, F=expression)  # -> G_2, G

# ---- group: PREVIEW ONLY
nurbs = NurbsCurve(Vertices=to_spiral_points.G, Degree=3, Periodic=False)  # -> Curve, Length, Domain; disabled
mesh = Mesh(flower_pot.mesh)  # disabled
facen = FaceNormals(Mesh=mesh)  # -> Centers, Normals; disabled
pipe = Pipe(Curve=nurbs.Curve, Radius=expr("x/2", number_slider_2), Caps=0, FitRail=False)  # disabled
preview = CustomPreview(
    Geometry=mesh,
    Material={diffuse=RGB(221, 160, 221), emission=RGB(66, 48, 66), shine=0.5, specular=RGB(255, 255, 255), transparency=0})  # disabled
vdisex = VectorDisplayEx(Point=facen.Centers, Vector=facen.Normals, Colour=RGB(0, 0, 0), Width=2)  # disabled

# ----
starting_nozzle_height = Panel(expression)
draw_3 = COMPASDraw(cg=spiral.layer)  # -> rg; same code as draw
convert_to_compas = Python3Script(pts=to_spiral_points.G_2)  # -> out, layer, comp_pts, index; inputs pts: list of Point3d
# ---------- convert_to_compas: Python ----------
import math as m
from compas.geometry import Point, Vector, Frame, Polyline
from compas_rhino.conversions import point_to_compas 

comp_pts = [point_to_compas(p) for p in pts]
layer = Polyline(comp_pts)

index = [0 if np % 2 == 0 else 1 for np in range(len(comp_pts))]
# ---------- end convert_to_compas ----------
draw_4 = COMPASDraw(cg=convert_to_compas.layer)  # -> rg; same code as draw
cluster = Cluster(S=printbed_position, uv=pt, A=degrees(number_slider))
panel_2 = Panel(flower_pot.out)

# ----
# generate printpath: printpoints and path
# export: save
safety_distance_mm_2 = Slider(100, range=10..300)
genes = GenePool(Decimals=2, Maximum=30, Minimum=10, Value=[10, 30])
blend_radius_mm_2 = Slider(5, range=0..5)
speed_mm_s_2 = Slider(20, range=1..50)
printpath_2 = Printpath(
    layers=spiral.pts,
    pt_class=convert_to_compas.index,
    speed=genes,
    blend_radius=blend_radius_mm_2,
    safety_distance=safety_distance_mm_2)  # -> printpath, summary; inputs layers: list, pt_class: list of Int32, speed: list
# ---------- printpath_2: Python ----------
# r: compas
# venv: mas-2627
"""
Turn the layers into printpoints and a PrintPath, in work object coordinates.
Safety points are added here, before any transform to the robot base.
"""
import os
import sys
import importlib

from compas.geometry import Frame, Vector


# Find source folder
gh_dir = os.path.dirname(ghenv.Component.OnPingDocument().FilePath)
print(gh_dir)
src_dir = os.path.join(gh_dir, "src")
print(src_dir)
if src_dir not in sys.path:
    sys.path.append(src_dir)
from print_class_02 import PrintPoint, PrintPath


# ===== One printpoint per point =====
# world XY orientation for every point: a tangent frame would turn the wrist 360 degrees each layer
printpoints = []
for pt_index, pt in enumerate(layers):
    t = (pt_index / (len(layers) - 1))
    frame = Frame(pt, -Vector.Xaxis(), Vector.Yaxis())
    v = speed[0] * (1 - t) + speed[1] * (t)
    printpoints.append(PrintPoint(frame, pt_index, v, blend_radius, True, pt_class[pt_index]))
    # printpoints.append(PrintPoint(frame, pt_index, speed, blend_radius, True, pt_class[pt_index])) if speed is a single input

# ===== Path with a travel point above the start and the end =====
printpath = PrintPath(printpoints)
printpath.add_safety_before(safety_distance, speed)
printpath.add_safety_after(safety_distance, speed)

summary = f"{len(printpoints)} printpoints in {len(layers)} layers, plus 2 safety points"
# ---------- end printpath_2 ----------
panel_3 = Panel(printpath_2.summary)
place_on_bed = Python3Script(printpath=printpath_2.printpath, bed_plane=cluster)  # -> printpath_on_bed, summary; inputs bed_plane: Plane
# ---------- place_on_bed: Python ----------
# r: compas
# venv: mas-2627
"""
Place the printpath on the print bed.
bed_plane comes from 校正桌面: the bed surface at (u, v), turned by the object angle, z up, raised by the first layer offset.
The printpath is built around world XY, so world XY is moved onto bed_plane.
The output is a normal PrintPath (now in robot base coordinates), so preview and save work as before.
"""
import os
import sys

from compas.geometry import Frame, Transformation
from compas_rhino.conversions import plane_to_compas_frame

# Find source folder
gh_dir = os.path.dirname(ghenv.Component.OnPingDocument().FilePath)
src_dir = os.path.join(gh_dir, "src")
if src_dir not in sys.path:
    sys.path.append(src_dir)
from print_class_02 import PrintPath

# ===== world XY -> bed plane =====
bed = plane_to_compas_frame(bed_plane)
transformation = Transformation.from_frame_to_frame(Frame.worldXY(), bed)

# ===== New printpath, the original stays untouched =====
placed = []
for printpoint in printpath.printpoints:
    new_printpoint = printpoint.copy()
    new_printpoint.frame.transform(transformation)
    placed.append(new_printpoint)
printpath_on_bed = PrintPath(placed)

z_values = [printpoint.frame.point.z for printpoint in placed]
summary = f"bed origin: {[round(v, 2) for v in bed.point]}\nz from {min(z_values):.1f} to {max(z_values):.1f} mm (robot base)"
# ---------- end place_on_bed ----------
save = Button()
save_2 = Save(printpath=place_on_bed.printpath_on_bed, save=save, out_path="data/out_printpoints_mike_2.json")  # -> status
# ---------- save_2: Python ----------
# r: compas
# venv: mas-2627
"""
On button press, write the printpath to data/out_printpoints.json next to this .ghx file.
send_to_robot.py reads that file.
"""
import json
import os

import scriptcontext as sc

gh_dir = os.path.dirname(ghenv.Component.OnPingDocument().FilePath)

# keep the last status in sticky, so the message survives the button being released
status_key = "save_status_" + str(ghenv.Component.InstanceGuid)

if save:
    if printpath is None:
        sc.sticky[status_key] = "nothing to save: no printpath"
    else:
        path = os.path.normpath(os.path.join(gh_dir, out_path))
        os.makedirs(os.path.dirname(path), exist_ok=True)
        with open(path, "w") as f:
            json.dump(printpath.to_dict(), f, indent=2)
        sc.sticky[status_key] = f"saved {len(printpath)} printpoints to {path}"

status = sc.sticky.get(status_key, "")
ghenv.Component.Message = "saved" if status.startswith("saved") else status
# ---------- end save_2 ----------
panel_4 = Panel(place_on_bed.summary)
panel_5 = Panel(save_2)

pick_safe_preview = Python3Script()  # -> planes; inputs frames: list
# ---------- pick_safe_preview: Python ----------
"""
Convert COMPAS Frames to Rhino Planes for preview.
    Input:  frames (List Access, No Type Hint)
    Output: planes
"""
import Rhino.Geometry as rg
from compas.geometry import Frame
from compas_rhino.conversions import frame_to_rhino_plane


def to_plane(item):
    if item is None:
        return None
    if isinstance(item, rg.Plane):
        return item
    if isinstance(item, Frame):
        return frame_to_rhino_plane(item)
    raise TypeError("Not a COMPAS Frame: {}".format(type(item)))


def flatten(items):
    for item in items:
        if isinstance(item, (list, tuple)):
            for sub in flatten(item):
                yield sub
        else:
            yield item


planes = [to_plane(f) for f in flatten(frames or [])]
ghenv.Component.Message = "{} planes".format(len(planes))
# ---------- end pick_safe_preview ----------

# ----
# generate printpath: printpoints and path
printpath_3 = Printpath(layers=convert_to_compas.layer, speed=speed_mm_s_2, blend_radius=blend_radius_mm_2, safety_distance=safety_distance_mm_2)  # -> printpath, summary; inputs layers: list; disabled; same code as printpath
panel_6 = Panel(printpath_3.summary)  # disabled

# ---- group: EXPORT
# export: preview and save
panel_7 = Panel("data/out_printpoints_mike.json")  # disabled
place_on_bed_2 = Python3Script(printpath=printpath_3.printpath, bed_plane=cluster)  # -> printpath_on_bed, summary; inputs bed_plane: Plane; disabled
# ---------- place_on_bed_2: Python ----------
# r: compas
# venv: mas-2627
"""
Place the printpath on the print bed.
bed_plane comes from 校正桌面: the bed surface at (u, v), turned by the object angle, z up, raised by the first layer offset.
The printpath is built around world XY, so world XY is moved onto bed_plane.
The output is a normal PrintPath (now in robot base coordinates), so preview and save work as before.
"""
import os
import sys

from compas.geometry import Frame, Transformation
from compas_rhino.conversions import plane_to_compas_frame

# Find source folder
gh_dir = os.path.dirname(ghenv.Component.OnPingDocument().FilePath)
src_dir = os.path.join(gh_dir, "..", "..", "src")
if src_dir not in sys.path:
    sys.path.append(src_dir)
from print_class import PrintPath

# ===== world XY -> bed plane =====
bed = plane_to_compas_frame(bed_plane)
transformation = Transformation.from_frame_to_frame(Frame.worldXY(), bed)

# ===== New printpath, the original stays untouched =====
placed = []
for printpoint in printpath.printpoints:
    new_printpoint = printpoint.copy()
    new_printpoint.frame.transform(transformation)
    placed.append(new_printpoint)
printpath_on_bed = PrintPath(placed)

z_values = [printpoint.frame.point.z for printpoint in placed]
summary = f"bed origin: {[round(v, 2) for v in bed.point]}\nz from {min(z_values):.1f} to {max(z_values):.1f} mm (robot base)"
# ---------- end place_on_bed_2 ----------
save_3 = Button()  # disabled
preview_2 = Preview(printpath=place_on_bed_2.printpath_on_bed)  # -> path, travel, planes; disabled
# ---------- preview_2: Python ----------
# r: compas
# venv: mas-2627
"""
Draw the printpath: path = the whole polyline, travel = extruder-off segments,
safety = extruder-off points, axes = small x and y axis of each frame.
"""
import Rhino.Geometry as rg
from compas_rhino.conversions import frame_to_rhino_plane, point_to_rhino

AXIS_LENGTH = 5.0  # mm

points = printpath.printpoints
planes = [frame_to_rhino_plane(printpoint.frame) for printpoint in points]

# ===== Whole path =====
polyline = rg.Polyline()
for plane in planes:
    polyline.Add(plane.Origin.X, plane.Origin.Y, plane.Origin.Z)
path = polyline.ToPolylineCurve()

# ===== Extruder off: a segment prints only if both of its points have the extruder on =====
safety = [point_to_rhino(printpoint.frame.point) for printpoint in points if not printpoint.is_extruder_on]
travel = []
for i in range(len(points) - 1):
    if not (points[i].is_extruder_on and points[i + 1].is_extruder_on):
        travel.append(rg.Line(planes[i].Origin, planes[i + 1].Origin))
# ---------- end preview_2 ----------
save_4 = Save(printpath=place_on_bed_2.printpath_on_bed, save=save_3, out_path=panel_7)  # -> status; disabled; same code as save_2
plane = Plane(preview_2.planes)  # disabled
swatch = ColourSwatch(SwatchColor=RGB(0, 170, 80))  # disabled
swatch_2 = ColourSwatch(SwatchColor=RGB(230, 40, 40))  # disabled
panel_8 = Panel(save_4)  # disabled
preview_3 = CustomPreview(Geometry=preview_2.travel, Material=swatch_2)  # disabled
preview_4 = CustomPreview(Geometry=preview_2.path, Material=swatch)  # disabled

# ----
# preview
preview_5 = Preview(printpath=place_on_bed.printpath_on_bed)  # -> path, travel, planes; disabled; same code as preview_2
plane_2 = Plane(preview_5.planes)  # disabled
swatch_3 = ColourSwatch(SwatchColor=RGB(0, 170, 80))  # disabled
swatch_4 = ColourSwatch(SwatchColor=RGB(230, 40, 40))  # disabled
preview_6 = CustomPreview(Geometry=preview_5.travel, Material=swatch_4)  # disabled
preview_7 = CustomPreview(Geometry=preview_5.path, Material=swatch_3)  # disabled

panel_9 = Panel(place_on_bed_2.summary)  # disabled

# ==== cluster To_spiral_points
L = ClusterInput()
A = ClusterInput()
F = ClusterInput()

# ---- group: Remove all last pts
cull_i = CullIndex(List=L, Indices=-1, Wrap=True)

# ---- group: Identify the resolution per curve
lng = ListLength(List=cull_i)
avr = Average(Input=flatten(lng))

# ----
item = ListItem(List=flatten(cull_i), Index=0, Wrap=True)
Y = UnitY(Factor=Slider(-55, range=-100..100))

# ---- group: Move the points by assigned dZ / dZ per point
division = Division(A=A, B=avr)

# ----
move = Move(Geometry=item, Motion=Y)  # -> Geometry, Transform

# ---- group: Move the points by assigned dZ
series = Series(Start=0, Step=division, Count=avr)
Z = UnitZ(Factor=series)
move_2 = Move(Geometry=cull_i, Motion=Z)  # -> flatten(Geometry), Transform

# ----
merge = Merge(Data1=move.Geometry, Data2=cull_i)

# ---- group: Move all points by dist above start
Z_2 = UnitZ(Factor=F)
move_3 = Move(Geometry=move_2.Geometry, Motion=Z_2)  # -> flatten(Geometry), Transform

# ----
move_4 = Move(Geometry=merge, Motion=Z_2)  # -> flatten(Geometry), Transform
G = ClusterOutput(move_3.Geometry)
G_2 = ClusterOutput(move_4.Geometry)

# ==== cluster Cluster
S = ClusterInput()
uv = ClusterInput()
A = ClusterInput()
evalsrf = EvaluateSurface(Surface=reparameterize(S), Point=uv)  # -> Point, Normal, UDirection, VDirection, Frame
prot = RotatePlane(Plane=evalsrf.Frame, Angle=degrees(A))
Z = UnitZ(Factor=1)
deplane = DeconstructPlane(Plane=prot)  # -> Origin, XAxis, YAxis, ZAxis
dprod = DotProduct(VectorA=Z, VectorB=deplane.ZAxis, Unitize=False)
pflip = FlipPlane(Plane=prot, ReverseX=False, ReverseY=False, SwapAxes=True)
expression = Expression(x=dprod, Expression="if(x<0,True,False)")
filter = StreamFilter(Gate=expression, Stream0=prot, Stream1=pflip)
deplane_2 = DeconstructPlane(Plane=filter)  # -> Origin, XAxis, YAxis, ZAxis
first_layer_lift = Panel("1.2")
addition = Addition(A=first_layer_lift, B="0")
amp = Amplitude(Vector=deplane_2.ZAxis, Amplitude=addition)
move = Move(Geometry=filter, Motion=amp)  # -> Geometry, Transform
G = ClusterOutput(move.Geometry)
