# Grasshopper definition design_spirals.gh (Grasshopper 1.0.8)

number_slider = Slider(10, range=0..10)
resolution = Slider(25, range=0..1000)
cycles = Slider(1, range=0..100)
number_slider_2 = Slider(6, range=0..10)
arch_spiral = Python3Script(start_rad=number_slider, gap=Slider(20, range=0..50), reso=resolution, cycles=cycles, segments=number_slider_2)  # -> out, frame_pts, index_list; inputs start_rad: Double, gap: Double, reso: Int32, cycles: Int32, segments: Int32
# ---------- arch_spiral: Python ----------
import math as m
from compas.geometry import Point, Vector, Line, Circle, Frame

# Definitions:

def circle_closest_point(circle, point, t_output = False):
    pt_local = circle.frame.to_local_coordinates(point)
    pt_local.z = 0.0
    dist = (pt_local.x ** 2 + pt_local.y ** 2) ** 0.5

    if dist == 0:
        closest = circle.frame.to_world_coordinates(Point(circle.radius, 0.0, 0.0))
    else:
        scale = circle.radius / dist
        closest = circle.frame.to_world_coordinates(Point(pt_local.x * scale, pt_local.y * scale, 0.0))
    
    if t_output:
        t = m.atan2(pt_local.y, pt_local.x) % m.tau
        return closest, t
    
    return closest


# 0. Define local variables

d_theta = m.tau/reso
d_gap = gap/m.tau
d_seg = m.tau/segments

spiral_pts = [
    [Point(
        (start_rad + d_gap * steps * d_theta) * m.cos(steps * d_theta + d_seg * s),
        (start_rad + d_gap * steps * d_theta) * m.sin(steps * d_theta + d_seg * s),
        0.0
    )
    for steps in range(int(reso * cycles + 1))
    ] 
    for s in range(segments)
]

ref_radius = spiral_pts[-1][-1].distance_to_point(Point(0.0, 0.0, 0.0))
hex_len = 2 * ref_radius / m.sqrt(3)
ref_frame = Frame(Point(0.0, 0.0, 0.0), Vector.Xaxis(), Vector.Yaxis())
hex_scale = 0.8 * hex_len

ref_circle = Circle(ref_radius, ref_frame)

closest_data = [circle_closest_point(ref_circle, p[-1], True) for p in spiral_pts]
circle_pos = [data[0] for data in closest_data] 
t_pts = [data[1] for data in closest_data]

t_v = [Vector(-m.sin(t), m.cos(t), 0.0) for t in t_pts]
for unit_t in t_v:
    unit_t.unitize()

hex_lines = [Line(cp - tv * 0.5 * hex_scale, cp + tv * 0.5 * hex_scale) for (cp, tv) in zip(circle_pos, t_v)]

frame_pts = []
index_list = []
for n_sp, sp in enumerate(spiral_pts):
    hx = hex_lines[n_sp]
    hex_start, hex_end = hx.start, hx.end
    frame_pts.append(hex_start)
    index_list.append(1)
    frame_pts.append(hex_end)
    index_list.append(2)
    for ns, s in enumerate(sp):
        frame_pts.append(s)
        index_list.append(1) if ns == 0 else index_list.append(2)

    
import ghpythonlib.treehelpers as th
spiral_pts = th.list_to_tree(spiral_pts)
hex_sides = th.list_to_tree(hex_lines)
frame_pts = th.list_to_tree(frame_pts)
# ---------- end arch_spiral ----------
log_spiral = Python3Script(start_rad=number_slider, k=Slider(2.783, range=0..10), reso=resolution, cycles=cycles, segments=number_slider_2)  # -> out, spiral_pts, hex_sides, circle_pos, frame_pts, index_list; inputs start_rad: Double, k: Double, reso: Int32, cycles: Int32, segments: Int32
# ---------- log_spiral: Python ----------
import math as m
from compas.geometry import Point, Vector, Line, Circle, Frame

# Definitions:

def circle_closest_point(circle, point, t_output = False):
    pt_local = circle.frame.to_local_coordinates(point)
    pt_local.z = 0.0
    dist = (pt_local.x ** 2 + pt_local.y ** 2) ** 0.5

    if dist == 0:
        closest = circle.frame.to_world_coordinates(Point(circle.radius, 0.0, 0.0))
    else:
        scale = circle.radius / dist
        closest = circle.frame.to_world_coordinates(Point(pt_local.x * scale, pt_local.y * scale, 0.0))
    
    if t_output:
        t = m.atan2(pt_local.y, pt_local.x) % m.tau
        return closest, t
    
    return closest

# 0. Define local variables

d_theta = m.tau/reso
d_gap = k/m.tau
d_seg = m.tau/segments

spiral_pts = [
    [Point(
        (start_rad + m.exp(d_gap * steps * d_theta)) * m.cos(steps * d_theta + d_seg * s),
        (start_rad + m.exp(d_gap * steps * d_theta)) * m.sin(steps * d_theta + d_seg * s),
        0.0
    )
    for steps in range(int(reso * cycles))
    ] 
    for s in range(segments)
]

ref_radius = spiral_pts[-1][-1].distance_to_point(Point(0.0, 0.0, 0.0))
hex_len = 2 * ref_radius / m.sqrt(3)
ref_frame = Frame(Point(0.0, 0.0, 0.0), Vector.Xaxis(), Vector.Yaxis())
hex_scale = 0.8 * hex_len

ref_circle = Circle(ref_radius, ref_frame)

closest_data = [circle_closest_point(ref_circle, p[-1], True) for p in spiral_pts]
circle_pos = [data[0] for data in closest_data] 
t_pts = [data[1] for data in closest_data]

t_v = [Vector(-m.sin(t), m.cos(t), 0.0) for t in t_pts]
for unit_t in t_v:
    unit_t.unitize()

hex_lines = [Line(cp - tv * 0.5 * hex_scale, cp + tv * 0.5 * hex_scale) for (cp, tv) in zip(circle_pos, t_v)]

frame_pts = []
index_list = []
for n_sp, sp in enumerate(spiral_pts):
    hx = hex_lines[n_sp]
    hex_start, hex_end = hx.start, hx.end
    frame_pts.append(hex_start)
    index_list.append(1)
    frame_pts.append(hex_end)
    index_list.append(2)
    for ns, s in enumerate(sp):
        frame_pts.append(s)
        index_list.append(1) if ns == 0 else index_list.append(2)

    
import ghpythonlib.treehelpers as th
spiral_pts = th.list_to_tree(spiral_pts)
hex_sides = th.list_to_tree(hex_lines)
frame_pts = th.list_to_tree(frame_pts)
# ---------- end log_spiral ----------
ferm_spiral = Python3Script(start_rad=number_slider, reso=resolution, cycles=cycles, segments=number_slider_2)  # -> out, spiral_pts, hex_sides, circle_pos, frame_pts, index_list; inputs start_rad: Double, reso: Int32, cycles: Int32, segments: Int32
# ---------- ferm_spiral: Python ----------
import math as m
from compas.geometry import Point, Vector, Line, Circle, Frame

# Definitions:

def circle_closest_point(circle, point, t_output = False):
    pt_local = circle.frame.to_local_coordinates(point)
    pt_local.z = 0.0
    dist = (pt_local.x ** 2 + pt_local.y ** 2) ** 0.5

    if dist == 0:
        closest = circle.frame.to_world_coordinates(Point(circle.radius, 0.0, 0.0))
    else:
        scale = circle.radius / dist
        closest = circle.frame.to_world_coordinates(Point(pt_local.x * scale, pt_local.y * scale, 0.0))
    
    if t_output:
        t = m.atan2(pt_local.y, pt_local.x) % m.tau
        return closest, t
    
    return closest

# 0. Define local variables

d_theta = m.tau/reso
d_seg = m.tau/segments

spiral_pts = [
    [Point(
        (start_rad * m.sqrt(steps * d_theta)) * m.cos(steps * d_theta + d_seg * s),
        (start_rad * m.sqrt(steps * d_theta)) * m.sin(steps * d_theta + d_seg * s),
        0.0
    )
    for steps in range(int(reso * cycles))
    ] 
    for s in range(segments)
]

ref_radius = spiral_pts[-1][-1].distance_to_point(Point(0.0, 0.0, 0.0))
hex_len = 2 * ref_radius / m.sqrt(3)
ref_frame = Frame(Point(0.0, 0.0, 0.0), Vector.Xaxis(), Vector.Yaxis())
hex_scale = 0.8 * hex_len

ref_circle = Circle(ref_radius, ref_frame)

closest_data = [circle_closest_point(ref_circle, p[-1], True) for p in spiral_pts]
circle_pos = [data[0] for data in closest_data] 
t_pts = [data[1] for data in closest_data]

t_v = [Vector(-m.sin(t), m.cos(t), 0.0) for t in t_pts]
for unit_t in t_v:
    unit_t.unitize()

hex_lines = [Line(cp - tv * 0.5 * hex_scale, cp + tv * 0.5 * hex_scale) for (cp, tv) in zip(circle_pos, t_v)]

frame_pts = []
index_list = []
for n_sp, sp in enumerate(spiral_pts):
    hx = hex_lines[n_sp]
    hex_start, hex_end = hx.start, hx.end
    frame_pts.append(hex_start)
    index_list.append(1)
    frame_pts.append(hex_end)
    index_list.append(2)
    for ns, s in enumerate(sp):
        frame_pts.append(s)
        index_list.append(1) if ns == 0 else index_list.append(2)

    
import ghpythonlib.treehelpers as th
spiral_pts = th.list_to_tree(spiral_pts)
hex_sides = th.list_to_tree(hex_lines)
frame_pts = th.list_to_tree(frame_pts)
# ---------- end ferm_spiral ----------
draw = COMPASDraw(cg=arch_spiral.frame_pts)  # -> rg
#   port cg: The COMPAS geometry or datastructure to be drawn.
#   port rg: The Rhino geometry object.
# ---------- draw: Python ----------
# r: compas>=2.14.1
"""
Draws COMPAS geometry in Grasshopper.
"""

from typing import Any

import Grasshopper

from compas.scene import SceneObject


class CompasToRhinoGeometry(Grasshopper.Kernel.GH_ScriptInstance):
    def RunScript(self, cg):
        if not cg:
            return None

        return SceneObject(item=cg).draw()
# ---------- end draw ----------
draw_2 = COMPASDraw(cg=ferm_spiral.spiral_pts)  # -> rg; same code as draw
draw_3 = COMPASDraw(cg=ferm_spiral.circle_pos)  # -> rg; same code as draw
draw_4 = COMPASDraw(cg=ferm_spiral.frame_pts)  # -> rg; same code as draw
draw_5 = COMPASDraw(cg=log_spiral.hex_sides)  # -> rg; same code as draw
draw_6 = COMPASDraw(cg=log_spiral.circle_pos)  # -> rg; same code as draw
draw_7 = COMPASDraw(cg=log_spiral.frame_pts)  # -> rg; same code as draw
frame_and_index = Python3Script(
    hex_pts=arch_spiral.frame_pts,
    index_list=arch_spiral.index_list,
    n_layers=Slider(10, range=0..10),
    layer_h=Slider(1.3, range=0..10))  # -> out, hex_tree, ind_tree; inputs hex_pts: list, index_list: list, n_layers: Int32, layer_h: Double
# ---------- frame_and_index: Python ----------
import math as m
from compas.geometry import Point, Vector, Frame

hex_tree = []
ind_tree = []

start_pt = hex_pts[0] + Vector(0.0, -50.0, 0.0)
start_frame = Frame(start_pt, Vector.Xaxis(), Vector.Yaxis())
hex_tree.append(start_frame)
ind_tree.append(2)

for n in range(n_layers):
    hex_list = hex_pts[::1] if n % 2 == 0 else hex_pts[::-1]
    for n_hx, hx in enumerate(hex_list):
        new_hx = hx.copy()
        new_hx.z = (1 + n) * layer_h
        new_frame = Frame(new_hx, -Vector.Xaxis(), Vector.Yaxis())
        hex_tree.append(new_frame)
        ind_tree.append(index_list[n_hx])
# ---------- end frame_and_index ----------
