# Grasshopper definition design_weijiun.gh (Grasshopper 1.0.8)
# plug-ins: Ovenbird 2, Bifocals

# ---- group: DESIGN
point_spacing_mm = Slider(6, range=1..50)
layer_height_mm = Slider(1.75, range=0.5..10)
height_mm = Slider(50, range=1..500)
radius_mm = Slider(50, range=5..200)

center_x_mm = Slider(0, range=-500..500)
center_y_mm = Slider(0, range=-500..500)
fine_adjust_z_mm = Slider(0, range=-5..5)

# ----
# design: "slice" a cylinder
number_slider = Slider(2, range=0..20)
spiral = Python3Script(
    x_rad=Slider(50, range=0..1000),
    y_rad=Slider(50, range=0..1000),
    layer_h=Slider(1.5, range=0..10),
    h=Slider(100, range=0..1000),
    resolution=Slider(50, range=0..1000),
    step=number_slider,
    dz=Slider(8, range=0..10))  # -> out, pts, layer; inputs resolution: Int32, dz: Double
# ---------- spiral: Python ----------
import math as m
from compas.geometry import Point, Vector, Frame, Polyline

n_turns = int(h//layer_h)
d_ang = m.tau / resolution
d_h = h / (resolution * n_turns)
l_h = h / n_turns

pts = [Point(
    x_rad * m.cos(d_ang * i), 
    y_rad * m.sin(d_ang * i),
    (i//resolution * l_h) + layer_h * (1 + (dz * (i % step)))
    ) 
for i in range(n_turns * resolution)
]


layer = Polyline(pts)
# ---------- end spiral ----------

# ---- group: DESIGN
# design: "slice" a cylinder
slice_cylinder = SliceCylinder(
    radius=radius_mm,
    height=height_mm,
    layer_height=layer_height_mm,
    point_spacing=point_spacing_mm,
    center_x=center_x_mm,
    center_y=center_y_mm,
    fine_adjust_z=fine_adjust_z_mm)  # -> layers
# ---------- slice_cylinder: Python ----------
# r: compas
# venv: mas-2627
"""
Slice a cylinder into layers, in work object coordinates (Rhino world XY = work object).
One closed compas Polyline per layer. Units: mm.
center_x, center_y: where the cylinder stands on the work object.
fine_adjust_z: shifts all layers up/down, to tune the nozzle height above the bed (0 = first layer at z = 0).
"""
import math

from compas.geometry import Point
from compas.geometry import Polyline

# ===== How many layers, how many points per layer =====
layer_count = int(height / layer_height)
points_per_layer = round(2 * math.pi * radius / point_spacing)

# ===== One closed polyline per layer =====
layers = []
for i in range(layer_count):
    z = i * layer_height + fine_adjust_z
    points = []
    for j in range(points_per_layer + 1):  # one extra point: back to the start to close the ring
        angle = 2 * math.pi * (j % points_per_layer) / points_per_layer
        points.append(Point(center_x + radius * math.cos(angle), center_y + radius * math.sin(angle), z))
    layers.append(Polyline(points))
# ---------- end slice_cylinder ----------

# ---- group: This is needed only ONCE in the GH definition
enable_auto_reload = Python3Script()  # -> ok
# ---------- enable_auto_reload: Python ----------
"""
------------------------------
Using VS Code as Python editor
------------------------------

The simplest way to start using VS Code as our editor, is
to place our Python code in files located IN THE SAME FOLDER as our Grasshopper file.

After we have done that, we need 2 steps: 

1. Enable the COMPAS reloader on one component. This tells Grasshopper to watch for changes in the Pythoh files and reload if changed.
2. Every other component that uses Python code from external files needs to start with a method to ensure Grasshopper knows where to load the files from.

"""
# r: compas
# venv: mas-2627

from compas_rhino.devtools import DevTools
DevTools.enable_reloader()
# ---------- end enable_auto_reload ----------

# ---- group: NONPLANAR SLICE
# NONPLANAR + TILT:
# wavy layers (flat first layer),
# print planes tilted normal to the layer
layer_height_mm_2 = Slider(1.5, range=0.5..10)
radius_mm_2 = Slider(25, range=10..150)
height_mm_2 = Slider(60, range=5..300)
point_spacing_mm_2 = Slider(4, range=1..20)
wave_amp_mm = Slider(8, range=0..40)
wave_freq = Slider(3, range=0..12)
center_x_mm_2 = Slider(0, range=-200..200)
center_y_mm_2 = Slider(0, range=-200..200)
fine_adjust_z_mm_2 = Slider(0, range=-10..10)
cluster = Cluster_2(
    B_4=layer_height_mm_2,
    A=height_mm_2,
    B=layer_height_mm_2,
    B_5=wave_amp_mm,
    B_11=fine_adjust_z_mm_2,
    B_2=radius_mm_2,
    B_3=point_spacing_mm_2,
    B_6=wave_freq,
    B_7=radius_mm_2,
    B_9=center_x_mm_2,
    B_8=radius_mm_2,
    B_10=center_y_mm_2,
    B_12=wave_freq)
plane = Plane(cluster)

# ----
number_slider_2 = Slider(1.6, range=0..100)
python_3_script = Python3Script(
    layer_height=number_slider_2,
    res_u=Slider(20, range=0..100),
    angle=Slider(5.5, range=0..10),
    freq=Slider(350, range=0..1000),
    shift_step=Slider(10, range=0..100),
    amp=Slider(4.38, range=0..10),
    v1=Slider(0, range=0..20),
    v2=Slider(10, range=0..20),
    window_interval=Slider(10, range=0..40),
    window_width=Slider(2, range=0..20))  # -> out, layers, mesh, extrusion, io_events, points_on, points_off, index; inputs layer_height: Double, res_u: Int32, freq: Int32, amp: Int32
# ---------- python_3_script: Python ----------
#! python3
import Rhino.Geometry as rg
import math as m
import numpy as np
import ghpythonlib.treehelpers as tree


curve_1 = rg.LineCurve(rg.Point3d(0, 0, 0), rg.Point3d(0, 100, 0))

curve_2 = rg.LineCurve(rg.Point3d(25, 0, 0), rg.Point3d(25, 100, 0))


class Wall:
    def __init__(self, axis, curve_1, curve_2):
        """
        Title and description

        """

        self.axis = axis
        self.curve_1 = curve_1
        self.curve_2 = curve_2
        self.height = axis.PointAtEnd.Z - axis.PointAtStart.Z
        # reparameterize axis
        self.axis.Domain = rg.Interval(0,1)


    def get_point(self, curve_index, t, tz):

        pt1 = self.curve_1.PointAtNormalizedLength(t)
        pt2 = self.curve_2.PointAtNormalizedLength(t)

        width = self.get_radius(t)
        offset = self.get_radius_bezier(tz)

        direction = pt2 - pt1
        direction.Unitize()

        if curve_index == 1:
            pt = pt1
        else:
            pt = pt1 + direction * (width + offset)

        z = self.axis.PointAt(tz).Z

        return rg.Point3d(pt.X, pt.Y, z)

    
    def get_radius(self, t):

        pt1 = self.curve_1.PointAtNormalizedLength(t)
        pt2 = self.curve_2.PointAtNormalizedLength(t)

        return pt1.DistanceTo(pt2)

    
    def get_radius_bezier(self, tz):

        bezier = rg.BezierCurve([
            rg.Point2d(0, 0),
            rg.Point2d(0.2, v1),
            rg.Point2d(0.8, v2),
            rg.Point2d(1, 0)
        ])

        offset = bezier.PointAt(tz).Y * 2

        return offset


    # # flipped cos function
    # def get_zigzag(self, angle: float, freq: int, amp: float, nz: int) -> float:

    #     if nz % 5 == 0:
    #         zigzag = amp * m.cos(angle * 300)
    #         #  print(zigzag)
    #         return zigzag
    #     else:
    #         flipped_zigzag = -(amp * m.cos(angle * 300))
    #         return flipped_zigzag


    # shifted cos function
    def get_zigzag(self, angle, freq, amp, nz):

        # if nz % 2 == 0:
        #     zigzag = amp * m.cos(angle * 300) 
        #     #  print(zigzag)
        #     return zigzag
        # else:
        #     shifted_zigzag = (amp * m.cos((angle+(m.pi/4)) * 300))
        #     return shifted_zigzag


        shift = nz * (m.pi / (freq*shift_step))
        zigzag = amp * m.cos((m.tau + shift) * freq)
        return zigzag


    def get_radius_wave(self, angle, tz, freq, amp):
        # rotate
        shift = tz * m.radians(270)
        angle = t * m.tau

        # # fade
        # amp = m.pow((tz), 2) * amp

        # radius = self.get_radius(angle, tz) + m.cos(angle*freq) * amp
        # return radius

        # # blend wave freq
        # freq1 = 2
        # freq2 = 4

        # _r1 = m.cos(angle*freq1)*amp
        # _r2 = m.cos(angle*freq2)*amp

        # radius = self.get_radius(angle, tz) + _r1*(1-tz) + _r2*(tz)
        # return radius

        _r1 = self.get_radius_bezier(tz) + m.cos(a1 * freq) * amp
        _r2 = self.get_radius_bezier(tz) + m.cos(a2 * freq) * amp
        # radius = _r1*(1-tz) + _r2*tz
        # radius = (_r1 + _r2) / 2
        # radius = max(_r1, _r2)
        # radius = min(_r1, _r2)

        return (_r1 + _r2) / 2


    def get_layers(self, layer_height, res_u):

            if layer_height <= 0:
                raise ValueError("layer_height must be positive.")

            if res_u < 2:
                raise ValueError("res_u must be at least 2.")

            layers_count = int(self.height // layer_height) + 1

            layers = []

            for i in range(layers_count):

                layer = []

                z = i * layer_height
                tz = min(z / self.height, 1.0)

                # Alternate direction for each layer
                indices = (
                    range(res_u)
                    if i % 2 == 0
                    else range(res_u - 1, -1, -1)
                )

                for j in indices:

                    t = j / float(res_u - 1)

                    pt1 = self.curve_1.PointAtNormalizedLength(t)
                    pt2 = self.curve_2.PointAtNormalizedLength(t)

                    # Bezier width deformation
                    offset = self.get_radius_bezier(tz)

                    direction = pt2 - pt1
                    direction.Unitize()

                    pt2 = pt2 + direction * offset

                    # Two points per station
                    layer.append(rg.Point3d(pt1.X, pt1.Y, z))
                    layer.append(rg.Point3d(pt2.X, pt2.Y, z))

                layers.append(layer)

            return layers


    @staticmethod
    def get_extrusion_data(layers, window_interval, window_width):

        if window_interval <= 0:
            raise ValueError("window_interval must be positive.")

        extrusion = []
        io_events = []

        previous_state = None

        for i, layer in enumerate(layers):

            layer_states = []

            # Shift window pattern between layers
            # shift = i / float(shift_step)
            shift = 2

            for j, pt in enumerate(layer):

                station = j // 2

                is_window = (
                    (station + shift) % window_interval) < window_width

                state = not is_window

                layer_states.append(state)

                if previous_state is None or state != previous_state:

                    io_events.append({
                        "layer": i,
                        "point": j,
                        "extrusion": state,
                        "position": pt
                    })

                previous_state = state

            extrusion.append(layer_states)

        return extrusion, io_events



    # @staticmethod
    # def get_mesh(layers: list[list[rg.Point3d]], closed: bool) -> rg.Mesh:

    #     mesh = rg.Mesh()

    #     for layer in layers:
    #         for pt in layer:
    #             mesh.Vertices.Add(pt)

    #     idx = np.array(range(mesh.Vertices.Count))
    #     idx = idx.reshape(len(layers), len(layers[0]))

    #     if closed:

    #         faces = np.stack([
    #             idx[:-1],
    #             np.roll(idx[:-1], -1, axis=1),
    #             np.roll(idx[1:], -1, axis=1),
    #             idx[1:],
    #         ], axis=-1).reshape(-1, 4)

    #     else:

    #         faces = np.lib.stride_tricks.sliding_window_view(
    #             idx, window_shape=(2, 2)
    #         ).reshape(-1, 4)

    #     for face in faces:

    #         mesh.Faces.AddFace(
    #             *[int(f) for f in face]
    #         )

    #     mesh.Compact()
    #     mesh.RebuildNormals()
    #     return mesh


if __name__ == "__main__":

    axis = rg.LineCurve(
        rg.Point3d(0, 0, 0),
        rg.Point3d(0, 0, 100)
    )

    mywall = Wall(axis, curve_1, curve_2)

    layers = mywall.get_layers(
        layer_height,
        res_u
    )

    extrusion, io_events = Wall.get_extrusion_data(
        layers,
        window_interval,
        window_width
    )

    index = []
    points_on = []
    points_off = []

    for i, layer in enumerate(layers):

        layer_index = []

        for j, pt in enumerate(layer):

            if extrusion[i][j]:

                points_on.append(pt)
                layer_index.append(3)   # solid wall: 3 = DO3 -> aspeed 0 = 7 mm/s, robot speed[0] in printpath

            else:

                points_off.append(pt)
                layer_index.append(1)

        index.append(layer_index)



    # n_turns = int(h // layer_h)
    # d_ang = m.tau / resolution
    # d_h = h / (resolution * n_turns)
    # l_h = h / n_turns

    # # 1. Generate points
    # pts = [
    #     [
    #         Point(
    #             x_rad * m.cos(d_ang * i),
    #             y_rad * m.sin(d_ang * i),
    #             (j * l_h) + first_h
    #         )
    #         for i in range(resolution)
    #     ]
    #     for j in range(n_turns)
    # ]

    # revised_pts = [p[(shift*np)%(len(p)-1):] + p[:(shift*np)%(len(p)-1)] for np, p in enumerate(pts)]
    # # pts_new = []
    # # for np, p in enumerate(pts):
    # #     shifting_index = (shift*np)%(len(p)-1)
    # #     pt_new = p[shifting_index:] + p[:shifting_index]
    # #     pts_new.append(pt_new)
    # index = [[1 if p == 0 else 2 for p in range(len(np))] for np in revised_pts]

    # revised_pts = tree.list_to_tree(revised_pts)
    # index = tree.list_to_tree(index)



    layers = tree.list_to_tree(layers)
    extrusion = tree.list_to_tree(extrusion)
    io_events = tree.list_to_tree(io_events)
    index = tree.list_to_tree(index)

    points_on = tree.list_to_tree(points_on)
    points_off = tree.list_to_tree(points_off)
# ---------- end python_3_script ----------
point = Point(python_3_script.points_off)
point_2 = Point(python_3_script.points_on)

number_slider_3 = Slider(10, range=0..10)
resolution = Slider(25, range=0..1000)
number_slider_4 = Slider(6, range=0..10)
cycles = Slider(1, range=0..100)
arch_spiral = Python3Script(start_rad=number_slider_3, gap=Slider(40, range=0..100), reso=resolution, cycles=cycles, segments=number_slider_4)  # -> out, frame_pts, index_list; inputs start_rad: Double, gap: Double, reso: Int32, cycles: Int32, segments: Int32
# ---------- arch_spiral: Python ----------
#! python3
import math as m
from compas.geometry import Point, Vector, Line, Circle, Frame

# Definitions:

def circle_closest_point(circle, point, t_output = False):
    pt_local = circle.frame.to_local_coordinates(point)
    pt_local.z = 0.0
    dist = (pt_local.x ** 2 + pt_local.y ** 2) ** 0.5

    if dist == 0:
        closest = circle.frame.to_world_coordinates(Point(circle.radius, 0.0, 0.0))
    else:
        scale = circle.radius / dist
        closest = circle.frame.to_world_coordinates(Point(pt_local.x * scale, pt_local.y * scale, 0.0))
    
    if t_output:
        t = m.atan2(pt_local.y, pt_local.x) % m.tau
        return closest, t
    
    return closest


# 0. Define local variables

d_theta = m.tau/reso
d_gap = gap/m.tau
d_seg = m.tau/segments

spiral_pts = [
    [Point(
        (start_rad + d_gap * steps * d_theta) * m.cos(steps * d_theta + d_seg * s),
        (start_rad + d_gap * steps * d_theta) * m.sin(steps * d_theta + d_seg * s),
        0.0
    )
    for steps in range(int(reso * cycles + 1))
    ] 
    for s in range(segments)
]

ref_radius = spiral_pts[-1][-1].distance_to_point(Point(0.0, 0.0, 0.0))
hex_len = 2 * ref_radius / m.sqrt(3)
ref_frame = Frame(Point(0.0, 0.0, 0.0), Vector.Xaxis(), Vector.Yaxis())
hex_scale = 0.8 * hex_len

ref_circle = Circle(ref_radius, ref_frame)

closest_data = [circle_closest_point(ref_circle, p[-1], True) for p in spiral_pts]
circle_pos = [data[0] for data in closest_data] 
t_pts = [data[1] for data in closest_data]

t_v = [Vector(-m.sin(t), m.cos(t), 0.0) for t in t_pts]
for unit_t in t_v:
    unit_t.unitize()

hex_lines = [Line(cp - tv * 0.5 * hex_scale, cp + tv * 0.5 * hex_scale) for (cp, tv) in zip(circle_pos, t_v)]

frame_pts = []
index_list = []
for n_sp, sp in enumerate(spiral_pts):
    hx = hex_lines[n_sp]
    hex_start, hex_end = hx.start, hx.end
    # index = extruder speed of the segment that ARRIVES at this point (walking the list forwards):
    # 2 = DO2 (-> aspeed 1 on this robot = 1 mm/s), 3 = DO3 (-> aspeed 0 = 7 mm/s), 1 = extruder off
    frame_pts.append(hex_start)
    index_list.append(3)
    frame_pts.append(hex_end)
    index_list.append(3)
    for ns, s in enumerate(sp):
        frame_pts.append(s)
        # ns == 0: the straight line from the hex corner to the centre (green lines) -> 1 mm/s, the rest 7 mm/s
        index_list.append(2 if ns == 0 or ns == len(sp) - 1 else 3)

    
import ghpythonlib.treehelpers as th
spiral_pts = th.list_to_tree(spiral_pts)
hex_sides = th.list_to_tree(hex_lines)
frame_pts = th.list_to_tree(frame_pts)
# ---------- end arch_spiral ----------
log_spiral = Python3Script(start_rad=number_slider_3, k=Slider(2.783, range=0..10), reso=resolution, cycles=cycles, segments=number_slider_4)  # -> out, spiral_pts, hex_sides, circle_pos, frame_pts, index_list; inputs start_rad: Double, k: Double, reso: Int32, cycles: Int32, segments: Int32
# ---------- log_spiral: Python ----------
import math as m
from compas.geometry import Point, Vector, Line, Circle, Frame

# Definitions:

def circle_closest_point(circle, point, t_output = False):
    pt_local = circle.frame.to_local_coordinates(point)
    pt_local.z = 0.0
    dist = (pt_local.x ** 2 + pt_local.y ** 2) ** 0.5

    if dist == 0:
        closest = circle.frame.to_world_coordinates(Point(circle.radius, 0.0, 0.0))
    else:
        scale = circle.radius / dist
        closest = circle.frame.to_world_coordinates(Point(pt_local.x * scale, pt_local.y * scale, 0.0))
    
    if t_output:
        t = m.atan2(pt_local.y, pt_local.x) % m.tau
        return closest, t
    
    return closest

# 0. Define local variables

d_theta = m.tau/reso
d_gap = k/m.tau
d_seg = m.tau/segments

spiral_pts = [
    [Point(
        (start_rad + m.exp(d_gap * steps * d_theta)) * m.cos(steps * d_theta + d_seg * s),
        (start_rad + m.exp(d_gap * steps * d_theta)) * m.sin(steps * d_theta + d_seg * s),
        0.0
    )
    for steps in range(int(reso * cycles))
    ] 
    for s in range(segments)
]

ref_radius = spiral_pts[-1][-1].distance_to_point(Point(0.0, 0.0, 0.0))
hex_len = 2 * ref_radius / m.sqrt(3)
ref_frame = Frame(Point(0.0, 0.0, 0.0), Vector.Xaxis(), Vector.Yaxis())
hex_scale = 0.8 * hex_len

ref_circle = Circle(ref_radius, ref_frame)

closest_data = [circle_closest_point(ref_circle, p[-1], True) for p in spiral_pts]
circle_pos = [data[0] for data in closest_data] 
t_pts = [data[1] for data in closest_data]

t_v = [Vector(-m.sin(t), m.cos(t), 0.0) for t in t_pts]
for unit_t in t_v:
    unit_t.unitize()

hex_lines = [Line(cp - tv * 0.5 * hex_scale, cp + tv * 0.5 * hex_scale) for (cp, tv) in zip(circle_pos, t_v)]

frame_pts = []
index_list = []
for n_sp, sp in enumerate(spiral_pts):
    hx = hex_lines[n_sp]
    hex_start, hex_end = hx.start, hx.end
    frame_pts.append(hex_start)
    index_list.append(2)
    frame_pts.append(hex_end)
    index_list.append(1)
    for ns, s in enumerate(sp):
        frame_pts.append(s)
        index_list.append(1) if ns == len(sp) - 1 else index_list.append(2)

    
import ghpythonlib.treehelpers as th
spiral_pts = th.list_to_tree(spiral_pts)
hex_sides = th.list_to_tree(hex_lines)
frame_pts = th.list_to_tree(frame_pts)
# ---------- end log_spiral ----------
ferm_spiral = Python3Script(start_rad=number_slider_3, reso=resolution, cycles=cycles, segments=number_slider_4)  # -> out, spiral_pts, hex_sides, circle_pos, frame_pts, index_list; inputs start_rad: Double, reso: Int32, cycles: Int32, segments: Int32
# ---------- ferm_spiral: Python ----------
import math as m
from compas.geometry import Point, Vector, Line, Circle, Frame

# Definitions:

def circle_closest_point(circle, point, t_output = False):
    pt_local = circle.frame.to_local_coordinates(point)
    pt_local.z = 0.0
    dist = (pt_local.x ** 2 + pt_local.y ** 2) ** 0.5

    if dist == 0:
        closest = circle.frame.to_world_coordinates(Point(circle.radius, 0.0, 0.0))
    else:
        scale = circle.radius / dist
        closest = circle.frame.to_world_coordinates(Point(pt_local.x * scale, pt_local.y * scale, 0.0))
    
    if t_output:
        t = m.atan2(pt_local.y, pt_local.x) % m.tau
        return closest, t
    
    return closest

# 0. Define local variables

d_theta = m.tau/reso
d_seg = m.tau/segments

spiral_pts = [
    [Point(
        (start_rad * m.sqrt(steps * d_theta)) * m.cos(steps * d_theta + d_seg * s),
        (start_rad * m.sqrt(steps * d_theta)) * m.sin(steps * d_theta + d_seg * s),
        0.0
    )
    for steps in range(int(reso * cycles))
    ] 
    for s in range(segments)
]

ref_radius = spiral_pts[-1][-1].distance_to_point(Point(0.0, 0.0, 0.0))
hex_len = 2 * ref_radius / m.sqrt(3)
ref_frame = Frame(Point(0.0, 0.0, 0.0), Vector.Xaxis(), Vector.Yaxis())
hex_scale = 0.8 * hex_len

ref_circle = Circle(ref_radius, ref_frame)

closest_data = [circle_closest_point(ref_circle, p[-1], True) for p in spiral_pts]
circle_pos = [data[0] for data in closest_data] 
t_pts = [data[1] for data in closest_data]

t_v = [Vector(-m.sin(t), m.cos(t), 0.0) for t in t_pts]
for unit_t in t_v:
    unit_t.unitize()

hex_lines = [Line(cp - tv * 0.5 * hex_scale, cp + tv * 0.5 * hex_scale) for (cp, tv) in zip(circle_pos, t_v)]

frame_pts = []
index_list = []
for n_sp, sp in enumerate(spiral_pts):
    hx = hex_lines[n_sp]
    hex_start, hex_end = hx.start, hx.end
    frame_pts.append(hex_start)
    index_list.append(2)
    frame_pts.append(hex_end)
    index_list.append(1)
    for ns, s in enumerate(sp):
        frame_pts.append(s)
        index_list.append(1) if ns == len(sp) - 1 else index_list.append(2)

    
import ghpythonlib.treehelpers as th
spiral_pts = th.list_to_tree(spiral_pts)
hex_sides = th.list_to_tree(hex_lines)
frame_pts = th.list_to_tree(frame_pts)
# ---------- end ferm_spiral ----------
draw = COMPASDraw(cg=arch_spiral.frame_pts)  # -> rg
#   port cg: The COMPAS geometry or datastructure to be drawn.
#   port rg: The Rhino geometry object.
# ---------- draw: Python ----------
# r: compas>=2.14.1
"""
Draws COMPAS geometry in Grasshopper.
"""

from typing import Any

import Grasshopper

from compas.scene import SceneObject


class CompasToRhinoGeometry(Grasshopper.Kernel.GH_ScriptInstance):
    def RunScript(self, cg):
        if not cg:
            return None

        return SceneObject(item=cg).draw()
# ---------- end draw ----------
draw_2 = COMPASDraw(cg=ferm_spiral.spiral_pts)  # -> rg; same code as draw
draw_3 = COMPASDraw(cg=ferm_spiral.circle_pos)  # -> rg; same code as draw
draw_4 = COMPASDraw(cg=ferm_spiral.frame_pts)  # -> rg; same code as draw
draw_5 = COMPASDraw(cg=log_spiral.hex_sides)  # -> rg; same code as draw
draw_6 = COMPASDraw(cg=log_spiral.circle_pos)  # -> rg; same code as draw
draw_7 = COMPASDraw(cg=log_spiral.frame_pts)  # -> rg; same code as draw
frame_and_index = Python3Script(
    hex_pts=arch_spiral.frame_pts,
    index_list=arch_spiral.index_list,
    n_layers=Slider(10, range=0..10),
    layer_h=Slider(1.3, range=0..10))  # -> out, hex_tree, ind_tree; inputs hex_pts: list, index_list: list, n_layers: Int32, layer_h: Double
# ---------- frame_and_index: Python ----------
#! python3
import math as m
from compas.geometry import Point, Vector, Frame

hex_tree = []
ind_tree = []

start_pt = hex_pts[0] + Vector(0.0, -50.0, 0.0)
start_frame = Frame(start_pt, Vector.Xaxis(), Vector.Yaxis())
# hex_tree.append(start_frame)
hex_tree.append(start_pt)
ind_tree.append(3)

N = len(hex_pts)
for n in range(n_layers):
    # index_list[k] = speed of the segment arriving at point k when walking forwards (k-1 -> k).
    # Odd layers walk backwards: point k is then reached from k+1, so it takes the index of that same segment, index_list[k+1].
    if n % 2 == 0:
        order = list(range(N))
        ind_list = [index_list[k] for k in order]
    else:
        order = list(range(N - 1, -1, -1))
        ind_list = [index_list[k + 1] if k + 1 < N else 3 for k in order]   # first point of the layer: the step up, 7 mm/s
    for n_hx, k in enumerate(order):
        new_hx = hex_pts[k].copy()
        new_hx.z = (1 + n) * layer_h
        hex_tree.append(new_hx)
        ind_tree.append(ind_list[n_hx])
# ---------- end frame_and_index ----------

# ---- group: radius_bounds
layer_bounds = GenePool(Decimals=0, Maximum=100, Minimum=0, Value=[50, 70])

# ----
# generate printpath: printpoints and path
layer_bounds_2 = GenePool(Decimals=2, Maximum=3, Minimum=0, Value=[1.6, 1.95])
n_layers = Slider(50, range=0..1000)
lamcp = LAMCPBridge(enable=Toggle(True))  # -> status; inputs enable: Boolean, port: Int32
#   port enable: Toggle to start (True) or stop (False) the local HTTP server.
#   port port: Port to listen on (loopback only). Defaults to 8765.
#   port status: Current server status string.
# ---------- lamcp: Python ----------
"""
LAMCP Bridge: local HTTP server inside Rhino 8 / Grasshopper CPython.

Exposes `POST /exec` (JSON: `{"code": "...", "timeout": 30}`) which
exec()s `code` and returns
`{"stdout": "...", "stderr": "...", "result": "...", "error": null|str}`.

Pair with the `lamcp` FastMCP server, which translates Claude's
`run_python_script` MCP tool calls into POSTs to this endpoint.

Binds to 127.0.0.1 only. NEVER expose beyond localhost â€” it exec()s
arbitrary Python with full Rhino API access.

LAMCP v0.1.0
"""

import contextlib
import io
import json
import threading
import traceback
from http.server import BaseHTTPRequestHandler
from http.server import HTTPServer

import Grasshopper
import scriptcontext as sc


SHARED_GLOBALS_KEY = "_lamcp_bridge_globals"
SERVER_KEY = "_lamcp_bridge_server"


def _exec_code(code, timeout):
    """Run `code` on the HTTP-server thread and capture stdout/stderr/result.

    NOTE: this is intentionally NOT marshalled to Rhino's UI thread for the
    spike â€” `Rhino.RhinoApp.InvokeOnUiThread` was queueing actions that
    never fired in Rhino 8 CPython. Most read-only RhinoCommon access is
    safe cross-thread; mutations may crash. Add Eto-based marshalling
    back here when we need it.
    """
    out = io.StringIO()
    err = io.StringIO()
    g = sc.sticky.setdefault(SHARED_GLOBALS_KEY, {"__name__": "__lamcp_bridge__"})
    error_text = None
    result_repr = None
    try:
        with contextlib.redirect_stdout(out), contextlib.redirect_stderr(err):
            exec(code, g, g)
            result_repr = repr(g.get("_"))
    except BaseException:
        error_text = traceback.format_exc()

    return {
        "stdout": out.getvalue(),
        "stderr": err.getvalue(),
        "result": result_repr,
        "error": error_text,
    }


class _ExecHandler(BaseHTTPRequestHandler):
    # Silence default request logging so it doesn't clog the Rhino command line.
    def log_message(self, fmt, *args):
        pass

    def _send(self, code, payload):
        body = json.dumps(payload).encode("utf-8")
        self.send_response(code)
        self.send_header("Content-Type", "application/json")
        self.send_header("Content-Length", str(len(body)))
        self.end_headers()
        self.wfile.write(body)

    def do_GET(self):
        if self.path == "/health":
            self._send(200, {"status": "ok"})
        else:
            self._send(404, {"error": "not found"})

    def do_POST(self):
        if self.path != "/exec":
            self._send(404, {"error": "not found"})
            return
        length = int(self.headers.get("Content-Length", "0"))
        try:
            raw = self.rfile.read(length).decode("utf-8")
            body = json.loads(raw)
            code = body.get("code", "")
            timeout = float(body.get("timeout", 30.0))
        except Exception as exc:
            self._send(400, {"error": "bad request: " + repr(exc)})
            return
        result = _exec_code(code, timeout)
        self._send(200, result)


def _start_server(port):
    server = HTTPServer(("127.0.0.1", port), _ExecHandler)
    thread = threading.Thread(
        target=server.serve_forever, daemon=True, name="lamcp-bridge"
    )
    thread.start()
    return {"server": server, "thread": thread, "port": port}


def _stop_server(state):
    try:
        state["server"].shutdown()
        state["server"].server_close()
    except Exception:
        pass


class LamcpBridgeComponent(Grasshopper.Kernel.GH_ScriptInstance):
    def RunScript(self, enable: bool, port: int):
        port = int(port) if port else 8765

        state = sc.sticky.get(SERVER_KEY)

        if not enable:
            if state is not None:
                _stop_server(state)
                del sc.sticky[SERVER_KEY]
            return "stopped"

        # Already running on the requested port: no-op.
        if (
            state is not None
            and state.get("port") == port
            and state["thread"].is_alive()
        ):
            return "listening on http://127.0.0.1:{}".format(port)

        # Port changed or server died: tear down and restart.
        if state is not None:
            _stop_server(state)
            del sc.sticky[SERVER_KEY]

        try:
            sc.sticky[SERVER_KEY] = _start_server(port)
        except OSError as exc:
            ghenv.Component.AddRuntimeMessage(  # noqa: F821
                Grasshopper.Kernel.GH_RuntimeMessageLevel.Error,
                "Failed to bind 127.0.0.1:{}: {}".format(port, exc),
            )
            return "error: {}".format(exc)

        return "listening on http://127.0.0.1:{}".format(port)
# ---------- end lamcp ----------
range = Range(Domain=Domain(0, 1), Steps=expr("x-1", n_layers))
graph = GraphMapper(range, x0=0, x1=1, y0=0, y1=1, container_name="Gaussian", factor=0.2, mean=0.6459159255, sdev=0.1924380362)
graph_2 = GraphMapper(range, x0=0, x1=1, y0=0, y1=1, Gx=0.6701000929, Gy=0.2977625728, container_name="Power", power=3.026164257)
panel = Panel(lamcp)
create_geometry = Python3Script(
    x_range=graph_2,
    y_range=graph,
    rad_bounds=layer_bounds,
    layer_bounds=layer_bounds_2,
    n_layers=n_layers,
    resolution=Slider(100, range=0..1000))  # -> out, pts_tree, vec_tree, z_change; inputs x_range: list of Double, y_range: list of Double, rad_bounds: list of Double, layer_bounds: list of Double, n_layers: Int32, resolution: Int32
# ---------- create_geometry: Python ----------
import math as m
from compas.geometry import Point, Vector

def remap(t, omin, omax, nmin, nmax, power):
    ratio = (t - omin) / (omax - omin)
    return m.pow(ratio, power) * (nmax - nmin) + nmin

# 0. Define global variables
min_rad, max_rad = rad_bounds[0], rad_bounds[1]
min_lay, max_lay = layer_bounds[0], layer_bounds[1]
x_min, x_max = min(x_range), max(x_range)
y_min, y_max = min(y_range), max(y_range)


pts = []
main_v = []
z_change = []
origin = Point(0.0, 0.0, 0.0)
d_ang = m.tau/resolution
for r in range(resolution):
    sub_pts = []
    sub_v = []
    sub_z = []
    tz = 0    
    for n in range(n_layers):
        x_val = remap(x_range[n], x_min, x_max, min_rad, max_rad, 1)
        y_val = remap(y_range[n], y_min, y_max, min_rad, max_rad, 1)
        pt = Point(x_val*m.cos(r * d_ang), y_val*m.sin(r * d_ang), 0.0)
        dist = pt.distance_to_point(origin)

        if n > 0:
            tz += remap(dist, min_rad, max_rad, min_lay, max_lay, 1)
        # Store point at current z height
            sub_z.append(remap(dist, min_rad, max_rad, min_lay, max_lay, 1))
        else:
            sub_z.append(min_lay)

        new_pt = Point(pt.x, pt.y, min_lay + tz)
        sub_pts.append(new_pt)

        if n > 0:
            dv = Vector.from_start_end(new_pt, sub_pts[-2])
            sub_v.append(dv)
        else:
            zv = Vector(0.0, 0.0, -1.0)
            sub_v.append(zv)
        
    pts.append(sub_pts)
    main_v.append(sub_v)
    z_change.append(sub_z)


# Transpose matrix (flips rows and columns)
revised_matrix = [list(col) for col in zip(*pts)]
revised_vectors = [list(cl) for cl in zip(*main_v)]
revised_z = [list(c) for c in zip(*z_change)]

# Convert transposed list to Grasshopper DataTree
import ghpythonlib.treehelpers as th
pts_tree = th.list_to_tree(revised_matrix)
vec_tree = th.list_to_tree(revised_vectors)
z_change = th.list_to_tree(revised_z)
# ---------- end create_geometry ----------
vdisex = VectorDisplayEx(Colour=RGB(0, 0, 0), Width=Slider(1, range=0..10))
frame_generation = Python3Script(pts_tree=create_geometry.pts_tree, vec_tree=create_geometry.vec_tree)  # -> out, rev_frames; inputs pts_tree: tree, vec_tree: tree
# ---------- frame_generation: Python ----------
from compas.geometry import Vector, Frame
import ghpythonlib.treehelpers as th

pts = th.tree_to_list(pts_tree)    # [layer][point]
vecs = th.tree_to_list(vec_tree)   # [layer][vector], same shape as pts

REF = -Vector.Xaxis()              # fixed x direction, same as the original flipped frame


def make_frame(pt, z, ref):
    """Frame at pt whose z-axis is z and whose x-axis stays as close to ref as possible."""
    z = z.unitized()
    # keep only the part of ref perpendicular to z (no spin around z)
    x = ref - z * ref.dot(z)
    if x.length < 1e-6:
        # ref is parallel to z: fall back to world Y
        x = Vector.Yaxis() - z * z.y

    print(x)    
    x.unitize()
    print(x)    

    # x cross (z cross x) = z, so this frame's z-axis comes out exactly as z
    return Frame(pt, x, z.cross(x))


frames = [
    [make_frame(p, v, REF) for p, v in zip(layer_pts, layer_vecs)]
    for layer_pts, layer_vecs in zip(pts, vecs)
]

rev_frames = th.list_to_tree(frames)
# ---------- end frame_generation ----------
frame_generation_2 = Python3Script(pts_tree=create_geometry.pts_tree, vec_tree=create_geometry.vec_tree)  # -> out, rev_frames; inputs pts_tree: tree, vec_tree: tree; disabled
# ---------- frame_generation_2: Python ----------
import math as m
from compas.geometry import Point, Vector, Frame
from compas.geometry import Transformation, Rotation
import ghpythonlib.treehelpers as th

pts = th.tree_to_list(pts_tree)
vecs = th.tree_to_list(vec_tree)

frames = [
    [Frame(
        p,
        -Vector.Xaxis(),
        Vector.Yaxis()
    )
    for p in sub_pts
    ]
    for sub_pts in pts
]

revised_frames = []

for ns, sub_vecs in enumerate(vecs):
    revised_subframes = []
    for nv, vs in enumerate(sub_vecs):
        frame_copy = frames[ns][nv].copy()
        v_u = vs.unitized()
        nx, ny, nz = v_u.x, v_u.y, v_u.z
        ny_clamped = max(-1.0, min(1.0, ny))
        theta_x = m.asin(ny_clamped)
        theta_y = m.atan2(-nx, -nz)
        frame_copy.rotate(theta_x, Vector.Xaxis(), frame_copy.point)
        frame_copy.rotate(theta_y, Vector.Yaxis(), frame_copy.point)
        revised_subframes.append(frame_copy)
    revised_frames.append(revised_subframes)

rev_frames = th.list_to_tree(revised_frames)
# ---------- end frame_generation_2 ----------
flatten = FlattenTree(Tree=frame_generation.rev_frames, Path="{0}")
flatten_2 = FlattenTree(Tree=create_geometry.z_change, Path="{0}")
item = ListItem(List=flatten_2, Index=0, Wrap=True)
add_frame = Python3Script(frames=flatten)  # -> out, rev_frames; inputs frames: list
# ---------- add_frame: Python ----------
from compas.geometry import Vector, Frame

f_origin = frames[0].copy()
f_origin.point += Vector(0.0, -100.0, 0.0)
frames.insert(0, f_origin)
rev_frames = frames
# ---------- end add_frame ----------
lng = ListLength(List=add_frame.rev_frames)
merge = Merge(Data1=item, Data2=flatten_2)
repeat = RepeatData(Data=Slider(2, range=0..10), Length=lng)
bounds = Bounds(Numbers=merge)
panel_2 = Panel(bounds)
safety_distance_mm = Slider(100, range=10..300)
blend_radius_mm = Slider(1, range=0..5)
genes = GenePool(Decimals=2, Maximum=50, Minimum=0, Value=[8, 12])
printpath = Printpath(
    layers=add_frame.rev_frames,
    pt_h=merge,
    pt_class=repeat,
    speed=genes,
    blend_radius=blend_radius_mm,
    safety_distance=safety_distance_mm)  # -> printpath, summary, mapped_speed; inputs layers: list, pt_h: list of Double, pt_class: list, speed: list
# ---------- printpath: Python ----------
# r: compas
# venv: mas-2627
"""
Turn the layers into printpoints and a PrintPath, in work object coordinates.
Safety points are added here, before any transform to the robot base.
"""
import os
import math as m
import sys
import importlib

from compas.geometry import Frame, Vector

def remap(t, omin, omax, nmin, nmax, power):
    ratio = (t - omin) / (omax - omin)
    return m.pow(ratio, power) * (nmax - nmin) + nmin

# Find source folder
gh_dir = os.path.dirname(ghenv.Component.OnPingDocument().FilePath)
print(gh_dir)
src_dir = os.path.join(gh_dir, "src")
print(src_dir)
if src_dir not in sys.path:
    sys.path.append(src_dir)
from print_class_02 import PrintPoint, PrintPath

sum_speed = max(speed) + min(speed)
# ===== One printpoint per point =====
# world XY orientation for every point: a tangent frame would turn the wrist 360 degrees each layer
printpoints = []
mapped_speed = []
for frame_index, fr in enumerate(layers):

    v = sum_speed - remap(pt_h[frame_index], min(pt_h), max(pt_h), min(speed), max(speed), 1)
    mapped_speed.append(v)
    # v = speed[0] * (1 - t) + speed[1] * (t)
    printpoints.append(PrintPoint(fr, frame_index, v, blend_radius, True, pt_class[frame_index]))
    # printpoints.append(PrintPoint(frame, pt_index, speed, blend_radius, True, pt_class[pt_index])) 
    # ABOVE if speed is a single input

# ===== Path with a travel point above the start and the end =====
printpath = PrintPath(printpoints)
printpath.add_safety_before(safety_distance, speed[1])
printpath.add_safety_after(safety_distance, speed[1])

summary = f"{len(printpoints)} printpoints in {len(layers)} layers, plus 2 safety points"
# ---------- end printpath ----------
panel_3 = Panel(printpath.summary)

# ---- group: 1 DESIGN - column layers (parameters + script)
python_3_script_2 = Python3Script(
    radius_base=Slider(50, range=0..50),
    radius_top=Slider(50, range=0..50),
    layer_height=Slider(1.3, range=0..100),
    res_u=Slider(80, range=0..100),
    angle=Slider(5.5, range=0..10),
    freq=Slider(350, range=0..1000),
    shift_step=Slider(10, range=0..100),
    amp=Slider(4.38, range=0..10),
    y1=Slider(0, range=0..20),
    y2=Slider(0, range=0..20),
    window_interval=Slider(15, range=0..40),
    window_width=Slider(2, range=0..20),
    shift_step_2=Slider(2, range=0..20))  # -> out, layers, index; inputs layer_height: Int32, res_u: Int32, freq: Int32, amp: Int32
# ---------- python_3_script_2: Python ----------
#! python3
import Rhino.Geometry as rg
import math as m
import numpy as np
import ghpythonlib.treehelpers as tree

class Column:
    def __init__(self, axis: rg.Curve, radius_base: float, radius_top: float):
        """
        Title and description

        """

        self.axis = axis
        self.radius_base = radius_base
        self.radius_top = radius_top
        self.height = axis.PointAtEnd.Z - axis.PointAtStart.Z
        # reparameterize axis
        self.axis.Domain = rg.Interval(0,1)


    def get_point(self, angle: float, tz: float, nz:int, na: int) -> rg.Point3d:
    # '->' showing what will be returned

        """
        angle: angle in polar coord. in radius
        tz: parameter on axis

        """

        origin = self.axis.PointAt(tz)
        # radius = self.get_radius_wave(angle, tz, 8, 3)
        radius = self.get_radius_bezier(tz)

        # if nz % 5 == 0:
        #     radius += self.get_zigzag(angle, freq, amp, nz)

        # pt = rg.Point3d(
        #     origin.X + m.cos(angle)*radius,
        #     origin.Y + m.sin(angle)*radius,
        #     origin.Z)

        # Convert circle into square
        x = m.cos(angle)
        y = m.sin(angle)

        scale = max(abs(x), abs(y))

        x = x / scale
        y = y / scale

        pt = rg.Point3d(
            origin.X + x * radius,
            origin.Y + y * radius / 8,
            origin.Z)

        return pt

    
    def get_radius(self, angle: float, tz: float) -> float:
        radius = self.radius_base*(1-tz) + self.radius_top*tz
        return radius

    
    def get_radius_bezier(self, tz: float) -> float:
        bezier = rg.BezierCurve(
            [
                rg.Point2d(0, 0),
                rg.Point2d(0.2,y1),
                rg.Point2d(0.8,y2),
                rg.Point2d(1,0)
            ]
        )

        radius = self.radius_base*(1-tz) + self.radius_top*tz
        radius += bezier.PointAt(tz).Y*5
        return radius


    # # flipped cos function
    # def get_zigzag(self, angle: float, freq: int, amp: float, nz: int) -> float:

    #     if nz % 5 == 0:
    #         zigzag = amp * m.cos(angle * 300)
    #         #  print(zigzag)
    #         return zigzag
    #     else:
    #         flipped_zigzag = -(amp * m.cos(angle * 300))
    #         return flipped_zigzag


    # shifted cos function
    def get_zigzag(self, angle: float, freq: int, amp: float, nz: int) -> float:

        # if nz % 2 == 0:
        #     zigzag = amp * m.cos(angle * 300) 
        #     #  print(zigzag)
        #     return zigzag
        # else:
        #     shifted_zigzag = (amp * m.cos((angle+(m.pi/4)) * 300))
        #     return shifted_zigzag


        shift = nz * (m.pi / (freq*shift_step))
        zigzag = amp * m.cos((angle + shift) * freq)
        return zigzag


    def get_radius_wave(self, angle: float, tz: float, freq: int, amp: float) -> float:
        # rotate
        shift = tz*m.radians(270)
        angle += shift

        # # fade
        # amp = m.pow((tz), 2) * amp

        # radius = self.get_radius(angle, tz) + m.cos(angle*freq) * amp
        # return radius

        # # blend wave freq
        # freq1 = 2
        # freq2 = 4

        # _r1 = m.cos(angle*freq1)*amp
        # _r2 = m.cos(angle*freq2)*amp

        # radius = self.get_radius(angle, tz) + _r1*(1-tz) + _r2*(tz)
        # return radius

        # rotate in both direction
        shift = tz*m.radians(260)

        a1 = angle + shift
        a2 = angle - shift

        _r1 = self.get_radius(angle, tz) + m.cos(a1 * freq) * amp
        _r2 = self.get_radius(angle, tz) + m.cos(a2 * freq) * amp
        # radius = _r1*(1-tz) + _r2*tz
        radius = (_r1 + _r2) / 2
        # radius = max(_r1, _r2)
        # radius = min(_r1, _r2)

        return radius


    def get_layers(self, layer_height: float, res_u: int) -> list[list[rg.Point3d]]:

        layers_count = int(self.height // layer_height) + 1
        layers = []

        for nz, tz in enumerate(np.linspace(0, 1, layers_count)[1:]):
            layer = []
            for na, angle in enumerate(np.linspace(0, m.tau, res_u)[:-1]):
                pt = self.get_point(angle, tz, nz, na)
                layer.append(pt)

            layers.append(layer)

        return layers


    @staticmethod
    def get_extrusion_data(layers, window_interval, window_width):

        extrusion = []
        io_events = []

        for i, layer in enumerate(layers):

            layer_states = []

            # shifted/zigzag lines for window
            zigzag_interval = i % (2 * shift_step)

            if zigzag_interval <= shift_step:
                shift = zigzag_interval
            else:
                shift = (2 * shift_step) - zigzag_interval

            for j, pt in enumerate(layer):

                # # straight lines for window
                # is_window = (j % window_interval) < window_width

                # rotated/shifted lines for window
                shift = i / shift_step
                is_window = ((j + shift) % window_interval) < window_width


                # # zigzag lines for window
                # is_window = ((j + shift) % window_interval) < window_width

                # True = extrusion ON
                # False = extrusion OFF
                state = not is_window

                layer_states.append(state)

                # Record only when IO state changes
                if j == 0 or state != layer_states[j-1]:

                    io_events.append({
                        "layer": i,
                        "point": j,
                        "extrusion": state,
                        "position": pt
                    })

            extrusion.append(layer_states)

        return extrusion, io_events



    @staticmethod
    def get_mesh(layers: list[list[rg.Point3d]], closed: bool) -> rg.Mesh:

        mesh = rg.Mesh()

        for layer in layers:
            for pt in layer:
                mesh.Vertices.Add(pt)

        idx = np.array(range(mesh.Vertices.Count))
        idx = idx.reshape(len(layers), len(layers[0]))

        if closed:

            faces = np.stack([
                idx[:-1],
                np.roll(idx[:-1], -1, axis=1),
                np.roll(idx[1:], -1, axis=1),
                idx[1:],
            ], axis=-1).reshape(-1, 4)

        else:

            faces = np.lib.stride_tricks.sliding_window_view(
                idx, window_shape=(2, 2)
            ).reshape(-1, 4)

        for face in faces:

            mesh.Faces.AddFace(
                *[int(f) for f in face]
            )

        mesh.Compact()
        mesh.RebuildNormals()
        return mesh


if __name__ == "__main__":

    axis = rg.LineCurve(
        rg.Point3d(0, 0, 0),
        rg.Point3d(0, 0, 100)
    )

    mycolumn = Column(axis, radius_base, radius_top)
    layers = mycolumn.get_layers(layer_height, res_u)


    extrusion, _ = Column.get_extrusion_data(
        layers,
        window_interval,
        window_width
    )

    index = []

    for i, layer in enumerate(layers):

        for j, pt in enumerate(layer):

            if extrusion[i][j]:
                index.append(2)

            else:
                index.append(3)   # window. NOTE: 3 = DO3 = 7 mm/s, 2 = DO2 = 1 mm/s on this robot: swap 2 and 3 here if the window should be the thin one


    # n_turns = int(h // layer_h)
    # d_ang = m.tau / resolution
    # d_h = h / (resolution * n_turns)
    # l_h = h / n_turns

    # # 1. Generate points
    # pts = [
    #     [
    #         Point(
    #             x_rad * m.cos(d_ang * i),
    #             y_rad * m.sin(d_ang * i),
    #             (j * l_h) + first_h
    #         )
    #         for i in range(resolution)
    #     ]
    #     for j in range(n_turns)
    # ]

    # revised_pts = [p[(shift*np)%(len(p)-1):] + p[:(shift*np)%(len(p)-1)] for np, p in enumerate(pts)]
    # # pts_new = []
    # # for np, p in enumerate(pts):
    # #     shifting_index = (shift*np)%(len(p)-1)
    # #     pt_new = p[shifting_index:] + p[:shifting_index]
    # #     pts_new.append(pt_new)
    # index = [[1 if p == 0 else 2 for p in range(len(np))] for np in revised_pts]

    # revised_pts = tree.list_to_tree(revised_pts)
    # index = tree.list_to_tree(index)



    layers = tree.list_to_tree(layers)
    index = tree.list_to_tree(index)
# ---------- end python_3_script_2 ----------

# ----
lamcp_bridge = LAMCPBridge(enable=Toggle(True))  # -> status; inputs enable: Boolean, port: Int32; same code as lamcp
panel_4 = Panel(lamcp_bridge)

pick_safe_preview = Python3Script()  # -> planes; inputs frames: list
# ---------- pick_safe_preview: Python ----------
"""
Convert COMPAS Frames to Rhino Planes for preview.
    Input:  frames (List Access, No Type Hint)
    Output: planes
"""
import Rhino.Geometry as rg
from compas.geometry import Frame
from compas_rhino.conversions import frame_to_rhino_plane


def to_plane(item):
    if item is None:
        return None
    if isinstance(item, rg.Plane):
        return item
    if isinstance(item, Frame):
        return frame_to_rhino_plane(item)
    raise TypeError("Not a COMPAS Frame: {}".format(type(item)))


def flatten(items):
    for item in items:
        if isinstance(item, (list, tuple)):
            for sub in flatten(item):
                yield sub
        else:
            yield item


planes = [to_plane(f) for f in flatten(frames or [])]
ghenv.Component.Message = "{} planes".format(len(planes))
# ---------- end pick_safe_preview ----------

radius_top_mm = Slider(25, range=5..200)
bulge_mm = Slider(5, range=-50..50)
twist_deg = Slider(45, range=-360..360)
wave_amp_mm_2 = Slider(4, range=0..20)
wave_freq_2 = Slider(6, range=0..12)
height_mm_3 = Slider(50, range=1..500)
radius_mm_3 = Slider(20, range=5..200)

point_spacing_mm_3 = Slider(5, range=1..50)
layer_height_mm_3 = Slider(1, range=0.5..10)

point_spacing_mm_4 = Slider(3, range=1..50)
layer_height_mm_4 = Slider(1, range=0.5..10)

fine_adjust_z_mm_3 = Slider(1, range=-5..5)
center_y_mm_3 = Slider(100, range=-500..500)
center_x_mm_3 = Slider(100, range=-500..500)

fine_adjust_z_mm_4 = Slider(1, range=-5..5)
center_x_mm_4 = Slider(100, range=-500..500)
center_y_mm_4 = Slider(100, range=-500..500)

# ----
# classic slicing
brep = Brep(<brep referenced from the Rhino model>)
slice_brep = SliceBrep(brep=brep, layer_height=layer_height_mm_3, point_spacing=point_spacing_mm_3, fine_adjust_z=fine_adjust_z_mm_3)  # -> layers; inputs brep: Brep
# ---------- slice_brep: Python ----------
# r: compas
# venv: mas-2627
"""
Slice a brep into layers, in work object coordinates (Rhino world XY = work object).
One closed compas Polyline per layer, same as slice cylinder. Units: mm.
The bottom of the brep is placed on the bed: first layer at z = 0, plus fine_adjust_z.
"""
import Rhino
import Rhino.Geometry as rg
from Rhino.Geometry.Intersect import Intersection
from compas.geometry import Point
from compas.geometry import Polyline

tolerance = Rhino.RhinoDoc.ActiveDoc.ModelAbsoluteTolerance
box = brep.GetBoundingBox(True)
layer_count = int((box.Max.Z - box.Min.Z) / layer_height)

layers = []
for i in range(layer_count):
    # ===== Cut the brep in the middle of the layer, keep the longest curve =====
    z_cut = box.Min.Z + (i + 0.5) * layer_height
    ok, curves, points = Intersection.BrepPlane(brep, rg.Plane(rg.Point3d(0, 0, z_cut), rg.Vector3d.ZAxis), tolerance)
    curves = rg.Curve.JoinCurves(curves)
    if not curves:
        continue
    contour = max(curves, key=lambda curve: curve.GetLength())

    # ===== Same direction and same seam (on the +x side) on every layer =====
    if contour.ClosedCurveOrientation(rg.Plane.WorldXY) == rg.CurveOrientation.Clockwise:
        contour.Reverse()
    ok, t = contour.ClosestPoint(rg.Point3d(box.Max.X + 1000, box.Center.Y, z_cut))
    contour.ChangeClosedCurveSeam(t)

    # ===== Points every point_spacing, closed: back to the start =====
    count = round(contour.GetLength() / point_spacing)
    z = i * layer_height + fine_adjust_z
    points = [Point(p.X, p.Y, z) for p in (contour.PointAt(t) for t in contour.DivideByCount(count, True))]
    layers.append(Polyline(points + [points[0]]))
# ---------- end slice_brep ----------

# ----
# design: tor alva style
interpolated_column = InterpolatedColumn(
    radius=radius_mm_3,
    radius_top=radius_top_mm,
    height=height_mm_3,
    bulge=bulge_mm,
    wave_amp=wave_amp_mm_2,
    wave_freq=wave_freq_2,
    twist=twist_deg,
    layer_height=layer_height_mm_4,
    point_spacing=point_spacing_mm_4,
    center_x=center_x_mm_4,
    center_y=center_y_mm_4,
    fine_adjust_z=fine_adjust_z_mm_4)  # -> layers
# ---------- interpolated_column: Python ----------
# r: compas
# venv: mas-2627
import math

from compas.geometry import Point
from compas.geometry import Polyline


def get_radius(angle, t):
    # base radius to top radius, plus a bulge in the middle, plus a wave that twists up the column
    r = radius * (1 - t) + radius_top * t
    r += bulge * math.sin(math.pi * t)
    r += wave_amp * math.cos(wave_freq * (angle + math.radians(twist) * t))
    return r


# ===== How many layers, how many points per layer =====
layer_count = int(height / layer_height)
points_per_layer = round(2 * math.pi * radius / point_spacing)

# ===== One closed polyline per layer =====
layers = []
for i in range(layer_count):
    z = i * layer_height + fine_adjust_z
    t = i * layer_height / height  # 0 at the bottom, close to 1 at the top
    points = []
    for j in range(points_per_layer + 1):  # one extra point: back to the start to close the ring
        angle = 2 * math.pi * (j % points_per_layer) / points_per_layer
        r = get_radius(angle, t)
        points.append(Point(center_x + r * math.cos(angle), center_y + r * math.sin(angle), z))
    layers.append(Polyline(points))
# ---------- end interpolated_column ----------

# ---- group: point class index (1 off / 2 = DO2 1 mm/s / 3 = DO3 7 mm/s)
data = Data(flatten(python_3_script.index))

# ---- group: design layers (Rhino points) - swap shape here
data_2 = Data(flatten(python_3_script.layers))

# ---- group: input your COMPAS Data
data_3 = Data(spiral.layer)

# ---- group: input your RHINO Data
data_4 = Data(plane)

# ---- group: insert tail point
number_slider_5 = Slider(15, range=0..20)
list_item = ListItem(List=flatten(data_4), Index=0, Wrap=True)
vector_xyz = VectorXYZ(XComponent=number_slider_5, YComponent=number_slider_5, ZComponent=expr("0", 0))  # -> Vector, Length
move = Move(Geometry=list_item, Motion=vector_xyz.Vector)  # -> Geometry, Transform
point_3 = Point(move.Geometry)
insert_items = InsertItems(List=flatten(data_4), Item=point_3, Indices="0", Wrap=True)  # -> simplify(List)
polyline = PolyLine(Vertices=insert_items, Closed=False)

# ---- group: 2 ADD TAIL - flatten, add tail points + point class
add_tail_info = Add_tail_info(list=flatten(data_2), F="100", list_2=data, item="2")  # -> cg, list_3

# ---- group: PRINTPATH
# generate printpath: printpoints and path
safety_distance_mm_2 = Slider(100, range=10..300)
blend_radius_mm_2 = Slider(0.5, range=0..5)
speed_mm_s = Slider(10, range=1..50)
printpath_2 = Printpath(layers=interpolated_column, speed=speed_mm_s, blend_radius=blend_radius_mm_2, safety_distance=safety_distance_mm_2)  # -> printpath, summary; inputs layers: list
# ---------- printpath_2: Python ----------
# r: compas
# venv: mas-2627
"""
Turn the layers into printpoints and a PrintPath, in work object coordinates.
Safety points are added here, before any transform to the robot base.
"""
import os
import sys

from compas.geometry import Frame, Vector


# Find source folder
gh_dir = os.path.dirname(ghenv.Component.OnPingDocument().FilePath)
src_dir = os.path.join(gh_dir, "..", "..", "src")
if src_dir not in sys.path:
    sys.path.append(src_dir)
from print_class import PrintPoint, PrintPath

# ===== One printpoint per point =====
# world XY orientation for every point: a tangent frame would turn the wrist 360 degrees each layer
printpoints = []
for layer_index, layer in enumerate(layers):
    for point in layer.points:
        frame = Frame(point, -Vector.Xaxis(), Vector.Yaxis())
        printpoints.append(PrintPoint(frame, layer_index, speed, blend_radius, True))

# ===== Path with a travel point above the start and the end =====
printpath = PrintPath(printpoints)

printpath.printpoints[0].speed *= 2
printpath.add_safety_before(safety_distance, speed*2)
printpath.add_safety_after(safety_distance, speed*2)

summary = f"{len(printpoints)} printpoints in {len(layers)} layers, plus 2 safety points"
# ---------- end printpath_2 ----------
panel_5 = Panel(printpath_2.summary)

# ---- group: 3 PRINTPATH - printpoints, speed (Genes), blend, safety
safety_distance_mm_3 = Slider(100, range=10..300)
first_layer_lift_mm = Slider(1.2, range=0..10)
blend_radius_mm_3 = Slider(1, range=0..5)
genes_2 = GenePool(Decimals=0, Maximum=50, Minimum=0, Value=[6, 20])
printpath_3 = Printpath(
    layers=add_tail_info.cg,
    pt_class=add_tail_info.list_3,
    speed=genes_2,
    blend_radius=blend_radius_mm_3,
    safety_distance=safety_distance_mm_3,
    first_layer_lift=first_layer_lift_mm)  # -> printpath, summary; inputs layers: list, pt_class: list of Int32, speed: list, first_layer_lift: Double
# ---------- printpath_3: Python ----------
#! python3
# r: compas
# venv: mas-2627
"""
Turn the layers into printpoints and a PrintPath, in work object coordinates.
Safety points are added here, before any transform to the robot base.
    first_layer_lift : lifts every point along Z, mm (was the Move + Unit Z group). Empty = 0
"""
import os
import sys
import importlib

from compas.geometry import Frame, Point, Vector


# Find source folder
gh_dir = os.path.dirname(ghenv.Component.OnPingDocument().FilePath)
print(gh_dir)
src_dir = os.path.join(gh_dir, "src")
print(src_dir)
if src_dir not in sys.path:
    sys.path.append(src_dir)
from print_class_02 import PrintPoint, PrintPath


# ===== One printpoint per point =====
# layer index = which z level the point is on (the layers come in flattened, so the layer is found from z)
z_levels = sorted(set(round(float(p[2]), 3) for p in layers))
layer_of = {z: n for n, z in enumerate(z_levels)}
dz = float(first_layer_lift) if first_layer_lift is not None else 0.0   # mm, lifts the whole path
# world XY orientation for every point: a tangent frame would turn the wrist 360 degrees each layer
printpoints = []
for pt_index, pt in enumerate(layers):
    t = (pt_index / (len(layers) - 1))
    frame = Frame(Point(pt[0], pt[1], pt[2] + dz), -Vector.Xaxis(), Vector.Yaxis())

    # bool_extrude = False if pt_class[pt_index] == 1 else True
    # Above if we want an actual extrude/no extrude to affect the movement
    v = speed[0] if pt_class[pt_index] == 3 else speed[1]   # 3 = main body (DO3 -> aspeed 0 = 7 mm/s): first robot speed; 2 = thin lines (DO2 -> aspeed 1 = 1 mm/s): second

    printpoints.append(PrintPoint(frame, layer_of[round(float(pt[2]), 3)], v, blend_radius, True, pt_class[pt_index]))   # v: one robot speed per point (not the whole Genes list)
    # ABOVE if speed is a single input

# ===== Path with a travel point above the start and the end =====
printpath = PrintPath(printpoints)
printpath.add_safety_before(safety_distance, max(speed))   # one speed (the fastest) for the travel moves
printpath.add_safety_after(safety_distance, max(speed))

summary = f"{len(printpoints)} printpoints in {len(z_levels)} layers, plus 2 safety points, z offset {dz:.2f} mm"
# ---------- end printpath_3 ----------
panel_6 = Panel(printpath_3.summary)

# ---- group: 4 PRINT BED - bed plane from 4 corners + object position
pt = ConstructPoint(XCoordinate=Slider(0.5, range=0..1), YCoordinate=Slider(0.5, range=0..1), ZCoordinate=0)
printbed_position = _4PointSurface(
    CornerA="535.57,-65.74,-9.79",
    CornerB="535.54,528.09,-10.52",
    CornerC="136.49,527.66,-10.90",
    CornerD="136.49,-67.26,-9.86")
cluster_2 = Cluster_3(S=printbed_position, uv=pt, A=degrees(Slider(270, range=0..360)))

# ----
panel_7 = Panel(insert_items)

# ---- group: DISPLAY: check before you print
# export: preview and save
panel_8 = Panel("data/out_printpoints.json")
save = Button()
save_2 = Save(printpath=printpath_2.printpath, save=save, out_path=panel_8)  # -> status
# ---------- save_2: Python ----------
# r: compas
# venv: mas-2627
"""
On button press, write the printpath to data/out_printpoints.json next to this .ghx file.
send_to_robot.py reads that file.
"""
import json
import os

import scriptcontext as sc

gh_dir = os.path.dirname(ghenv.Component.OnPingDocument().FilePath)

# keep the last status in sticky, so the message survives the button being released
status_key = "save_status_" + str(ghenv.Component.InstanceGuid)

if save:
    if printpath is None:
        sc.sticky[status_key] = "nothing to save: no printpath"
    else:
        path = os.path.normpath(os.path.join(gh_dir, out_path))
        os.makedirs(os.path.dirname(path), exist_ok=True)
        with open(path, "w") as f:
            json.dump(printpath.to_dict(), f, indent=2)
        sc.sticky[status_key] = f"saved {len(printpath)} printpoints to {path}"

status = sc.sticky.get(status_key, "")
ghenv.Component.Message = "saved" if status.startswith("saved") else status
# ---------- end save_2 ----------
panel_9 = Panel(save_2)

# ---- group: 5 PLACE ON BED + SAVE JSON - move path onto the bed, press save
place_on_bed = Python3Script(printpath=printpath_3.printpath, bed_plane=cluster_2)  # -> printpath_on_bed, summary; inputs bed_plane: Plane
# ---------- place_on_bed: Python ----------
#! python3
# r: compas
# venv: mas-2627
"""
Place the printpath on the print bed.
bed_plane comes from 校正桌面: the bed surface at (u, v), turned by the object angle, z up (no lift here: the first layer lift is first_layer_lift in printpath).
The printpath is built around world XY, so world XY is moved onto bed_plane.
The output is a normal PrintPath (now in robot base coordinates), so preview and save work as before.
"""
import os
import sys

from compas.geometry import Frame, Transformation
from compas_rhino.conversions import plane_to_compas_frame

# Find source folder
gh_dir = os.path.dirname(ghenv.Component.OnPingDocument().FilePath)
src_dir = os.path.join(gh_dir, "src")
if src_dir not in sys.path:
    sys.path.append(src_dir)
from print_class_02 import PrintPath

# ===== world XY -> bed plane =====
bed = plane_to_compas_frame(bed_plane)
transformation = Transformation.from_frame_to_frame(Frame.worldXY(), bed)

# ===== New printpath, the original stays untouched =====
placed = []
for printpoint in printpath.printpoints:
    new_printpoint = printpoint.copy()
    new_printpoint.frame.transform(transformation)
    placed.append(new_printpoint)
printpath_on_bed = PrintPath(placed)

z_values = [printpoint.frame.point.z for printpoint in placed]
summary = f"bed origin: {[round(v, 2) for v in bed.point]}\nz from {min(z_values):.1f} to {max(z_values):.1f} mm (robot base)"
# ---------- end place_on_bed ----------
save_3 = Button()
panel_10 = Panel(place_on_bed.summary)
save_4 = Save(printpath=place_on_bed.printpath_on_bed, save=save_3, out_path="data/out_printpoints_weijiun.json")  # -> status; same code as save_2

# ----
panel_11 = Panel(polyline)

# ---- group: TO CONVERT RHINO CURVES TO COMPAS GEOM
python_3_script_3 = Python3Script(layers=polyline)  # -> out, cg; inputs layers: list
# ---------- python_3_script_3: Python ----------
from compas_rhino.conversions import curve_to_compas_polyline

# cg = [curve_to_compas_polyline(layer) for layer in layers]
cg = []
for layer in layers:
    p = curve_to_compas_polyline(layer)
    cg.append(p)
# ---------- end python_3_script_3 ----------

# ---- group: ⑨ robot speed：geometry 接 COMPAS 或 Rhino data（每層 polyline 或一整條）→ robot_speed → printpath.robot_speed（厚的慢、薄的快）
min_speed_mm_s_thick = Slider(8, range=1..30)
max_speed_mm_s_thin = Slider(12, range=1..30)
layer_height_mm_5 = Slider(1.5, range=0.5..10)

# ---- group: ⑧ 轉 TCP：工具頭繞噴嘴轉，讓鐵片避開已印部分（-45° = 0 碰撞）
tcp_rotate_deg = Slider(-20, range=-180..180)
rotate_tcp = RotatePlane(Plane=plane, Angle=degrees(tcp_rotate_deg))

# ---- group: 6 ROBOT SIM - UR5 path, collisions, play (Index / Play / Timeline)
check_every_n_targets = Slider(5, range=1..50)
tool_mesh_edit = ToolMeshEdit([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])
ur5_path_solver = Python3Script(Targets=place_on_bed.printpath_on_bed, ToolMesh=tool_mesh_edit, CheckEvery=check_every_n_targets)  # -> Sim, Joints, Reach, Path, Analysis, Info, Collide; inputs Targets: list, Tool: Plane, Base: Plane, Seed: list, Collision: list, ToolMesh: list of Mesh, CheckEvery: Int32
# ---------- ur5_path_solver: Python ----------
#! python3
"""UR5 (CB3) kinematics, pure python. Units mm / rad inside, degrees outside."""
import math

# UR5 DH parameters (mm), same as Universal Robots publish
D1, A2, A3, D4, D5, D6 = 89.159, -425.0, -392.25, 109.15, 94.65, 82.3
DH_D = [D1, 0.0, 0.0, D4, D5, D6]
DH_A = [0.0, A2, A3, 0.0, 0.0, 0.0]
DH_ALPHA = [math.pi / 2, 0.0, 0.0, math.pi / 2, -math.pi / 2, 0.0]
LIMITS = [(-360.0, 360.0)] * 6   # UR5 CB3: every joint +-360 deg


def _dh(theta, d, a, alpha):
    ct, st, ca, sa = math.cos(theta), math.sin(theta), math.cos(alpha), math.sin(alpha)
    return [[ct, -st * ca, st * sa, a * ct],
            [st, ct * ca, -ct * sa, a * st],
            [0.0, sa, ca, d],
            [0.0, 0.0, 0.0, 1.0]]


def mul(a, b):
    return [[sum(a[i][k] * b[k][j] for k in range(4)) for j in range(4)] for i in range(4)]


def inv(t):
    r = [[t[j][i] for j in range(3)] for i in range(3)]
    p = [-sum(r[i][k] * t[k][3] for k in range(3)) for i in range(3)]
    return [r[0] + [p[0]], r[1] + [p[1]], r[2] + [p[2]], [0.0, 0.0, 0.0, 1.0]]


def frames(q_deg):
    """Base -> frame 1..6 (flange) for joints in degrees."""
    out, t = [], [[1.0 if i == j else 0.0 for j in range(4)] for i in range(4)]
    for i in range(6):
        t = mul(t, _dh(math.radians(q_deg[i]), DH_D[i], DH_A[i], DH_ALPHA[i]))
        out.append(t)
    return out


def fk(q_deg):
    return frames(q_deg)[-1]


def ik(t):
    """All analytic solutions (deg, in [-180, 180)) for a flange pose t (4x4, mm)."""
    sols = []
    p05 = [t[i][3] - D6 * t[i][2] for i in range(3)]
    r = math.hypot(p05[0], p05[1])
    if r < D4:
        return sols
    psi = math.atan2(p05[1], p05[0])
    phi = math.acos(D4 / r)
    for th1 in (psi + phi + math.pi / 2, psi - phi + math.pi / 2):
        s1, c1 = math.sin(th1), math.cos(th1)
        c5 = (t[0][3] * s1 - t[1][3] * c1 - D4) / D6
        if abs(c5) > 1.0 + 1e-9:
            continue
        c5 = max(-1.0, min(1.0, c5))
        for th5 in (math.acos(c5), -math.acos(c5)):
            s5 = math.sin(th5)
            if abs(s5) < 1e-9:
                th6 = 0.0   # wrist singularity: only th4 + th6 is defined
            else:
                th6 = math.atan2((-t[0][1] * s1 + t[1][1] * c1) / s5, (t[0][0] * s1 - t[1][0] * c1) / s5)
            t01 = _dh(th1, DH_D[0], DH_A[0], DH_ALPHA[0])
            t45 = _dh(th5, DH_D[4], DH_A[4], DH_ALPHA[4])
            t56 = _dh(th6, DH_D[5], DH_A[5], DH_ALPHA[5])
            t14 = mul(mul(inv(t01), t), inv(mul(t45, t56)))
            # origin of frame 3 seen from frame 1 (remove the d4 offset along y of frame 4)
            px = t14[0][3] - D4 * t14[0][1]
            py = t14[1][3] - D4 * t14[1][1]
            l = math.hypot(px, py)
            c3 = (l * l - A2 * A2 - A3 * A3) / (2 * A2 * A3)
            if abs(c3) > 1.0 + 1e-9:
                continue
            c3 = max(-1.0, min(1.0, c3))
            for th3 in (math.acos(c3), -math.acos(c3)):
                th2 = math.atan2(-py, -px) - math.asin(max(-1.0, min(1.0, -A3 * math.sin(th3) / l)))
                t12 = _dh(th2, DH_D[1], DH_A[1], DH_ALPHA[1])
                t23 = _dh(th3, DH_D[2], DH_A[2], DH_ALPHA[2])
                t34 = mul(inv(mul(t12, t23)), t14)
                th4 = math.atan2(t34[1][0], t34[0][0])
                sols.append([(math.degrees(v) + 180.0) % 360.0 - 180.0 for v in (th1, th2, th3, th4, th5, th6)])
    return sols


def variants(sol):
    """Every +-360 turn of every joint that stays inside the limits."""
    out = [[]]
    for a, (lo, hi) in zip(sol, LIMITS):
        out = [o + [v] for o in out for v in (a - 360.0, a, a + 360.0) if lo <= v <= hi]
    return out


def cost(q, prev):
    return sum(w * (a - b) ** 2 for w, a, b in zip((1, 1, 1, 0.5, 0.5, 0.25), q, prev))


def solve_path(flanges, seed):
    """Joint values per flange pose, each closest to the previous pose (None if unreachable)."""
    joints, prev = [], seed
    for t in flanges:
        sols = ik(t)
        if not sols:
            joints.append(None)
            continue
        # closest turn of each joint to the previous pose, then the closest solution
        best = None
        for s in sols:
            q = [min((v for v in (a - 360.0, a, a + 360.0) if lo <= v <= hi), key=lambda v: abs(v - p))
                 for a, p, (lo, hi) in zip(s, prev, LIMITS)]
            c = cost(q, prev)
            if best is None or c < best[0]:
                best = (c, q)
        joints.append(best[1])
        prev = best[1]
    return joints




# ====================================================================
# UR5 Path Solver - same idea as the IRB 2600 Path Solver (TACO logic):
# TCP targets (robot base, mm) -> flange poses -> inverse kinematics -> checks.
# Simulation only: nothing is sent to the robot (send_to_robot.py does that).
#
# Inputs
#   Targets : place on bed > printpath_on_bed (PrintPath), or compas Frames, or Rhino Planes (robot base, mm)
#   Tool    : TCP plane in the flange frame. Empty = TOOL_FRAME of send_to_robot.py
#   Base    : robot base plane in Rhino. Empty = World XY (the path is already in robot base coordinates)
#   Seed    : 6 joint values (deg) the first target should stay close to. Empty = robot pose read on 2026-11-05
#   CheckEvery : collision check on every N-th target only (faster). Empty = 1 (every target)
# Outputs
#   Sim      : solved path for UR5 Robot Pose
#   Joints   : joint values (deg), one branch per target
#   Reach    : True per target if a solution exists
#   Path     : polyline through all TCP positions
#   Analysis : True if every target is reachable, no flip, no singularity
#   Info     : report
# Joint states (colours in Robot Pose)
#   grey = ok, orange = near limit, red = unreachable, yellow = singularity, magenta = joint flip
# ====================================================================
import Grasshopper
import numpy as np
import Rhino.Geometry as rg
import System.Drawing as sd
from ghpythonlib import treehelpers as th

TOOL_XYZ = (-57.08, 44.54, 189.5)                     # TOOL_FRAME in send_to_robot.py (= UR installation TCP)
SEED = [205.43, -84.05, 89.30, -95.24, -89.94, -52.40]  # robot pose read over RTDE on 2026-11-05
FLIP_DEG = 30.0          # joint change between two targets reported as a flip ...
FLIP_DEG_PER_MM = 0.5    # ... when it is also large compared to the TCP travel
NEAR_LIMIT_DEG = 10.0
SINGULAR_DEG = 5.0       # wrist: |sin A5| , elbow: |sin A3| below sin(5 deg)
SHOULDER_MM = 20.0       # wrist centre closer than this to the shoulder singular cylinder

COLORS = {
    "ok": sd.Color.FromArgb(170, 170, 170),
    "near limit": sd.Color.FromArgb(255, 150, 0),
    "limit": sd.Color.FromArgb(230, 30, 30),
    "singular": sd.Color.FromArgb(255, 225, 0),
    "flip": sd.Color.FromArgb(220, 40, 220),
    "collision": sd.Color.FromArgb(255, 0, 0),
}
SEVERITY = ["ok", "near limit", "singular", "flip", "limit", "collision"]


def polyline(points):
    """rg.Polyline from a python list (the list constructor is not picked reliably by every Rhino)."""
    pl = rg.Polyline()
    for p in points:
        pl.Add(p)
    return pl


def plane_to_m(pl):
    x, y, z, o = pl.XAxis, pl.YAxis, pl.ZAxis, pl.Origin
    return [[x.X, y.X, z.X, o.X], [x.Y, y.Y, z.Y, o.Y], [x.Z, y.Z, z.Z, o.Z], [0.0, 0.0, 0.0, 1.0]]


def m_to_plane(m):
    return rg.Plane(rg.Point3d(m[0][3], m[1][3], m[2][3]),
                    rg.Vector3d(m[0][0], m[1][0], m[2][0]), rg.Vector3d(m[0][1], m[1][1], m[2][1]))


def to_plane(t):
    if isinstance(t, rg.Plane):
        return t
    if hasattr(t, "point") and hasattr(t, "xaxis"):   # compas Frame
        p, x, y = t.point, t.xaxis, t.yaxis
        return rg.Plane(rg.Point3d(p[0], p[1], p[2]), rg.Vector3d(x[0], x[1], x[2]), rg.Vector3d(y[0], y[1], y[2]))
    return None


def joint_status(q, prev_q, is_flip, shoulder):
    out = []
    for j, (a, (lo, hi)) in enumerate(zip(q, LIMITS)):
        s = "ok"
        if min(a - lo, hi - a) < NEAR_LIMIT_DEG:
            s = "near limit"
        if j == 4 and abs(math.sin(math.radians(a))) < math.sin(math.radians(SINGULAR_DEG)):
            s = "singular"
        if j == 2 and abs(math.sin(math.radians(a))) < math.sin(math.radians(SINGULAR_DEG)):
            s = "singular"
        if j == 0 and shoulder:
            s = "singular"
        if is_flip and prev_q is not None and abs(a - prev_q[j]) > FLIP_DEG:
            s = "flip"
        if a <= lo or a >= hi:
            s = "limit"
        out.append(s)
    return out


def shoulder_singular(q):
    t = fk(q)
    p05 = [t[i][3] - D6 * t[i][2] for i in range(3)]
    return math.hypot(p05[0], p05[1]) - D4 < SHOULDER_MM


class Simulation(object):
    """Everything UR5 Robot Pose needs that does not depend on Index."""
    colors = COLORS
    severity = SEVERITY
    name = "UR5 (CB3)"

    def __init__(self, targets, joints, tool, base, extruding, layers=None, collisions=None):
        self.joints = joints
        self.tool = tool
        self.tool_m = plane_to_m(tool)
        self.to_world = rg.Transform.PlaneToPlane(rg.Plane.WorldXY, base)
        self.extruding = extruding
        self.layers = layers or []
        self.collisions = collisions or {}     # target index -> name of the part that hits
        self.points = []
        for t in targets:
            p = rg.Point3d(t.Origin)
            p.Transform(self.to_world)
            self.points.append(p)
        self.unreachable = [i for i, q in enumerate(joints) if q is None]
        self.flips, self.prev_of, last = [], {}, None
        for i, q in enumerate(joints):
            if q is None:
                continue
            if last is not None:
                self.prev_of[i] = last
                dq = max(abs(a - b) for a, b in zip(q, joints[last]))
                if dq > FLIP_DEG and dq > FLIP_DEG_PER_MM * targets[i].Origin.DistanceTo(targets[last].Origin):
                    self.flips.append(i)
            last = i
        self.flip_set = set(self.flips)
        self.shoulder = set(i for i, q in enumerate(joints) if q and shoulder_singular(q))
        s5 = math.sin(math.radians(SINGULAR_DEG))
        self.singular = [i for i, q in enumerate(joints)
                         if q and (abs(math.sin(math.radians(q[4]))) < s5 or abs(math.sin(math.radians(q[2]))) < s5
                                   or i in self.shoulder)]
        self.near = [i for i, q in enumerate(joints)
                     if q and any(min(a - lo, hi - a) < NEAR_LIMIT_DEG for a, (lo, hi) in zip(q, LIMITS))]
        self.marks = ([(self.points[i], COLORS["collision"]) for i in sorted(self.collisions)[:3000]] +
                      [(self.points[i], COLORS["limit"]) for i in self.unreachable[:2000]] +
                      [(self.points[i], COLORS["flip"]) for i in self.flips[:2000]] +
                      [(self.points[i], COLORS["singular"]) for i in self.singular[:2000]])
        self.bbox = rg.BoundingBox.Empty
        for p in self.points:
            self.bbox = rg.BoundingBox.Union(self.bbox, rg.BoundingBox(p, p))

    def __len__(self):
        return len(self.joints)

    def __repr__(self):
        return "UR5 Simulation ({} targets)".format(len(self.joints))

    def pose(self, index):
        idx = max(0, min(int(index), len(self.joints) - 1))
        shown = next((k for k in range(idx, -1, -1) if self.joints[k] is not None),
                     next((k for k, j in enumerate(self.joints) if j is not None), None))
        if shown is None:
            return idx, None, None, ["limit"] * 6, False
        q = self.joints[shown]
        if shown != idx:
            return idx, shown, q, ["limit"] * 6, False
        prev_q = self.joints[self.prev_of[idx]] if idx in self.prev_of else None
        return idx, shown, q, joint_status(q, prev_q, idx in self.flip_set, idx in self.shoulder), True

    def link_planes(self, q):
        """Base plane + frame 1..6 (flange) + TCP, in Rhino world."""
        ms = frames(q)
        pls = [rg.Plane.WorldXY] + [m_to_plane(m) for m in ms] + [m_to_plane(mul(ms[-1], self.tool_m))]
        out = []
        for pl in pls:
            pl = rg.Plane(pl)
            pl.Transform(self.to_world)
            out.append(pl)
        return out

    def summary(self):
        return "path: {} collisions, {} unreachable, {} flips, {} singular, {} near limit".format(
            len(self.collisions), len(self.unreachable), len(self.flips), len(self.singular), len(self.near))


# ---------- collision: extruder parts vs printed material and the bed ----------
BEAD_R = 1.0     # half the bead width, mm (margin around the printed path)
STEP = 1.0       # printed path sampled every STEP mm
CELL = 20.0      # grid cell for the neighbour search, mm


def _inside(poly, u, v):
    """Vectorised point in polygon (ray casting). poly: list of (u, v); u, v: numpy arrays."""
    inside = np.zeros(u.shape, dtype=bool)
    n = len(poly)
    for k in range(n):
        (u1, v1), (u2, v2) = poly[k], poly[(k + 1) % n]
        cross = (v1 > v) != (v2 > v)
        with np.errstate(divide="ignore", invalid="ignore"):
            ux = u1 + (v - v1) * (u2 - u1) / (v2 - v1)
        inside ^= cross & (u < ux)
    return inside


def sample_print(targets, extruding):
    """Printed path sampled every STEP mm: points (N, 3) and the target index that prints each one."""
    on = extruding if extruding else [True] * len(targets)
    pts, owner = [], []
    for i in range(1, len(targets)):
        if not (on[i - 1] and on[i]):
            continue
        a, b = targets[i - 1].Origin, targets[i].Origin
        n = max(1, int(a.DistanceTo(b) / STEP))
        for k in range(1, n + 1):
            t = k / n
            pts.append((a.X + (b.X - a.X) * t, a.Y + (b.Y - a.Y) * t, a.Z + (b.Z - a.Z) * t))
            owner.append(i)
    return np.array(pts), np.array(owner)


def check_mesh_collisions(targets, flanges, extruding, meshes, tool, every=1):
    """Same check with meshes in the flange frame (Tool Mesh input). The part that holds the TCP
    (the nozzle) is skipped: it touches the print on purpose. Meshes must be closed."""
    pts, owner = sample_print(targets, extruding)
    if not len(pts):
        return {}
    bed_z = pts[:, 2].min() - 0.5
    grid = {}
    for idx, c in enumerate(map(tuple, np.floor(pts / CELL).astype(int))):
        grid.setdefault(c, []).append(idx)
    parts = []
    for k, mesh in enumerate(meshes):
        if mesh is None or mesh.Vertices.Count == 0:
            continue
        if mesh.ClosestPoint(tool.Origin).DistanceTo(tool.Origin) < 1.0:
            continue                                          # nozzle
        verts = np.array([(v.X, v.Y, v.Z) for v in mesh.Vertices])
        parts.append(("tool mesh {}".format(k), mesh, verts, verts.min(0) - BEAD_R, verts.max(0) + BEAD_R))
    hits = {}
    for i, f in enumerate(flanges):
        if i % every:
            continue
        fm = np.array(f)
        rot, org = fm[:3, :3], fm[:3, 3]
        for name, mesh, verts, lo_l, hi_l in parts:
            world = verts @ rot.T + org
            if world[:, 2].min() < bed_z:
                hits[i] = name + " / bed"
                break
            lo = np.floor((world.min(0) - BEAD_R) / CELL).astype(int)
            hi = np.floor((world.max(0) + BEAD_R) / CELL).astype(int)
            cand = [j for cx in range(lo[0], hi[0] + 1) for cy in range(lo[1], hi[1] + 1)
                    for cz in range(lo[2], hi[2] + 1) for j in grid.get((cx, cy, cz), ())]
            if not cand:
                continue
            cand = np.array(cand)
            cand = cand[owner[cand] <= i]
            if not len(cand):
                continue
            local = (pts[cand] - org) @ rot                   # world -> flange frame
            local = local[np.all((local >= lo_l) & (local <= hi_l), axis=1)]
            for x, y, z in local:
                p = rg.Point3d(x, y, z)
                if mesh.ClosestPoint(p).DistanceTo(p) <= BEAD_R or mesh.IsPointInside(p, 0.01, False):
                    hits[i] = name
                    break
            if i in hits:
                break
    return hits


def check_collisions(targets, flanges, extruding, solids, every=1):
    """Target index -> part name, for every pose where a solid touches printed material or the bed."""
    if not solids:
        return {}
    on = extruding if extruding else [True] * len(targets)
    pts, owner = [], []
    for i in range(1, len(targets)):
        if not (on[i - 1] and on[i]):
            continue
        a, b = targets[i - 1].Origin, targets[i].Origin
        n = max(1, int(a.DistanceTo(b) / STEP))
        for k in range(1, n + 1):
            t = k / n
            pts.append((a.X + (b.X - a.X) * t, a.Y + (b.Y - a.Y) * t, a.Z + (b.Z - a.Z) * t))
            owner.append(i)
    if not pts:
        return {}
    pts, owner = np.array(pts), np.array(owner)
    bed_z = pts[:, 2].min() - 0.5
    grid = {}
    for idx, c in enumerate(map(tuple, np.floor(pts / CELL).astype(int))):
        grid.setdefault(c, []).append(idx)
    local = [(s, np.array(plane_to_m(s.plane))) for s in solids]
    hits = {}
    for i, f in enumerate(flanges):
        if i % every:
            continue
        fm = np.array(f)
        for s, sm in local:
            m = fm @ sm                         # solid frame -> world
            rot, org = m[:3, :3], m[:3, 3]
            half = s.thickness / 2 + BEAD_R
            corners = np.array([org + rot @ (u, h, w) for u, h in s.outline for w in (-half, half)])
            if corners[:, 2].min() < bed_z:
                hits[i] = s.name + " / bed"
                break
            lo, hi = np.floor((corners.min(0) - BEAD_R) / CELL).astype(int), np.floor((corners.max(0) + BEAD_R) / CELL).astype(int)
            cand = [j for cx in range(lo[0], hi[0] + 1) for cy in range(lo[1], hi[1] + 1)
                    for cz in range(lo[2], hi[2] + 1) for j in grid.get((cx, cy, cz), ())]
            if not cand:
                continue
            cand = np.array(cand)
            cand = cand[owner[cand] <= i]       # only what is already printed at this pose
            if not len(cand):
                continue
            p = (pts[cand] - org) @ rot         # world -> solid frame (u, h, w)
            near = np.abs(p[:, 2]) <= half
            if not near.any():
                continue
            u, v = p[near, 0], p[near, 1]
            hit = np.zeros(u.shape, dtype=bool)
            for du, dv in ((0, 0), (BEAD_R, 0), (-BEAD_R, 0), (0, BEAD_R), (0, -BEAD_R)):
                hit |= _inside(s.outline, u + du, v + dv)
            if hit.any():
                hits[i] = s.name
                break
    return hits


# ---------- component ----------
items = [t for t in (Targets or []) if t is not None]
Sim = Joints = Reach = Path = Analysis = Info = Collide = None
extruding, layers, speeds = [], [], []
if len(items) == 1 and hasattr(items[0], "printpoints"):        # a PrintPath
    # extruder_index 1 = extruder off (DO1), e.g. the windows: draw those points as travel too
    extruding = [p.is_extruder_on and getattr(p, "extruder_index", 2) != 1 for p in items[0].printpoints]
    layers = [p.layer_index for p in items[0].printpoints]
    # a speed given as a list (e.g. Genes) counts as its fastest value
    speeds = [max(p.speed) if isinstance(p.speed, (list, tuple)) else p.speed for p in items[0].printpoints]
    items = [p.frame for p in items[0].printpoints]
targets = [to_plane(t) for t in items]
targets = [t for t in targets if t is not None]

if targets:
    tool = Tool if isinstance(Tool, rg.Plane) else rg.Plane(rg.Point3d(*TOOL_XYZ), rg.Vector3d.XAxis, rg.Vector3d.YAxis)
    base = Base if isinstance(Base, rg.Plane) else rg.Plane.WorldXY
    seed = [float(v) for v in Seed][:6] if Seed and len(Seed) >= 6 else SEED
    tool_inv = inv(plane_to_m(tool))
    flanges = [mul(plane_to_m(t), tool_inv) for t in targets]
    joints = solve_path(flanges, seed)
    try:
        EVERY = max(1, int(round(float(str(CheckEvery))))) if CheckEvery is not None else 1
    except NameError:
        EVERY = 1
    tool_meshes = [m for m in (ToolMesh or []) if isinstance(m, rg.Mesh)]
    solids = [s for s in (Collision or []) if hasattr(s, "outline")]
    if tool_meshes:      # the meshes you can edit win over the Extruder Model solids
        hits = check_mesh_collisions(targets, flanges, extruding, tool_meshes, tool, EVERY)
        solids = tool_meshes
    else:
        hits = check_collisions(targets, flanges, extruding, solids, EVERY)
    Sim = Simulation(targets, joints, tool, base, extruding, layers, hits)
    # time at each target: segment length / speed of the target it moves to (10 mm/s if unknown)
    Sim.times = [0.0]
    for i in range(1, len(targets)):
        v = speeds[i] if i < len(speeds) and speeds[i] > 0 else 10.0
        Sim.times.append(Sim.times[-1] + targets[i - 1].Origin.DistanceTo(targets[i].Origin) / v)

    hit_layers = sorted(set(layers[i] + 1 for i in hits)) if layers else []
    first = min(hits) if hits else None
    Info = "\n".join([
        "robot: UR5 (CB3), base = {}".format("World XY" if base == rg.Plane.WorldXY else "custom plane"),
        "targets: {}{}".format(len(targets), "" if EVERY == 1 else "   (collision check on every {}th target)".format(EVERY)),
        "COLLISIONS: {}{}".format(len(hits), "" if not hits else "  first at index {} ({}){}, parts: {}".format(
            first, hits[first], ", layer {}".format(layers[first] + 1) if layers else "", sorted(set(hits.values())))),
        "  layers with collisions: {}".format(hit_layers[:40]) if hit_layers else ("  (no Collision solids connected)" if not solids else ""),
        "unreachable: {}{}".format(len(Sim.unreachable), " " + str(Sim.unreachable[:20]) if Sim.unreachable else ""),
        "joint flips > {} deg: {}{}".format(FLIP_DEG, len(Sim.flips), " " + str(Sim.flips[:20]) if Sim.flips else ""),
        "singular (wrist A5 / elbow A3 / shoulder): {}{}".format(len(Sim.singular), " " + str(Sim.singular[:20]) if Sim.singular else ""),
        "near limit (< {} deg from +-360): {}".format(NEAR_LIMIT_DEG, len(Sim.near)),
        "A6 range: {:.1f} to {:.1f} deg".format(min(q[5] for q in joints if q), max(q[5] for q in joints if q)) if any(joints) else "",
    ])
    if hits:
        ghenv.Component.AddRuntimeMessage(Grasshopper.Kernel.GH_RuntimeMessageLevel.Error,
                                          "{} collision(s), first at index {} ({})".format(len(hits), first, hits[first]))
    if Sim.unreachable:
        ghenv.Component.AddRuntimeMessage(Grasshopper.Kernel.GH_RuntimeMessageLevel.Warning,
                                          "{} target(s) unreachable".format(len(Sim.unreachable)))
    if Sim.flips or Sim.singular:
        ghenv.Component.AddRuntimeMessage(Grasshopper.Kernel.GH_RuntimeMessageLevel.Warning,
                                          "{} flip(s), {} singular target(s)".format(len(Sim.flips), len(Sim.singular)))
    Joints = th.list_to_tree([q if q is not None else [] for q in joints])
    Reach = [q is not None for q in joints]
    Path = polyline(Sim.points).ToPolylineCurve() if len(Sim.points) > 1 else None
    Collide = [i in hits for i in range(len(targets))]
    Analysis = not hits and not Sim.unreachable and not Sim.flips and not Sim.singular
# ---------- end ur5_path_solver ----------
index = Slider(1963, range=0..2522)
timeline = BooleanToggle(True)
play = BooleanToggle(False)
ur5_robot_pose = Python3Script(Sim=ur5_path_solver.Sim, Index=index, ToolMesh=tool_mesh_edit, Play=play, Timeline=timeline)  # -> Robot, TCP, Axis, Status; inputs ToolMesh: list of Mesh, Play: Boolean, Timeline: Boolean
# ---------- ur5_robot_pose: Python ----------
#! python3
"""UR5 Robot Pose - shows the UR5 Path Solver result at one target.
Only this component runs when the Index slider moves.

Inputs
    Sim      : UR5 Path Solver > Sim
    Index    : target to display (connect a Number Slider)
    Play     : Boolean Toggle: True plays the path (moves the Index slider), False pauses
    Timeline : Boolean Toggle: False hides the timeline bar at the top of the viewport (not connected = shown)
    ToolMesh : Extruder Model > tool_mesh (in the flange frame)
Outputs
    Robot  : UR5 meshes posed at Index, coloured by joint status (extruder red on a collision)
    TCP    : TCP plane at Index
    Axis   : 6 joint values at Index (deg)
    Status : joint states at Index

Viewport timeline (top left): play / pause symbol, the line shows where Index is on the path.
Red ticks on the line = collisions, magenta = flips, yellow = singular.
This component draws the robot only (robot, extruder, table). The printed shape is drawn by the
extrusion preview component (connect the same Index slider to both).
"""
import Grasshopper
import Rhino
import Rhino.Geometry as rg
import scriptcontext as sc
import System
import System.Drawing as sd

# UR5 shape close to the real robot (mm). The arm tubes sit beside the DH axis lines like on the robot:
# upper arm SHOULDER_OFFSET along the shoulder axis, forearm FOREARM_OFFSET, wrist 1 at d4.
SHOULDER_OFFSET = 135.85
FOREARM_OFFSET = 16.15          # 135.85 - 119.70
D1, D4, D5, D6 = 89.159, 109.15, 94.65, 82.3
R_BASE, R_SHOULDER, R_ELBOW, R_WRIST = 45.0, 45.0, 38.0, 32.0
R_UPPER, R_FORE = 31.0, 26.0    # arm tubes
TOOL_R = 14

# colours of the real parts
ALU = sd.Color.FromArgb(200, 202, 206)        # aluminium arm tubes
JOINT = sd.Color.FromArgb(92, 92, 98)         # dark grey joint bodies
CAP = sd.Color.FromArgb(150, 196, 200)        # light blue-green joint caps
BED = sd.Color.FromArgb(178, 180, 182)        # aluminium table
PLATE_COL = sd.Color.FromArgb(150, 152, 156)  # adapter plate under the robot
# Tool Mesh order: ring, nozzle, plate, heater, extruder, motor, housing
TOOL_COLS = [sd.Color.FromArgb(25, 25, 25), sd.Color.FromArgb(200, 150, 60), sd.Color.FromArgb(205, 165, 55),
             sd.Color.FromArgb(190, 140, 60), sd.Color.FromArgb(30, 30, 32), sd.Color.FromArgb(40, 40, 42),
             sd.Color.FromArgb(28, 28, 30)]
METALLIC = (ALU, CAP, TOOL_COLS[1], TOOL_COLS[2], TOOL_COLS[3])

BLUE = sd.Color.FromArgb(90, 110, 255)
PLAY_SECONDS = 40.0       # the whole path plays in about this time
# one set of keys per component, so several UR5 Robot Pose components do not share their state
STATE_KEY = "ur5_timeline_" + str(ghenv.Component.InstanceGuid)
PATH_KEY = "ur5_print_cache_" + str(ghenv.Component.InstanceGuid)


def cylinder(origin, axis, r, h, centred=True):
    axis = rg.Vector3d(axis)
    if not axis.Unitize() or h <= 0:
        return None
    start = origin - axis * (h / 2.0) if centred else rg.Point3d(origin)
    c = rg.Cylinder(rg.Circle(rg.Plane(start, axis), r), h)
    return rg.Mesh.CreateFromCylinder(c, 1, 32)


def along(pl, a, b, r):
    """Cylinder on the z axis of plane pl, from a to b (mm along z)."""
    return cylinder(pl.Origin + pl.ZAxis * a, pl.ZAxis, r, b - a, centred=False)


def tube(a, b, r):
    v = b - a
    return cylinder(a, v, r, v.Length, centred=False) if r > 0 and v.Length > 1 else None


def material(c):
    m = Rhino.Display.DisplayMaterial(c)
    if c in METALLIC:
        m.Shine = 0.8
        m.Specular = sd.Color.White
    return m


def robot_parts(pl):
    """(mesh, colour key, joint) for the UR5 in pose pl (base, frame 1..6, TCP).
    colour key: 'alu', 'joint' or 'cap'; joint = index used for the status colour."""
    p = []
    base, f1, f2, f3, f4, f5, f6 = pl[:7]
    so, fo = SHOULDER_OFFSET, FOREARM_OFFSET
    # base: flange ring + joint 1 column up to the shoulder
    p.append((along(base, 0, 12, 75), "joint", 0))
    p.append((along(base, 12, D1 + 25, R_BASE), "joint", 0))
    p.append((along(base, D1 + 25, D1 + 33, R_BASE - 2), "cap", 0))
    # shoulder (joint 2): housing along the shoulder axis, cap outside
    p.append((along(f1, -R_SHOULDER, so + 30, R_SHOULDER), "joint", 1))
    p.append((along(f1, so + 30, so + 38, R_SHOULDER - 2), "cap", 1))
    # upper arm
    p.append((tube(f1.Origin + f1.ZAxis * so, f2.Origin + f2.ZAxis * so, R_UPPER), "alu", 1))
    # elbow (joint 3)
    p.append((along(f2, fo - 28, so + 28, R_ELBOW), "joint", 2))
    p.append((along(f2, so + 28, so + 35, R_ELBOW - 2), "cap", 2))
    # forearm
    p.append((tube(f2.Origin + f2.ZAxis * fo, f3.Origin + f3.ZAxis * fo, R_FORE), "alu", 2))
    # wrist 1 (joint 4) on the forearm end, up to the wrist 2 axis
    p.append((along(f3, fo - 26, D4 + R_WRIST, R_WRIST), "joint", 3))
    p.append((along(f3, fo - 33, fo - 26, R_WRIST - 2), "cap", 3))
    # wrist 2 (joint 5)
    p.append((along(f4, -R_WRIST, D5 - 5, R_WRIST), "joint", 4))
    p.append((along(f4, -R_WRIST - 7, -R_WRIST, R_WRIST - 2), "cap", 4))
    # wrist 3 (joint 6) up to the tool flange
    p.append((along(f5, -R_WRIST, D6 - 8, R_WRIST), "joint", 5))
    p.append((along(f5, -R_WRIST - 7, -R_WRIST, R_WRIST - 2), "cap", 5))
    p.append((along(f5, D6 - 8, D6, 31.5), "alu", 5))           # tool flange
    return p


def polyline(points):
    """rg.Polyline from a python list (the list constructor is not picked reliably)."""
    pl = rg.Polyline()
    for p in points:
        pl.Add(p)
    return pl


def print_cache(Sim):
    """Table height and size from the path, made once per Sim."""
    cache = sc.sticky.get(PATH_KEY)
    if cache and cache[0] is Sim:
        return cache[1]
    pts, on = Sim.points, Sim.extruding or [True] * len(Sim.points)
    lows = [pts[i].Z for i in range(len(pts)) if on[i]] or [p.Z for p in pts]
    bed_z = min(lows) - 1.0                     # nozzle prints about one layer above the table
    xs = [p.X for p in pts] + [0.0]
    ys = [p.Y for p in pts] + [0.0]
    table = rg.Box(rg.Plane.WorldXY, rg.Interval(min(xs) - 250, max(xs) + 250),
                   rg.Interval(min(ys) - 250, max(ys) + 250), rg.Interval(bed_z - 30, bed_z))
    data = {"bed_z": bed_z, "table": rg.Mesh.CreateFromBox(table, 1, 1, 1)}
    sc.sticky[PATH_KEY] = (Sim, data)
    return data


def as_int(value):
    """Slider values are System.Decimal: int() does not take them and Convert.ToDouble picks the
    SByte overload (overflow above 127), so go through the text."""
    return int(round(float(str(value).replace(",", "."))))


def as_decimal(value):
    return System.Decimal.Parse(str(int(value)))


def clock(seconds):
    s = int(round(seconds))
    return "{:d}:{:02d}".format(s // 60, s % 60)


# ---------- timeline (driven by the Index slider and the Play toggle, no mouse hooks) ----------
state = sc.sticky.setdefault(STATE_KEY, {"n": 1, "comp": None, "play": False})


def index_slider():
    comp = state.get("comp")
    if comp is None or comp.Params.Input.Count < 2:
        return None
    for s in comp.Params.Input[1].Sources:
        if isinstance(s, Grasshopper.Kernel.Special.GH_NumberSlider):
            return s
    return None


def _advance(doc):
    s = index_slider()
    if s is None or not state["play"]:
        return
    step = max(1, int(round(state["n"] / (PLAY_SECONDS * 25.0))))
    value = as_int(s.CurrentValue) + step
    if value >= state["n"] - 1:
        value, state["play"] = state["n"] - 1, False
    s.SetSliderValue(as_decimal(value))
    s.ExpireSolution(False)


def _fit_slider(doc):
    s = index_slider()
    if s is not None:
        s.Slider.Minimum = as_decimal(0)
        s.Slider.Maximum = as_decimal(max(state["n"] - 1, 1))
        s.Slider.DecimalPlaces = 0
        s.ExpireSolution(False)


class Script_Instance(Grasshopper.Kernel.GH_ScriptInstance):
    def __init__(self):
        self._draw, self._marks, self._hud = [], [], []
        self._bbox = rg.BoundingBox.Empty
        self._bar = None

    def RunScript(self,
            Sim,
            Index,
            ToolMesh: list[Rhino.Geometry.Mesh],
            Play: bool,
            Timeline: bool):
        self._show_bar = Timeline is not False      # not connected = shown
        try:
            return self._run(Sim, Index, ToolMesh, bool(Play))
        except Exception:
            import traceback
            ghenv.Component.AddRuntimeMessage(Grasshopper.Kernel.GH_RuntimeMessageLevel.Error, traceback.format_exc()[-600:])
            return None, None, None, None

    def _run(self, Sim, Index, ToolMesh, play):
        self._draw, self._marks, self._hud = [], [], []
        self._bbox = rg.BoundingBox.Empty
        self._bar = None
        if Sim is None:
            return None, None, None, None
        colors = Sim.colors
        state["comp"] = ghenv.Component
        state["n"] = len(Sim)
        doc = ghenv.Component.OnPingDocument()
        s = index_slider()
        if s is not None and as_int(s.Slider.Maximum) != len(Sim) - 1:
            doc.ScheduleSolution(1, Grasshopper.Kernel.GH_Document.GH_ScheduleDelegate(_fit_slider))
        state["play"] = play
        if play and s is not None and as_int(s.CurrentValue) < len(Sim) - 1:
            doc.ScheduleSolution(40, Grasshopper.Kernel.GH_Document.GH_ScheduleDelegate(_advance))

        idx, shown, q, status, reachable = Sim.pose(int(round(float(Index or 0))))
        collisions = getattr(Sim, "collisions", {})
        robot, tcp = [], None
        cache = print_cache(Sim)
        hit = collisions.get(idx)
        hit_part = None               # index in Tool Mesh of the part that hits
        if hit and "tool mesh" in str(hit):
            try:
                hit_part = int(str(hit).split("tool mesh")[1].split()[0])
            except ValueError:
                hit_part = None
        if q is not None:
            pl = Sim.link_planes(q)   # base, frame 1..6, TCP
            parts = []                # (mesh, colour)
            look = {"alu": ALU, "joint": JOINT, "cap": CAP}
            for m, key, j in robot_parts(pl):
                st = status[j] if reachable else "limit"
                # natural colours; a joint with a problem shows its status colour
                c = look[key] if st == "ok" or key == "alu" else colors[st]
                parts.append((m, c))
            if ToolMesh:
                to_flange = rg.Transform.PlaneToPlane(rg.Plane.WorldXY, pl[6])
                for k, tm in enumerate(ToolMesh):
                    if tm is None:
                        continue
                    dup = tm.DuplicateMesh()
                    dup.Transform(to_flange)
                    c = TOOL_COLS[k] if k < len(TOOL_COLS) else JOINT
                    if hit and (hit_part is None or hit_part == k):
                        c = colors["collision"]
                    parts.append((dup, c))
            else:
                parts.append((tube(pl[6].Origin, pl[7].Origin, TOOL_R), JOINT))
            # adapter plate between the table and the robot base
            parts.append((cylinder(rg.Point3d(0, 0, cache["bed_z"]), rg.Vector3d.ZAxis, 90,
                                   max(-cache["bed_z"], 1), False), PLATE_COL))
            for m, c in parts:
                if m is None:
                    continue
                m.VertexColors.CreateMonotoneMesh(c)
                robot.append(m)
                self._draw.append((m, c))
                self._bbox = rg.BoundingBox.Union(self._bbox, m.GetBoundingBox(False))
            tcp = pl[7]
        self._draw.insert(0, (cache["table"], BED))
        self._bbox = rg.BoundingBox.Union(self._bbox, cache["table"].GetBoundingBox(False))

        # the printed shape is not drawn here: use the extrusion preview component for it
        self._marks = Sim.marks + [(Sim.points[idx], sd.Color.Black)]
        self._bbox = rg.BoundingBox.Union(self._bbox, Sim.bbox)

        # ----- text -----
        on = Sim.extruding[idx] if idx < len(Sim.extruding) else None
        layers = getattr(Sim, "layers", [])
        layer = "   height {:.1f} mm".format(Sim.points[idx].Z - cache["bed_z"])
        if idx < len(layers) and layers[-1] + 1 < len(Sim) / 5:   # real layers (not one per point)
            layer = "   layer {} / {}".format(layers[idx] + 1, layers[-1] + 1) + layer
        # several pose components: each gets its own place on the screen (top one first)
        poses = sorted([o for o in doc.Objects if o.NickName == "UR5 Robot Pose" and hasattr(o, "Params")],
                       key=lambda o: (o.Attributes.Pivot.Y, o.Attributes.Pivot.X))
        self._rank = next((k for k, o in enumerate(poses) if o.InstanceGuid == ghenv.Component.InstanceGuid), 0)
        tag = "SIM {}  ".format(self._rank + 1) if len(poses) > 1 else ""
        self._hud.append((tag + "PATH SIM  " + Sim.name + layer + ("" if on is None else ("   extruder ON" if on else "   travel")),
                          sd.Color.FromArgb(0, 70, 200)))
        if idx in collisions:
            self._hud.append(("COLLISION: {}".format(collisions[idx]), colors["collision"]))
        if not reachable:
            self._hud.append(("UNREACHABLE  (showing index {})".format(shown), colors["limit"]))
        else:
            for j, (a, st) in enumerate(zip(q, status)):
                self._hud.append(("A{} {:9.2f}  {}".format(j + 1, a, "" if st == "ok" else st),
                                  sd.Color.Black if st == "ok" else colors[st]))
        bad = Sim.unreachable or Sim.flips or Sim.singular or collisions
        self._hud.append((Sim.summary(), colors["limit"] if bad else sd.Color.DimGray))

        # ----- timeline -----
        n = max(len(Sim) - 1, 1)
        marks = []
        for name, items in (("singular", Sim.singular), ("flip", Sim.flips), ("limit", Sim.unreachable),
                            ("collision", sorted(collisions))):
            marks += [(i / float(n), colors[name]) for i in items]
        times = getattr(Sim, "times", None)
        sub = "/ {}".format(n)
        if times:
            sub += "   ({} / {})".format(clock(times[idx]), clock(times[-1]))
        self._bar = (idx / float(n), idx, sub, marks, idx in collisions)

        worst = "limit" if not reachable else max(status, key=Sim.severity.index)
        if idx in collisions:
            worst = "collision"
        if worst != "ok":
            ghenv.Component.AddRuntimeMessage(Grasshopper.Kernel.GH_RuntimeMessageLevel.Remark,
                                              "index {}: {}".format(idx, worst))
        return robot, tcp, (q if reachable else []), ["A{} {}".format(j + 1, st) for j, st in enumerate(status)]

    # ---------- preview ----------
    def get_ClippingBox(self):
        return self._bbox

    def DrawViewportMeshes(self, args):
        for m, c in self._draw:
            args.Display.DrawMeshShaded(m, material(c))

    def DrawViewportWires(self, args):
        d = args.Display
        for p, c in self._marks:
            d.DrawPoint(p, Rhino.Display.PointStyle.RoundSimple, 3, c)
        if self._bar and getattr(self, "_show_bar", True):
            self._draw_timeline(args)
        rank = getattr(self, "_rank", 0)
        y = 100 + 70 * rank
        for text, c in self._hud:
            d.Draw2dText(text, c, rg.Point2d(20 + 470 * rank, y), False, 15, "Consolas")
            y += 20

    def _draw_timeline(self, args):
        d = args.Display
        fraction, idx, sub, marks, hit = self._bar
        width = args.Viewport.Bounds.Width
        bx, by, bs = 20, 30 + 70 * getattr(self, "_rank", 0), 30   # play button
        x0, x1, y = bx + bs + 14, max(bx + bs + 200, width - 170), by + bs // 2

        # play / pause button
        d.Draw2dRectangle(sd.Rectangle(bx, by, bs, bs), BLUE, 2, sd.Color.FromArgb(40, 90, 110, 255))
        if state["play"]:
            for xx in (bx + 10, bx + 18):
                d.Draw2dLine(sd.PointF(xx, by + 8), sd.PointF(xx, by + bs - 8), BLUE, 4)
        else:
            for k in range(0, 13):                         # filled triangle from vertical lines
                h = 14 - k * 14.0 / 13
                d.Draw2dLine(sd.PointF(bx + 10 + k, y - h / 2), sd.PointF(bx + 10 + k, y + h / 2), BLUE, 1.5)
        # track, done part, problem ticks
        d.Draw2dLine(sd.PointF(x0, y), sd.PointF(x1, y), sd.Color.FromArgb(150, 90, 110, 255), 2)
        xi = x0 + (x1 - x0) * fraction
        d.Draw2dLine(sd.PointF(x0, y), sd.PointF(xi, y), BLUE, 4)
        for f, c in marks:
            xm = x0 + (x1 - x0) * f
            d.Draw2dLine(sd.PointF(xm, y + 5), sd.PointF(xm, y + 12), c, 1)
        # handle
        handle = sd.Color.FromArgb(255, 0, 0) if hit else BLUE
        d.Draw2dRectangle(sd.Rectangle(int(xi) - 5, y - 11, 10, 22), handle, 1, handle)
        # index and time
        d.Draw2dText(str(idx), handle, rg.Point2d(x1 + 14, by - 4), False, 26, "Arial")
        d.Draw2dText(sub, BLUE, rg.Point2d(x1 + 14, by + 24), False, 12, "Arial")
# ---------- end ur5_robot_pose ----------

# ---- group: ⑨ robot speed：geometry 接 COMPAS 或 Rhino data（每層 polyline 或一整條）→ robot_speed → printpath.robot_speed（厚的慢、薄的快）
robot_speed = Python3Script(geometry=flatten(data_4), min_speed=min_speed_mm_s_thick, max_speed=max_speed_mm_s_thin, first_layer=layer_height_mm_5)  # -> robot_speed, thickness, info; inputs geometry: list, min_speed: Double, max_speed: Double, first_layer: Double
# ---------- robot_speed: Python ----------
#! python3
"""Robot speed from layer thickness: thick bead -> slow, thin bead -> fast.

Inputs
    geometry     : the print path as COMPAS data (Polyline / list of Points) or Rhino data
                   (Polyline curves, Polylines, Points, Planes). One curve per layer, or one joined curve.
                   The order of the points must be the print order (same as the printpoints).
    min_speed    : speed of the thickest bead (mm/s)
    max_speed    : speed of the thinnest bead (mm/s)
    first_layer  : thickness of the first layer, above the bed (mm)
Outputs
    robot_speed  : one speed per point (mm/s) -> printpath.robot_speed
    thickness    : layer thickness at every point (mm)
    info         : point count, thickness range, speed range

Layer thickness of a point = shortest distance to the path printed before it, leaving out the
part of the path just behind the point (EXCLUDE mm along the path), so the bead it lies on is
found and not the bead it is printing. Points of the first layer: height above the bed.
"""
import math

import Rhino.Geometry as rg
import rhinoscriptsyntax as rs
import System

EXCLUDE = 15.0   # mm along the path behind the point that is still the same bead
CELL = 5.0       # grid size for the search (mm)
MIN_T = 0.2      # closer than this = the same point printed twice (e.g. a closed layer), not a bead below


def to_xyz(p):
    if hasattr(p, "X"):
        return (float(p.X), float(p.Y), float(p.Z))
    if hasattr(p, "x"):
        return (float(p.x), float(p.y), float(p.z))
    return (float(p[0]), float(p[1]), float(p[2]))


def points_of(item):
    """Points of one geometry item, COMPAS or Rhino."""
    if item is None:
        return []
    if isinstance(item, System.Guid):              # Rhino data without a type hint arrives as an id
        item = rs.coercegeometry(item)
        if item is None:
            return []
    if hasattr(item, "points") and not isinstance(item, rg.GeometryBase):     # COMPAS Polyline
        return [to_xyz(p) for p in item.points]
    if isinstance(item, rg.Curve):
        ok, pl = item.TryGetPolyline()
        if ok:
            return [to_xyz(p) for p in pl]
        ts = item.DivideByLength(1.0, True)
        return [to_xyz(item.PointAt(t)) for t in ts] if ts else []
    if isinstance(item, rg.Plane):                 # print planes: the origin is the point
        return [to_xyz(item.Origin)]
    if isinstance(item, rg.Polyline):
        return [to_xyz(p) for p in item]
    if isinstance(item, (rg.Point3d, rg.Point)) or hasattr(item, "x") or hasattr(item, "X"):
        return [to_xyz(item.Location if isinstance(item, rg.Point) else item)]
    return []


def seg_dist(p, a, b):
    ab = [b[i] - a[i] for i in range(3)]
    ap = [p[i] - a[i] for i in range(3)]
    L2 = sum(v * v for v in ab)
    t = 0.0 if L2 == 0 else max(0.0, min(1.0, sum(ab[i] * ap[i] for i in range(3)) / L2))
    return math.sqrt(sum((ap[i] - ab[i] * t) ** 2 for i in range(3)))


def cell(p):
    return (int(math.floor(p[0] / CELL)), int(math.floor(p[1] / CELL)), int(math.floor(p[2] / CELL)))


pts = []
for g in (geometry or []):
    pts += points_of(g)

robot_speed, thickness = [], []
info = "no geometry (got: {})".format(sorted({type(g).__name__ for g in (geometry or [])}))
if pts:
    lo_v = float(min_speed) if min_speed is not None else 8.0
    hi_v = float(max_speed) if max_speed is not None else 12.0
    first = float(first_layer) if first_layer is not None else 1.5
    z_bed = min(p[2] for p in pts) - first
    # arc length along the path
    s = [0.0]
    for k in range(1, len(pts)):
        s.append(s[-1] + math.dist(pts[k - 1], pts[k]))
    grid = {}                     # cell -> segment indices (segment k = pts[k-1] -> pts[k])
    for k in range(len(pts)):
        p = pts[k]
        best = p[2] - z_bed       # first layer: height above the bed
        cx, cy, cz = cell(p)
        for dx in range(-1, 2):
            for dy in range(-1, 2):
                for dz in range(-1, 1):          # the bead below is at the same height or lower
                    for j in grid.get((cx + dx, cy + dy, cz + dz), ()):
                        if s[k] - s[j] < EXCLUDE:
                            continue
                        d = seg_dist(p, pts[j - 1], pts[j])
                        if MIN_T <= d < best:
                            best = d
        thickness.append(best)
        if k >= 1:                # add segment k to every cell it passes
            a, b = pts[k - 1], pts[k]
            n = max(1, int(math.dist(a, b) / CELL) + 1)
            for c in {cell(tuple(a[i] + (b[i] - a[i]) * t / n for i in range(3))) for t in range(n + 1)}:
                grid.setdefault(c, []).append(k)
    t_lo, t_hi = min(thickness), max(thickness)
    for t in thickness:
        f = 0.0 if t_hi - t_lo < 1e-9 else (t - t_lo) / (t_hi - t_lo)
        robot_speed.append(hi_v + (lo_v - hi_v) * f)       # thick -> slow
    info = ("{} points\nthickness {:.2f} - {:.2f} mm\nspeed {:.1f} - {:.1f} mm/s (thick -> slow)").format(
        len(pts), t_lo, t_hi, min(robot_speed), max(robot_speed))
# ---------- end robot_speed ----------
robot_speed_info = Panel(robot_speed.info)

# ---- group: 7 EXTRUSION PREVIEW - bead width from speed (red = thinner than layer, may not bond)
line_width_do2_index_2_1_mm_s_mm = Slider(1, range=0..5)
line_width_do3_index_3_7_mm_s_mm = Slider(5, range=0..5)
check_width_colours = BooleanToggle(False)
extrusion_preview = Python3Script(
    printpath=place_on_bed.printpath_on_bed,
    width_speed0=line_width_do2_index_2_1_mm_s_mm,
    layer_height=number_slider_2,
    index=index,
    check_width=check_width_colours,
    width_speed1=line_width_do3_index_3_7_mm_s_mm)  # -> beads, width_check, width, info; inputs width_speed0: Double, layer_height: Double, index: Double, check_width: Boolean, width_speed1: Double
# ---------- extrusion_preview: Python ----------
#! python3
"""Extrusion preview: bead width from the robot speed (the extruder pushes a constant flow).

Inputs
    printpath    : PrintPath (on the bed), the same one the robot simulation uses
    width_speed0 : line width of the beads with extruder_index 2 (DO2 -> aspeed 1 = 1 mm/s on this robot), mm
    width_speed1 : line width of the beads with extruder_index 3 (DO3 -> aspeed 0 = 7 mm/s on this robot), mm
    layer_height : layer height of the design (mm) = bead height
    index        : show the beads up to this printpoint (connect the Index slider of the robot sim)
    check_width  : True = also output width_check (beads coloured by width)
Outputs
    beads        : beads with an elliptic section (width x layer height) -> Custom Preview with the clear material
    width_check  : the same beads coloured by width (only when check_width is True)
                   red = thinnest, yellow = in between, green = thickest
    width        : bead width of every printed segment (mm)
    info         : width and speed range, share of the path printed thin

Line width: each segment takes the width of the extruder speed of the point it moves to
(extruder_index 2 -> width_speed0, 3 -> width_speed1, 1 = extruder off -> no bead). Set the widths to what you
see in the real print (measure a printed bead).
Section: ellipse, width across the path, layer height tall, top at the nozzle tip.
"""
import math

import Rhino.Geometry as rg
import scriptcontext as sc
import System
import System.Linq
import System.Drawing as sd

SIDES = 6                    # points on the ellipse (6 looks round enough and is lighter to draw)

w0 = float(width_speed0) if width_speed0 is not None else 1.0
w1 = float(width_speed1) if width_speed1 is not None else 0.5   # 0 = no material
LIMITS = [None, None]                     # thinnest and thickest width of the path, for the colours
h = float(layer_height) if layer_height else 1.3


def colour(w):
    """red (thinnest) -> yellow -> green (thickest)."""
    lo, hi = LIMITS
    t = 1.0 if lo is None or hi <= lo else max(0.0, min(1.0, (w - lo) / (hi - lo)))
    if t < 0.5:
        return sd.Color.FromArgb(220, int(40 + 360 * t), 40)
    return sd.Color.FromArgb(int(220 - 380 * (t - 0.5)), 220, 50)


def width_of(p, v_slow=None):
    """extruder_index 2 = DO2, 3 = DO3, 1 = off (no bead)."""
    i = int(getattr(p, "extruder_index", 2))
    return w0 if i == 2 else (w1 if i == 3 else 0.0)


def speed_of(p):
    s = p.speed
    return float(max(s)) if isinstance(s, (list, tuple)) else float(s)


def pt(p):
    return rg.Point3d(*[float(c) for c in p.frame.point])


def across(t):
    t = rg.Vector3d(t)
    t.Z = 0
    if not t.Unitize():
        return None
    return rg.Vector3d.CrossProduct(t, rg.Vector3d.ZAxis)


def add_run(mesh, cmesh, P, W, coloured):
    """Tube with an elliptic section through points P; W[i] = width at point i."""
    rings = []
    for i, p in enumerate(P):
        a = P[max(i - 1, 0)]; b = P[min(i + 1, len(P) - 1)]
        n = across(b - a)
        if n is None:
            n = rings[-1][1] if rings else rg.Vector3d.XAxis
        rings.append((p, n))
    base = mesh.Vertices.Count
    for i, (p, n) in enumerate(rings):
        c = p + rg.Vector3d(0, 0, -h / 2.0)
        for k in range(SIDES):
            ang = 2 * math.pi * k / SIDES
            q = c + n * (math.cos(ang) * W[i] / 2.0) + rg.Vector3d(0, 0, math.sin(ang) * h / 2.0)
            mesh.Vertices.Add(q)
            if coloured:
                cmesh.Vertices.Add(q)
                cmesh.VertexColors.Add(colour(W[i]))
    for i in range(len(rings) - 1):
        for k in range(SIDES):
            k2 = (k + 1) % SIDES
            f = (base + i * SIDES + k, base + i * SIDES + k2, base + (i + 1) * SIDES + k2, base + (i + 1) * SIDES + k)
            mesh.Faces.AddFace(*f)
            if coloured:
                cmesh.Faces.AddFace(*f)


beads, width_check, width, info = None, None, [], "no printpath"
CACHE_KEY = "extrusion_preview_" + str(ghenv.Component.InstanceGuid)


def build_full(pts, coloured):
    """Whole path once: mesh, coloured mesh, face count reached at every printpoint, widths, thin share, speeds."""
    mesh, cmesh = rg.Mesh(), rg.Mesh()
    faces_at = [0] * len(pts)          # faces in the mesh once printpoint k is reached
    widths = []
    thin = total = 0.0
    run_P, run_W, run_K = [], [], []
    printed = [k for k in range(1, len(pts)) if pts[k - 1].is_extruder_on and pts[k].is_extruder_on]
    v_slow = min(speed_of(pts[k]) for k in printed) if printed else 1.0
    v_fast = max(speed_of(pts[k]) for k in printed) if printed else 1.0
    ws = [w for w in (width_of(pts[k], v_slow) for k in printed) if w > 0]
    LIMITS[0], LIMITS[1] = (min(ws), max(ws)) if ws else (None, None)

    def flush():
        if len(run_P) > 1:
            start = mesh.Faces.Count
            add_run(mesh, cmesh, run_P, run_W, coloured)
            for i, k in enumerate(run_K):
                faces_at[k] = start + i * SIDES
        del run_P[:]; del run_W[:]; del run_K[:]

    for k in range(1, len(pts)):
        faces_at[k] = mesh.Faces.Count
        p0, p1 = pts[k - 1], pts[k]
        if not (p0.is_extruder_on and p1.is_extruder_on):
            flush()
            faces_at[k] = mesh.Faces.Count
            continue
        v = speed_of(p1)
        w = width_of(p1, v_slow)
        if w <= 0:                     # extruder off on this segment: no bead
            flush()
            faces_at[k] = mesh.Faces.Count
            continue
        widths.append(w)
        a, b = pt(p0), pt(p1)
        L = a.DistanceTo(b)
        total += L
        if int(getattr(p1, "extruder_index", 2)) == 3:
            thin += L
        if not run_P:
            run_P.append(a); run_W.append(w); run_K.append(k - 1)
        run_P.append(b); run_W.append(w); run_K.append(k)
    flush()
    running = 0                         # make faces_at never decrease (points after a run keep its count)
    for k in range(len(faces_at)):
        running = max(running, faces_at[k]); faces_at[k] = running
    mesh.Normals.ComputeNormals()
    if coloured:
        cmesh.Normals.ComputeNormals()
    return mesh, (cmesh if coloured else None), faces_at, widths, (thin / total if total else 0.0), (v_slow, v_fast)


def cut(full, n_faces):
    """Copy of the mesh with only its first n_faces faces (all done in RhinoCommon, fast)."""
    if full is None or n_faces <= 0:
        return None
    if n_faces >= full.Faces.Count:
        return full
    m = full.DuplicateMesh()
    m.Faces.DeleteFaces(System.Linq.Enumerable.Range(n_faces, full.Faces.Count - n_faces))
    m.Compact()
    return m


if printpath is not None and hasattr(printpath, "printpoints"):
    pts = printpath.printpoints
    last = len(pts) - 1 if index is None else max(0, min(int(round(float(str(index)))), len(pts) - 1))
    coloured = bool(check_width)
    key = (id(printpath), len(pts), w0, w1, h, coloured)
    cache = sc.sticky.get(CACHE_KEY)
    if not cache or cache[0] != key:   # rebuild only when the path or the settings change, not for the Index
        cache = (key, build_full(pts, coloured))
        sc.sticky[CACHE_KEY] = cache
    mesh, cmesh, faces_at, width, thin_share, (v_slow, v_fast) = cache[1]
    n = faces_at[last] if last < len(faces_at) else mesh.Faces.Count
    beads = cut(mesh, n)
    width_check = cut(cmesh, n) if coloured else None
    if width:
        info = ("{} printed segments, showing up to index {}\n"
                "line width: DO2 (index 2) = {:.2f} mm, DO3 (index 3) = {:.2f} mm, layer {:.2f} mm\n"
                "robot speed {:.0f} - {:.0f} mm/s\n"
                "printed with DO3 (index 3): {:.0f}% of the path length").format(
            len(width), last, w0, w1, h, v_slow, v_fast, 100.0 * thin_share)
# ---------- end extrusion_preview ----------
bead_preview_clear_petg = CustomPreview(Geometry=extrusion_preview.beads, Material=ColourSwatch(SwatchColor=RGB(140, 203, 255)))

# ----
panel_12 = Panel(ur5_path_solver.Info)

# ---- group: FILL BOTTOM
line_width_mm = Slider(2.5, range=0.5..10)
fill_point_spacing_mm = Slider(4, range=1..10)
skip_start = Slider(1, range=0..5)
fill_bottom = Python3Script(layers=python_3_script_3.cg, line_width=line_width_mm, point_spacing=fill_point_spacing_mm, skip_start=skip_start)  # -> layers_filled, summary; inputs layers: list
# ---------- fill_bottom: Python ----------
# r: compas
# venv: mas-2627
"""
Fill the bottom: a spiral from the center outward, printed before the first wall.
The spiral ends at the angle where the wall starts, so the path stays one continuous line
(extruder stays on, no travel move).
layers: the compas polylines that go into printpath (here one long polyline).
line_width: distance between two spiral turns, and between the spiral and the inner side of the wall, mm.
point_spacing: distance between two spiral points, mm.
skip_start: points at the start of the path that are not wall (the lead-in point from Insert Items).
They are dropped, because the spiral now leads into the wall.
"""
import math

from compas.geometry import Point
from compas.geometry import Polyline

# ===== First layer of the wall =====
first = layers[0]
points = list(first.points)[int(skip_start):]
wall_start = points[0]
z = wall_start.z
first_layer = [p for p in points if abs(p.z - z) < 1e-3]

# center and inner radius of the first layer
cx = sum(p.x for p in first_layer) / len(first_layer)
cy = sum(p.y for p in first_layer) / len(first_layer)
inner_radius = min(math.hypot(p.x - cx, p.y - cy) for p in first_layer)
start_angle = math.atan2(wall_start.y - cy, wall_start.x - cx)

# ===== Spiral, center -> outside, whole turns so it ends at start_angle =====
end_radius = inner_radius - line_width
turns = max(1, round(end_radius / line_width))
end_theta = 2 * math.pi * turns
pitch = end_radius / end_theta      # radius grows by line_width-ish per turn

spiral = []
theta = 0.0
while theta < end_theta:
    r = pitch * theta
    spiral.append(Point(cx + r * math.cos(start_angle + theta), cy + r * math.sin(start_angle + theta), z))
    theta += min(point_spacing / max(r, 1e-6), math.pi / 4)   # even spacing, max 45 deg near the center
spiral.append(Point(cx + end_radius * math.cos(start_angle), cy + end_radius * math.sin(start_angle), z))

# ===== New path: spiral, then the wall as before =====
layers_filled = [Polyline(spiral + points)] + list(layers)[1:]

summary = (f"center {cx:.1f}, {cy:.1f}, z {z:.2f}\n"
           f"inner wall radius {inner_radius:.1f} mm, spiral to {end_radius:.1f} mm\n"
           f"{turns} turns, {len(spiral)} points, {int(skip_start)} start point(s) dropped")
# ---------- end fill_bottom ----------
compas_draw = COMPASDraw(cg=fill_bottom.layers_filled)  # -> rg; same code as draw
panel_13 = Panel(fill_bottom.summary)

# ---- group: PRINTPATH
# generate printpath: printpoints and path
speed_mm_s_2 = Slider(10, range=1..50)
printpath_4 = Printpath(
    layers=python_3_script_3.cg,
    speed=speed_mm_s_2,
    blend_radius="1.0",
    safety_distance="100.0",
    planes=rotate_tcp,
    robot_speed=flatten(robot_speed.robot_speed))  # -> printpath, summary; inputs layers: list, planes: tree, robot_speed: list
# ---------- printpath_4: Python ----------
#! python3
# r: compas
# venv: mas-2627
"""
Turn the layers into printpoints and a PrintPath, in work object coordinates.
Safety points are added here, before any transform to the robot base.
planes (optional, tree: one branch per layer): if connected, every printpoint uses that plane as its frame
(tilted nonplanar printing). If not connected, the layers are used with a vertical nozzle, as before.
speed: one speed for every printpoint (mm/s).
robot_speed (optional list): one speed per printpoint (from the robot speed component); if connected it replaces speed.
"""
import os
import sys

from compas.geometry import Frame, Vector
from compas_rhino.conversions import plane_to_compas_frame


# Find source folder
gh_dir = os.path.dirname(ghenv.Component.OnPingDocument().FilePath)
src_dir = os.path.join(gh_dir, "..", "..", "src")
if src_dir not in sys.path:
    sys.path.append(src_dir)
from print_class import PrintPoint, PrintPath

# ===== Speed: one per printpoint, or one for all =====
per_point = [float(v) for v in (robot_speed or []) if v is not None]
speeds = per_point or [float(speed) if speed is not None else 10.0]


def speed_at(k):
    return speeds[k] if len(speeds) > 1 and k < len(speeds) else speeds[0]


# ===== One printpoint per point =====
printpoints = []
if planes is not None and planes.DataCount > 0:
    # tilted frames: one branch per layer, the plane z axis is the nozzle direction
    layer_count = planes.BranchCount
    for layer_index, branch in enumerate(planes.Branches):
        for plane in branch:
            printpoints.append(PrintPoint(plane_to_compas_frame(plane), layer_index, speed_at(len(printpoints)), blend_radius, True))
    source = "planes (tilted)"
else:
    # world XY orientation for every point: a tangent frame would turn the wrist 360 degrees each layer
    layer_count = len(layers)
    for layer_index, layer in enumerate(layers):
        for point in layer.points:
            frame = Frame(point, -Vector.Xaxis(), Vector.Yaxis())
            printpoints.append(PrintPoint(frame, layer_index, speed_at(len(printpoints)), blend_radius, True))
    source = "layers (vertical nozzle)"

# ===== Path with a travel point above the start and the end =====
printpath = PrintPath(printpoints)
travel = max(speeds)   # safety moves at the fastest print speed
printpath.add_safety_before(safety_distance, travel)
printpath.add_safety_after(safety_distance, travel)

summary = f"{len(printpoints)} printpoints in {layer_count} layers, plus 2 safety points\nfrom {source}"
# ---------- end printpath_4 ----------
panel_14 = Panel(printpath_4.summary)

# ----
data_5 = Data(printpath_4.printpath)
panel_15 = Panel(data_5)
py3 = Python3Script()  # -> out, layers, mesh
# ---------- py3: Python ----------
import Rhino.Geometry as rg
import numpy as np
import math as m

class Column:
    def __init__(self, axis: rg.Curve, radius_base: float, radius_top: float):
        self.axis = axis
        # reparameterize axis
        self.axis.Domain = rg.Interval(0,1)
        self.r_base = radius_base
        self.r_top = radius_top
        self.height = axis.PointAtEnd.Z - axis.PointAtStart.Z
        self.radius_bezier = self.gen_radius_bezier()

    def gen_radius_bezier(self) -> rg.BezierCurve:
        pts = [
            rg.Point2d(0, 0),
            rg.Point2d(0.6, 3),
            rg.Point2d(0.9, 5),
            rg.Point2d(1.0, 0.5)
        ]
        return rg.BezierCurve(pts)

    def get_radius(self, tz) -> float:
        # power
        # tz = m.pow(tz, 3)
        # return self.r_base*(1-tz) + self.r_top*(tz)

        # beizer curve
        bezier = self.radius_bezier.PointAt(tz)
        amp = 10
        return self.r_base*(1-tz) + self.r_top*(tz) + bezier.Y*amp

    def get_pattern(self, angle, tz) -> float:
        a = angle
        freq = 4
        amp = 5

        # shift angle
        shift = m.pow(tz, 2.5)
        shift *= m.pi
        
        # fade out amp
        fade = m.pow(tz,1)
        # amp *= fade
        # pattern = m.cos((a+shift)*freq)*amp

        # blend multiple freq
        freqs = [3, 8, 4]
        set_freqs = [m.cos((a+shift)*f)*(amp+3*(1-tz)) for f in freqs]
        t_sets = [t for t in np.linspace(0,1,len(freqs))]
        pattern = np.interp(tz, t_sets, set_freqs)
        
        # add reverse pattern
        set_freqs = [m.cos((a-shift)*f)*(amp+3*tz) for f in freqs]
        r_pattern = np.interp(tz, t_sets, set_freqs)

        # try different blend
        pattern = (pattern + r_pattern)*.5
        pattern = max(pattern, r_pattern)
        # pattern = min(pattern, r_pattern)
        # pattern = pattern*(1-tz) + r_pattern*tz

        return pattern

    def get_point(self, angle, tz) -> rg.Point3d:
        """
        Get point on the column at certain angle and height

        Args:
        angle: angle of the point in radians
        tz: normalize parameter of the height along the axis

        Returns:
        The list of polylinecurve for each layer
        """
        radius = self.get_radius(tz)
        radius += self.get_pattern(angle, tz)
        origin = self.axis.PointAt(tz)
        vector = rg.Vector3d(
            radius*m.cos(angle),
            radius*m.sin(angle),
            0
        )
        return origin+vector

    def print_paths(self, resolution: int, layer_height: float) -> list[int, list[rg.PolylineCurve]]:
        """
        Generate print path of the columns

        Args:
        resolution: division around the circumference
        layer_height: distance between vertical layers in mm.

        Returns:
        The list of polylinecurve for each layer
        """

        lh = int(self.height // layer_height)
        layers = []

        for tz in np.linspace(0, 1, lh+1, endpoint=True)[1:]:
            pts = []
            for angle in np.linspace(0, 2*np.pi, resolution+1, endpoint=True)[:-1]:
                pts.append(self.get_point(angle, tz))
            
            layers.append(
                rg.PolylineCurve(pts)
            )
        return lh, layers
    
    @ staticmethod
    def to_mesh(crvs: list[rg.PolylineCurve], closed: bool = True) -> rg.Mesh:
        mesh = rg.Mesh()
        for layer in crvs:
            for pt in layer.ToArray():
                mesh.Vertices.Add(pt)
        
        idx = np.array(range(mesh.Vertices.Count))
        idx = idx.reshape(len(crvs), layer.PointCount)

        if closed:
            faces = np.stack([
                idx[:-1],                             # Top-left
                np.roll(idx[:-1], -1, axis=1),        # Top-right
                idx[1:],                              # Bottom-left
                np.roll(idx[1:], -1, axis=1)          # Bottom-right
            ], axis=-1).reshape(-1, 4)
        else:
            faces = np.lib.stride_tricks.sliding_window_view(
                idx, window_shape=(2, 2)
            ).reshape(-1, 4)
        
        for f in faces:
            mesh.Faces.AddFace(
                int(f[0]),
                int(f[1]),
                int(f[3]),
                int(f[2])
            )

        mesh.Compact()
        mesh.RebuildNormals()
        return mesh

            


if __name__ == "__main__":
    axis = rg.LineCurve(
        rg.Point3d(0,0,0),
        rg.Point3d(10,10,300)
    )
    r1 = 10
    r2 = 10

    column = Column(axis, r1, r2)
    layer_count, layers = column.print_paths(150, 2)
    mesh = Column.to_mesh(layers, closed=True)
# ---------- end py3 ----------
python_3_script_4 = Python3Script()  # -> out, layers
# ---------- python_3_script_4: Python ----------
import Rhino.Geometry as rg
import numpy as np
import math as m

class Column:
    def __init__(self, axis: rg.Curve, radius_base: float, radius_top: float):
        self.axis = axis
        # reparameterize axis
        self.axis.Domain = rg.Interval(0,1)
        self.radius_base = radius_base
        self.radius_top = radius_top
        self.height = axis.PointAtEnd.Z - axis.PointAtStart.Z

    def get_point(self, angle: float, tz: float) -> rg.Point3d:
        """
        Args:
            angle: angle in polar coord. in radians
            tz: parameter on axis
        """
        origin = self.axis.PointAt(tz)
        radius = self.get_radius_bezier(tz)

        pt = rg.Point3d(
            origin.X + m.cos(angle)*radius,
            origin.Y + m.sin(angle)*radius,
            origin.Z
        )

        return pt


    def get_radius(self, angle: float, tz: float) -> float:
        radius =  self.radius_base*(1-tz) + self.radius_top*tz
        return radius

    def get_radius_bezier(self, tz: float) ->float:
        bezier = rg.BezierCurve(
            [
                rg.Point2d(0, 0),
                rg.Point2d(0.25, 5),
                rg.Point2d(0.75, 3),
                rg.Point2d(1, 0)
            ]
        )

        radius = self.radius_base*(1-tz) + self.radius_top*tz
        radius += bezier.PointAt(tz).Y*5
        return radius

    def get_radius_wave(self, angle: float, tz: float, freq: int, amp: float) -> float:
        # #roatate
        # shift = tz*m.radians(60)
        # angle += shift

        # #fade
        # amp = m.pow(tz, 2)*amp

        
        # # radius = self.get_radius(angle, tz) + m.cos(angle*freq)*amp
        # # return radius

        # #blend wave freq
        # freq1 = 3
        # freq2 = 5

        # _r1 = m.cos(angle*freq1)*amp
        # _r2 = m.cos(angle*freq2)*amp

        # radius = self.get_radius(angle, tz) + _r1*(1-tz) + _r2*(tz)
        # return radius

        # rotate in both direction
        shift = tz*m.radians(100)

        _r1 = self.get_radius(angle, tz) + m.cos((angle+shift)*freq)*amp
        _r2 = self.get_radius(angle, tz) + m.cos((angle-shift)*freq)*amp

        # radius = _r1*(1-tz) + _r2*tz
        # radius = (_r1 + _r2)/2
        # radius = max(_r1, _r2) #둘중에 큰거 써라
        radius = min(_r1, _r2)

        return radius




    def get_layers(self, layer_height: float, res_u: int):

        layers_count = int(self.height // layer_height) + 1
        layers = []

        for tz in np.linspace(0, 1, layers_count)[1::]:
            layer = []

            for angle in np.linspace(0, m.tau, res_u )[::-1]:
                pt = self.get_point(angle, tz)
                layer.append(pt)

            layers.append(layer)

        return layers

    @staticmethod
    def get_mesh(layers:list[list[rg.Point3d]], closed: bool) -> rg.Mesh:
        mesh  = rg.Mesh()

        for layer in layers:
            for pt in layer:
                mesh.Vertices.Add(pt)

        idx = np.array(range(mesh.Vertices.Count))
        idx = idx.reshape(len(layers), len(layers[0]))

        if closed:
            print(np.roll(idx[:-1], -1, axis=1))
            faces = np.stack([
                idx[:-1],                             # Top-left
                np.roll(idx[:-1], -1, axis=1),        # Top-right
                idx[1:],                              # Bottom-left
                np.roll(idx[1:], -1, axis=1)          # Bottom-right
            ], axis=-1).reshape(-1, 4)
        else:
            faces = np.lib.stride_tricks.sliding_window_view(
                idx, window_shape=(2, 2)
            ).reshape(-1, 4)

            print(faces)

        for face in faces:
            print (face, [int(f)for f in face], *[int(f)for f in face])
            mesh.Faces.AddFace(
                *[int(f)for f in face]
            )

        mesh.Compact()
        mesh.RebuildNormals()

        return mesh
       


if __name__ == "__main__":
    
    axis = rg.LineCurve(
        rg.Point3d(0,0,0),
        rg.Point3d(0,0,70)
    )
    
    mycolumn = Column(axis, 15, 15)
    layers = mycolumn.get_layers(3,100)

    mesh = Column.get_mesh(layers, closed=True)


    import ghpythonlib.treehelpers as tree
    layers = tree.list_to_tree(layers)
# ---------- end python_3_script_4 ----------
mesh_overhang = MeshOverhang(Mesh=py3.mesh, Interval=Domain(0, 1.5), paletteI=0, useSmooth=True, useVertex=True)  # -> Mesh, OverhangDistribution
preview = CustomPreview(
    Geometry=py3.mesh,
    Material={diffuse=RGB(221, 160, 221), emission=RGB(66, 48, 66), shine=0.5, specular=RGB(255, 255, 255), transparency=0})
face_boundaries = FaceBoundaries(Mesh=py3.mesh)
curve = Curve(py3.layers)
polyline_2 = PolyLine(Vertices=python_3_script_4.layers, Closed=False)  # -> flatten(Polyline)

# ---- group: printbed_position
printbed_position_2 = _4PointSurface(
    CornerA="535.57,-65.74,-9.79",
    CornerB="535.54,528.09,-10.52",
    CornerC="136.49,527.66,-10.90",
    CornerD="136.49,-67.26,-9.86")

# ---- group: object_position_on_printbed
pt_2 = ConstructPoint(XCoordinate=Slider(0.5, range=0..1), YCoordinate=Slider(0.5, range=0..1), ZCoordinate=0)

# ---- group: first_layer_lift
number_slider_6 = Slider(1.5, range=0..10)

# ----
loft = Loft(
    Curves=flatten(polyline_2),
    Options={Adjust=False, Closed=False, LoftEnds=0, LoftSimp=0, LoftType=0, Rebuild=10, Refit=0.01})

# ---- group: object_rotation
number_slider_7 = Slider(75, range=0..360)

# ----
panel_16 = Panel(polyline_2)
mesh = Mesh(mesh_overhang.Mesh)
preview_2 = CustomPreview(
    Geometry=loft,
    Material={diffuse=RGB(221, 160, 221), emission=RGB(66, 48, 66), shine=0.5, specular=RGB(255, 255, 255), transparency=0})

# ----
# bed corners (robot base, mm), uv on the bed, angle, first layer offset
cluster_3 = Cluster(S=printbed_position_2, uv=pt_2, A=degrees(number_slider_7), first_layer_lift_2=number_slider_6)
place_on_bed_2 = Python3Script(printpath=data_5, bed_plane=cluster_3)  # -> printpath_on_bed, summary; inputs bed_plane: Plane
# ---------- place_on_bed_2: Python ----------
# r: compas
# venv: mas-2627
"""
Place the printpath on the print bed.
bed_plane comes from 校正桌面: the bed surface at (u, v), turned by the object angle, z up, raised by the first layer offset.
The printpath is built around world XY, so world XY is moved onto bed_plane.
The output is a normal PrintPath (now in robot base coordinates), so preview and save work as before.
"""
import os
import sys

from compas.geometry import Frame, Transformation
from compas_rhino.conversions import plane_to_compas_frame

# Find source folder
gh_dir = os.path.dirname(ghenv.Component.OnPingDocument().FilePath)
src_dir = os.path.join(gh_dir, "..", "..", "src")
if src_dir not in sys.path:
    sys.path.append(src_dir)
from print_class import PrintPath

# ===== world XY -> bed plane =====
bed = plane_to_compas_frame(bed_plane)
transformation = Transformation.from_frame_to_frame(Frame.worldXY(), bed)

# ===== New printpath, the original stays untouched =====
placed = []
for printpoint in printpath.printpoints:
    new_printpoint = printpoint.copy()
    new_printpoint.frame.transform(transformation)
    placed.append(new_printpoint)
printpath_on_bed = PrintPath(placed)

z_values = [printpoint.frame.point.z for printpoint in placed]
summary = f"bed origin: {[round(v, 2) for v in bed.point]}\nz from {min(z_values):.1f} to {max(z_values):.1f} mm (robot base)"
# ---------- end place_on_bed_2 ----------

# ---- group: UR5 SIM (取代 TACO)
# UR5 SIM (TACO logic): printpath_on_bed -> IK -> reach / flip / singular / collision -> pose at Index
tool_mesh_edit_2 = ToolMeshEdit([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])  # disabled
extruder_model = Python3Script()  # -> tool_mesh, collision, info; disabled
# ---------- extruder_model: Python ----------
#! python3
"""Extruder model (SAEKI housing + R3DP extruder + gold bracket plate), in the FLANGE frame
(tool0 of the UR: origin = flange centre, z = out of the flange towards the nozzle), mm.
Sizes and positions are read from the photos (2026-11-10): measure them and change the numbers below.
The nozzle tip is placed exactly at the TCP (TOOL_FRAME in send_to_robot.py).

Directions used below (all horizontal, in the flange plane):
  n : normal of the gold plate, pointing from the nozzle towards the plate
  u : along the plate, pointing towards the flange axis side (u = z x n)
Positions of the black parts are (u, n) measured from the FLANGE AXIS, plate outline (u, h) from the NOZZLE.

Outputs
  tool_mesh : meshes for UR5 Robot Pose > ToolMesh (preview of this component is off)
  collision : solids for UR5 Path Solver > Collision
  info      : the numbers that matter for collisions
"""
import math

import Rhino.Geometry as rg

TCP = (-57.08, 44.54, 189.5)        # nozzle tip in the flange frame (TOOL_FRAME)

# ----- gold bracket plate (MEASURE THESE) -----
PLATE_ANGLE = 120.0     # deg: plate normal n = (flange axis -> nozzle direction) turned by this angle about z
PLATE_OFFSET = 44.0     # mm from the nozzle axis to the plate (photo: 44, the plate passes ~8 mm beyond the flange axis)
PLATE_T = 5.0           # plate thickness
PLATE_GAP = 8.0         # lowest edge of the plate above the nozzle tip (raised 5 mm on 2026-11-10)
# plate seen face on: (u from the nozzle, h above the nozzle tip). Narrow tab at the bottom, wide part under the flange
PLATE_OUTLINE = [(8, PLATE_GAP), (50, PLATE_GAP), (50, 38), (99, 84), (99, 173), (27, 173), (27, 125), (8, 60)]

# ----- black parts and brass: (u0, u1), (n0, n1), (z0, z1), from the flange axis -----
RING = (37.0, 10.0)                                          # black ring under the flange: radius, height
HOUSING = ((-47, 8), (-43, 5), [(-47, 10), (8, 10), (8, 102), (-47, 65)])   # SAEKI box, sloped bottom (u, z)
MOTOR = ((-51, -10), (-37, 5), (81, 132))                    # stepper under the housing
EXTRUDER = ((-98, -39), (-62, -8), (78, 132))                # R3DP extruder + fan, away from the flange
HEATER = (15.0, 20.0, 132.0)                                 # brass bar around the nozzle: size along u, along n, top z
NOZZLE_H, NOZZLE_R = 4.5, 4.0                                # cone above the tip


def polyline(points):
    """rg.Polyline from a python list (the list constructor is not picked reliably by every Rhino)."""
    pl = rg.Polyline()
    for p in points:
        pl.Add(p)
    return pl


class Prism(object):
    """Flat outline extruded by its thickness, in the flange frame.
    Outline (x, y) in plane coordinates, thickness centred on the plane (along plane Z)."""

    def __init__(self, name, plane, outline, thickness):
        self.name, self.plane, self.outline, self.thickness = name, plane, outline, thickness

    def mesh(self):
        mesh = rg.Mesh()
        half = self.thickness / 2
        n = len(self.outline)
        for w in (-half, half):
            for x, y in self.outline:
                mesh.Vertices.Add(self.plane.PointAt(x, y, w))
        for k in range(n):                       # sides
            k2 = (k + 1) % n
            mesh.Faces.AddFace(k, k2, n + k2, n + k)
        for w in (-half, half):                  # top and bottom caps
            cap = polyline([self.plane.PointAt(x, y, w) for x, y in self.outline] + [self.plane.PointAt(self.outline[0][0], self.outline[0][1], w)])
            cap_mesh = rg.Mesh.CreateFromClosedPolyline(cap)
            if cap_mesh:
                mesh.Append(cap_mesh)
        mesh.Normals.ComputeNormals()
        mesh.Vertices.CombineIdentical(True, True)   # weld: a closed mesh, so the collision check can test inside
        mesh.Normals.ComputeNormals()
        mesh.Compact()
        return mesh


tip = rg.Point3d(*TCP)
direction = rg.Vector3d(tip.X, tip.Y, 0)     # flange axis -> nozzle
direction.Unitize()
n_axis = rg.Vector3d(direction)
n_axis.Rotate(math.radians(PLATE_ANGLE), rg.Vector3d.ZAxis)
u_axis = rg.Vector3d.CrossProduct(rg.Vector3d.ZAxis, n_axis)


def box_un(name, u, n, z):
    """Box from (u0, u1), (n0, n1), (z0, z1) measured from the flange axis. z may be a (u, z) outline."""
    plane = rg.Plane(rg.Point3d(0, 0, 0) + n_axis * ((n[0] + n[1]) / 2), u_axis, rg.Vector3d.ZAxis)
    outline = z if isinstance(z, list) else [(u[0], z[0]), (u[1], z[0]), (u[1], z[1]), (u[0], z[1])]
    return Prism(name, plane, outline, n[1] - n[0])


# plate: vertical, PLATE_OFFSET from the nozzle on the n side; plane x = u, plane y = up (towards the flange)
plate_plane = rg.Plane(rg.Point3d(tip.X, tip.Y, tip.Z) + n_axis * PLATE_OFFSET, u_axis, -rg.Vector3d.ZAxis)
plate = Prism("bracket", plate_plane, PLATE_OUTLINE, PLATE_T)
housing = box_un("housing", HOUSING[0], HOUSING[1], HOUSING[2])
motor = box_un("motor", *MOTOR)
extruder = box_un("extruder", *EXTRUDER)
nu = rg.Point3d(tip.X, tip.Y, 0)
heater_plane = rg.Plane(nu, u_axis, rg.Vector3d.ZAxis)
heater = Prism("heater", heater_plane, [(-HEATER[0] / 2, HEATER[2]), (HEATER[0] / 2, HEATER[2]),
                                        (HEATER[0] / 2, tip.Z - NOZZLE_H), (-HEATER[0] / 2, tip.Z - NOZZLE_H)], HEATER[1])
ring = rg.Mesh.CreateFromCylinder(rg.Cylinder(rg.Circle(rg.Plane.WorldXY, RING[0]), RING[1]), 1, 32)
nozzle = rg.Mesh.CreateFromCone(rg.Cone(rg.Plane(tip, -rg.Vector3d.ZAxis), NOZZLE_H, NOZZLE_R), 1, 24)

collision = [plate, heater, extruder, motor, housing]
tool_mesh = [ring, nozzle] + [p.mesh() for p in collision]
ghenv.Component.Hidden = True

# check: where the flange axis and the nozzle sit relative to the plate
n_nozzle = (tip - rg.Point3d(0, 0, tip.Z)) * n_axis
u_nozzle = (tip - rg.Point3d(0, 0, tip.Z)) * u_axis
info = (f"tip (TCP): {TCP}\n"
        f"nozzle from the flange axis: u {u_nozzle:.1f}, n {n_nozzle:.1f} (photo: u -63, n -36)\n"
        f"plate: {PLATE_OFFSET:.0f} mm beside the nozzle, {PLATE_OFFSET + n_nozzle:.0f} mm beyond the flange axis, "
        f"lowest edge {PLATE_GAP:.0f} mm above the tip")
# ---------- end extruder_model ----------
ur5_path_solver_2 = Python3Script(Targets=place_on_bed_2.printpath_on_bed, Collision=extruder_model.collision, ToolMesh=tool_mesh_edit_2)  # -> Sim, Joints, Reach, Path, Analysis, Info, Collide; inputs Targets: list, Tool: Plane, Base: Plane, Seed: list, Collision: list, ToolMesh: list of Mesh, CheckEvery: Int32; disabled
# ---------- ur5_path_solver_2: Python ----------
#! python3
"""UR5 (CB3) kinematics, pure python. Units mm / rad inside, degrees outside."""
import math

# UR5 DH parameters (mm), same as Universal Robots publish
D1, A2, A3, D4, D5, D6 = 89.159, -425.0, -392.25, 109.15, 94.65, 82.3
DH_D = [D1, 0.0, 0.0, D4, D5, D6]
DH_A = [0.0, A2, A3, 0.0, 0.0, 0.0]
DH_ALPHA = [math.pi / 2, 0.0, 0.0, math.pi / 2, -math.pi / 2, 0.0]
LIMITS = [(-360.0, 360.0)] * 6   # UR5 CB3: every joint +-360 deg


def _dh(theta, d, a, alpha):
    ct, st, ca, sa = math.cos(theta), math.sin(theta), math.cos(alpha), math.sin(alpha)
    return [[ct, -st * ca, st * sa, a * ct],
            [st, ct * ca, -ct * sa, a * st],
            [0.0, sa, ca, d],
            [0.0, 0.0, 0.0, 1.0]]


def mul(a, b):
    return [[sum(a[i][k] * b[k][j] for k in range(4)) for j in range(4)] for i in range(4)]


def inv(t):
    r = [[t[j][i] for j in range(3)] for i in range(3)]
    p = [-sum(r[i][k] * t[k][3] for k in range(3)) for i in range(3)]
    return [r[0] + [p[0]], r[1] + [p[1]], r[2] + [p[2]], [0.0, 0.0, 0.0, 1.0]]


def frames(q_deg):
    """Base -> frame 1..6 (flange) for joints in degrees."""
    out, t = [], [[1.0 if i == j else 0.0 for j in range(4)] for i in range(4)]
    for i in range(6):
        t = mul(t, _dh(math.radians(q_deg[i]), DH_D[i], DH_A[i], DH_ALPHA[i]))
        out.append(t)
    return out


def fk(q_deg):
    return frames(q_deg)[-1]


def ik(t):
    """All analytic solutions (deg, in [-180, 180)) for a flange pose t (4x4, mm)."""
    sols = []
    p05 = [t[i][3] - D6 * t[i][2] for i in range(3)]
    r = math.hypot(p05[0], p05[1])
    if r < D4:
        return sols
    psi = math.atan2(p05[1], p05[0])
    phi = math.acos(D4 / r)
    for th1 in (psi + phi + math.pi / 2, psi - phi + math.pi / 2):
        s1, c1 = math.sin(th1), math.cos(th1)
        c5 = (t[0][3] * s1 - t[1][3] * c1 - D4) / D6
        if abs(c5) > 1.0 + 1e-9:
            continue
        c5 = max(-1.0, min(1.0, c5))
        for th5 in (math.acos(c5), -math.acos(c5)):
            s5 = math.sin(th5)
            if abs(s5) < 1e-9:
                th6 = 0.0   # wrist singularity: only th4 + th6 is defined
            else:
                th6 = math.atan2((-t[0][1] * s1 + t[1][1] * c1) / s5, (t[0][0] * s1 - t[1][0] * c1) / s5)
            t01 = _dh(th1, DH_D[0], DH_A[0], DH_ALPHA[0])
            t45 = _dh(th5, DH_D[4], DH_A[4], DH_ALPHA[4])
            t56 = _dh(th6, DH_D[5], DH_A[5], DH_ALPHA[5])
            t14 = mul(mul(inv(t01), t), inv(mul(t45, t56)))
            # origin of frame 3 seen from frame 1 (remove the d4 offset along y of frame 4)
            px = t14[0][3] - D4 * t14[0][1]
            py = t14[1][3] - D4 * t14[1][1]
            l = math.hypot(px, py)
            c3 = (l * l - A2 * A2 - A3 * A3) / (2 * A2 * A3)
            if abs(c3) > 1.0 + 1e-9:
                continue
            c3 = max(-1.0, min(1.0, c3))
            for th3 in (math.acos(c3), -math.acos(c3)):
                th2 = math.atan2(-py, -px) - math.asin(max(-1.0, min(1.0, -A3 * math.sin(th3) / l)))
                t12 = _dh(th2, DH_D[1], DH_A[1], DH_ALPHA[1])
                t23 = _dh(th3, DH_D[2], DH_A[2], DH_ALPHA[2])
                t34 = mul(inv(mul(t12, t23)), t14)
                th4 = math.atan2(t34[1][0], t34[0][0])
                sols.append([(math.degrees(v) + 180.0) % 360.0 - 180.0 for v in (th1, th2, th3, th4, th5, th6)])
    return sols


def variants(sol):
    """Every +-360 turn of every joint that stays inside the limits."""
    out = [[]]
    for a, (lo, hi) in zip(sol, LIMITS):
        out = [o + [v] for o in out for v in (a - 360.0, a, a + 360.0) if lo <= v <= hi]
    return out


def cost(q, prev):
    return sum(w * (a - b) ** 2 for w, a, b in zip((1, 1, 1, 0.5, 0.5, 0.25), q, prev))


def solve_path(flanges, seed):
    """Joint values per flange pose, each closest to the previous pose (None if unreachable)."""
    joints, prev = [], seed
    for t in flanges:
        sols = ik(t)
        if not sols:
            joints.append(None)
            continue
        # closest turn of each joint to the previous pose, then the closest solution
        best = None
        for s in sols:
            q = [min((v for v in (a - 360.0, a, a + 360.0) if lo <= v <= hi), key=lambda v: abs(v - p))
                 for a, p, (lo, hi) in zip(s, prev, LIMITS)]
            c = cost(q, prev)
            if best is None or c < best[0]:
                best = (c, q)
        joints.append(best[1])
        prev = best[1]
    return joints




# ====================================================================
# UR5 Path Solver - same idea as the IRB 2600 Path Solver (TACO logic):
# TCP targets (robot base, mm) -> flange poses -> inverse kinematics -> checks.
# Simulation only: nothing is sent to the robot (send_to_robot.py does that).
#
# Inputs
#   Targets : place on bed > printpath_on_bed (PrintPath), or compas Frames, or Rhino Planes (robot base, mm)
#   Tool    : TCP plane in the flange frame. Empty = TOOL_FRAME of send_to_robot.py
#   Base    : robot base plane in Rhino. Empty = World XY (the path is already in robot base coordinates)
#   Seed    : 6 joint values (deg) the first target should stay close to. Empty = robot pose read on 2026-11-05
#   CheckEvery : collision check on every N-th target only (faster). Empty = 1 (every target)
# Outputs
#   Sim      : solved path for UR5 Robot Pose
#   Joints   : joint values (deg), one branch per target
#   Reach    : True per target if a solution exists
#   Path     : polyline through all TCP positions
#   Analysis : True if every target is reachable, no flip, no singularity
#   Info     : report
# Joint states (colours in Robot Pose)
#   grey = ok, orange = near limit, red = unreachable, yellow = singularity, magenta = joint flip
# ====================================================================
import Grasshopper
import numpy as np
import Rhino.Geometry as rg
import System.Drawing as sd
from ghpythonlib import treehelpers as th

TOOL_XYZ = (-57.08, 44.54, 189.5)                     # TOOL_FRAME in send_to_robot.py (= UR installation TCP)
SEED = [205.43, -84.05, 89.30, -95.24, -89.94, -52.40]  # robot pose read over RTDE on 2026-11-05
FLIP_DEG = 30.0          # joint change between two targets reported as a flip ...
FLIP_DEG_PER_MM = 0.5    # ... when it is also large compared to the TCP travel
NEAR_LIMIT_DEG = 10.0
SINGULAR_DEG = 5.0       # wrist: |sin A5| , elbow: |sin A3| below sin(5 deg)
SHOULDER_MM = 20.0       # wrist centre closer than this to the shoulder singular cylinder

COLORS = {
    "ok": sd.Color.FromArgb(170, 170, 170),
    "near limit": sd.Color.FromArgb(255, 150, 0),
    "limit": sd.Color.FromArgb(230, 30, 30),
    "singular": sd.Color.FromArgb(255, 225, 0),
    "flip": sd.Color.FromArgb(220, 40, 220),
    "collision": sd.Color.FromArgb(255, 0, 0),
}
SEVERITY = ["ok", "near limit", "singular", "flip", "limit", "collision"]


def polyline(points):
    """rg.Polyline from a python list (the list constructor is not picked reliably by every Rhino)."""
    pl = rg.Polyline()
    for p in points:
        pl.Add(p)
    return pl


def plane_to_m(pl):
    x, y, z, o = pl.XAxis, pl.YAxis, pl.ZAxis, pl.Origin
    return [[x.X, y.X, z.X, o.X], [x.Y, y.Y, z.Y, o.Y], [x.Z, y.Z, z.Z, o.Z], [0.0, 0.0, 0.0, 1.0]]


def m_to_plane(m):
    return rg.Plane(rg.Point3d(m[0][3], m[1][3], m[2][3]),
                    rg.Vector3d(m[0][0], m[1][0], m[2][0]), rg.Vector3d(m[0][1], m[1][1], m[2][1]))


def to_plane(t):
    if isinstance(t, rg.Plane):
        return t
    if hasattr(t, "point") and hasattr(t, "xaxis"):   # compas Frame
        p, x, y = t.point, t.xaxis, t.yaxis
        return rg.Plane(rg.Point3d(p[0], p[1], p[2]), rg.Vector3d(x[0], x[1], x[2]), rg.Vector3d(y[0], y[1], y[2]))
    return None


def joint_status(q, prev_q, is_flip, shoulder):
    out = []
    for j, (a, (lo, hi)) in enumerate(zip(q, LIMITS)):
        s = "ok"
        if min(a - lo, hi - a) < NEAR_LIMIT_DEG:
            s = "near limit"
        if j == 4 and abs(math.sin(math.radians(a))) < math.sin(math.radians(SINGULAR_DEG)):
            s = "singular"
        if j == 2 and abs(math.sin(math.radians(a))) < math.sin(math.radians(SINGULAR_DEG)):
            s = "singular"
        if j == 0 and shoulder:
            s = "singular"
        if is_flip and prev_q is not None and abs(a - prev_q[j]) > FLIP_DEG:
            s = "flip"
        if a <= lo or a >= hi:
            s = "limit"
        out.append(s)
    return out


def shoulder_singular(q):
    t = fk(q)
    p05 = [t[i][3] - D6 * t[i][2] for i in range(3)]
    return math.hypot(p05[0], p05[1]) - D4 < SHOULDER_MM


class Simulation(object):
    """Everything UR5 Robot Pose needs that does not depend on Index."""
    colors = COLORS
    severity = SEVERITY
    name = "UR5 (CB3)"

    def __init__(self, targets, joints, tool, base, extruding, layers=None, collisions=None):
        self.joints = joints
        self.tool = tool
        self.tool_m = plane_to_m(tool)
        self.to_world = rg.Transform.PlaneToPlane(rg.Plane.WorldXY, base)
        self.extruding = extruding
        self.layers = layers or []
        self.collisions = collisions or {}     # target index -> name of the part that hits
        self.points = []
        for t in targets:
            p = rg.Point3d(t.Origin)
            p.Transform(self.to_world)
            self.points.append(p)
        self.unreachable = [i for i, q in enumerate(joints) if q is None]
        self.flips, self.prev_of, last = [], {}, None
        for i, q in enumerate(joints):
            if q is None:
                continue
            if last is not None:
                self.prev_of[i] = last
                dq = max(abs(a - b) for a, b in zip(q, joints[last]))
                if dq > FLIP_DEG and dq > FLIP_DEG_PER_MM * targets[i].Origin.DistanceTo(targets[last].Origin):
                    self.flips.append(i)
            last = i
        self.flip_set = set(self.flips)
        self.shoulder = set(i for i, q in enumerate(joints) if q and shoulder_singular(q))
        s5 = math.sin(math.radians(SINGULAR_DEG))
        self.singular = [i for i, q in enumerate(joints)
                         if q and (abs(math.sin(math.radians(q[4]))) < s5 or abs(math.sin(math.radians(q[2]))) < s5
                                   or i in self.shoulder)]
        self.near = [i for i, q in enumerate(joints)
                     if q and any(min(a - lo, hi - a) < NEAR_LIMIT_DEG for a, (lo, hi) in zip(q, LIMITS))]
        self.marks = ([(self.points[i], COLORS["collision"]) for i in sorted(self.collisions)[:3000]] +
                      [(self.points[i], COLORS["limit"]) for i in self.unreachable[:2000]] +
                      [(self.points[i], COLORS["flip"]) for i in self.flips[:2000]] +
                      [(self.points[i], COLORS["singular"]) for i in self.singular[:2000]])
        self.bbox = rg.BoundingBox.Empty
        for p in self.points:
            self.bbox = rg.BoundingBox.Union(self.bbox, rg.BoundingBox(p, p))

    def __len__(self):
        return len(self.joints)

    def __repr__(self):
        return "UR5 Simulation ({} targets)".format(len(self.joints))

    def pose(self, index):
        idx = max(0, min(int(index), len(self.joints) - 1))
        shown = next((k for k in range(idx, -1, -1) if self.joints[k] is not None),
                     next((k for k, j in enumerate(self.joints) if j is not None), None))
        if shown is None:
            return idx, None, None, ["limit"] * 6, False
        q = self.joints[shown]
        if shown != idx:
            return idx, shown, q, ["limit"] * 6, False
        prev_q = self.joints[self.prev_of[idx]] if idx in self.prev_of else None
        return idx, shown, q, joint_status(q, prev_q, idx in self.flip_set, idx in self.shoulder), True

    def link_planes(self, q):
        """Base plane + frame 1..6 (flange) + TCP, in Rhino world."""
        ms = frames(q)
        pls = [rg.Plane.WorldXY] + [m_to_plane(m) for m in ms] + [m_to_plane(mul(ms[-1], self.tool_m))]
        out = []
        for pl in pls:
            pl = rg.Plane(pl)
            pl.Transform(self.to_world)
            out.append(pl)
        return out

    def summary(self):
        return "path: {} collisions, {} unreachable, {} flips, {} singular, {} near limit".format(
            len(self.collisions), len(self.unreachable), len(self.flips), len(self.singular), len(self.near))


# ---------- collision: extruder parts vs printed material and the bed ----------
BEAD_R = 1.0     # half the bead width, mm (margin around the printed path)
STEP = 1.0       # printed path sampled every STEP mm
CELL = 20.0      # grid cell for the neighbour search, mm


def _inside(poly, u, v):
    """Vectorised point in polygon (ray casting). poly: list of (u, v); u, v: numpy arrays."""
    inside = np.zeros(u.shape, dtype=bool)
    n = len(poly)
    for k in range(n):
        (u1, v1), (u2, v2) = poly[k], poly[(k + 1) % n]
        cross = (v1 > v) != (v2 > v)
        with np.errstate(divide="ignore", invalid="ignore"):
            ux = u1 + (v - v1) * (u2 - u1) / (v2 - v1)
        inside ^= cross & (u < ux)
    return inside


def sample_print(targets, extruding):
    """Printed path sampled every STEP mm: points (N, 3) and the target index that prints each one."""
    on = extruding if extruding else [True] * len(targets)
    pts, owner = [], []
    for i in range(1, len(targets)):
        if not (on[i - 1] and on[i]):
            continue
        a, b = targets[i - 1].Origin, targets[i].Origin
        n = max(1, int(a.DistanceTo(b) / STEP))
        for k in range(1, n + 1):
            t = k / n
            pts.append((a.X + (b.X - a.X) * t, a.Y + (b.Y - a.Y) * t, a.Z + (b.Z - a.Z) * t))
            owner.append(i)
    return np.array(pts), np.array(owner)


def check_mesh_collisions(targets, flanges, extruding, meshes, tool, every=1):
    """Same check with meshes in the flange frame (Tool Mesh input). The part that holds the TCP
    (the nozzle) is skipped: it touches the print on purpose. Meshes must be closed."""
    pts, owner = sample_print(targets, extruding)
    if not len(pts):
        return {}
    bed_z = pts[:, 2].min() - 0.5
    grid = {}
    for idx, c in enumerate(map(tuple, np.floor(pts / CELL).astype(int))):
        grid.setdefault(c, []).append(idx)
    parts = []
    for k, mesh in enumerate(meshes):
        if mesh is None or mesh.Vertices.Count == 0:
            continue
        if mesh.ClosestPoint(tool.Origin).DistanceTo(tool.Origin) < 1.0:
            continue                                          # nozzle
        verts = np.array([(v.X, v.Y, v.Z) for v in mesh.Vertices])
        parts.append(("tool mesh {}".format(k), mesh, verts, verts.min(0) - BEAD_R, verts.max(0) + BEAD_R))
    hits = {}
    for i, f in enumerate(flanges):
        if i % every:
            continue
        fm = np.array(f)
        rot, org = fm[:3, :3], fm[:3, 3]
        for name, mesh, verts, lo_l, hi_l in parts:
            world = verts @ rot.T + org
            if world[:, 2].min() < bed_z:
                hits[i] = name + " / bed"
                break
            lo = np.floor((world.min(0) - BEAD_R) / CELL).astype(int)
            hi = np.floor((world.max(0) + BEAD_R) / CELL).astype(int)
            cand = [j for cx in range(lo[0], hi[0] + 1) for cy in range(lo[1], hi[1] + 1)
                    for cz in range(lo[2], hi[2] + 1) for j in grid.get((cx, cy, cz), ())]
            if not cand:
                continue
            cand = np.array(cand)
            cand = cand[owner[cand] <= i]
            if not len(cand):
                continue
            local = (pts[cand] - org) @ rot                   # world -> flange frame
            local = local[np.all((local >= lo_l) & (local <= hi_l), axis=1)]
            for x, y, z in local:
                p = rg.Point3d(x, y, z)
                if mesh.ClosestPoint(p).DistanceTo(p) <= BEAD_R or mesh.IsPointInside(p, 0.01, False):
                    hits[i] = name
                    break
            if i in hits:
                break
    return hits


def check_collisions(targets, flanges, extruding, solids, every=1):
    """Target index -> part name, for every pose where a solid touches printed material or the bed."""
    if not solids:
        return {}
    on = extruding if extruding else [True] * len(targets)
    pts, owner = [], []
    for i in range(1, len(targets)):
        if not (on[i - 1] and on[i]):
            continue
        a, b = targets[i - 1].Origin, targets[i].Origin
        n = max(1, int(a.DistanceTo(b) / STEP))
        for k in range(1, n + 1):
            t = k / n
            pts.append((a.X + (b.X - a.X) * t, a.Y + (b.Y - a.Y) * t, a.Z + (b.Z - a.Z) * t))
            owner.append(i)
    if not pts:
        return {}
    pts, owner = np.array(pts), np.array(owner)
    bed_z = pts[:, 2].min() - 0.5
    grid = {}
    for idx, c in enumerate(map(tuple, np.floor(pts / CELL).astype(int))):
        grid.setdefault(c, []).append(idx)
    local = [(s, np.array(plane_to_m(s.plane))) for s in solids]
    hits = {}
    for i, f in enumerate(flanges):
        if i % every:
            continue
        fm = np.array(f)
        for s, sm in local:
            m = fm @ sm                         # solid frame -> world
            rot, org = m[:3, :3], m[:3, 3]
            half = s.thickness / 2 + BEAD_R
            corners = np.array([org + rot @ (u, h, w) for u, h in s.outline for w in (-half, half)])
            if corners[:, 2].min() < bed_z:
                hits[i] = s.name + " / bed"
                break
            lo, hi = np.floor((corners.min(0) - BEAD_R) / CELL).astype(int), np.floor((corners.max(0) + BEAD_R) / CELL).astype(int)
            cand = [j for cx in range(lo[0], hi[0] + 1) for cy in range(lo[1], hi[1] + 1)
                    for cz in range(lo[2], hi[2] + 1) for j in grid.get((cx, cy, cz), ())]
            if not cand:
                continue
            cand = np.array(cand)
            cand = cand[owner[cand] <= i]       # only what is already printed at this pose
            if not len(cand):
                continue
            p = (pts[cand] - org) @ rot         # world -> solid frame (u, h, w)
            near = np.abs(p[:, 2]) <= half
            if not near.any():
                continue
            u, v = p[near, 0], p[near, 1]
            hit = np.zeros(u.shape, dtype=bool)
            for du, dv in ((0, 0), (BEAD_R, 0), (-BEAD_R, 0), (0, BEAD_R), (0, -BEAD_R)):
                hit |= _inside(s.outline, u + du, v + dv)
            if hit.any():
                hits[i] = s.name
                break
    return hits


# ---------- component ----------
items = [t for t in (Targets or []) if t is not None]
Sim = Joints = Reach = Path = Analysis = Info = Collide = None
extruding, layers, speeds = [], [], []
if len(items) == 1 and hasattr(items[0], "printpoints"):        # a PrintPath
    extruding = [p.is_extruder_on for p in items[0].printpoints]
    layers = [p.layer_index for p in items[0].printpoints]
    # a speed given as a list (e.g. Genes) counts as its fastest value
    speeds = [max(p.speed) if isinstance(p.speed, (list, tuple)) else p.speed for p in items[0].printpoints]
    items = [p.frame for p in items[0].printpoints]
targets = [to_plane(t) for t in items]
targets = [t for t in targets if t is not None]

if targets:
    tool = Tool if isinstance(Tool, rg.Plane) else rg.Plane(rg.Point3d(*TOOL_XYZ), rg.Vector3d.XAxis, rg.Vector3d.YAxis)
    base = Base if isinstance(Base, rg.Plane) else rg.Plane.WorldXY
    seed = [float(v) for v in Seed][:6] if Seed and len(Seed) >= 6 else SEED
    tool_inv = inv(plane_to_m(tool))
    flanges = [mul(plane_to_m(t), tool_inv) for t in targets]
    joints = solve_path(flanges, seed)
    try:
        EVERY = max(1, int(round(float(str(CheckEvery))))) if CheckEvery is not None else 1
    except NameError:
        EVERY = 1
    tool_meshes = [m for m in (ToolMesh or []) if isinstance(m, rg.Mesh)]
    solids = [s for s in (Collision or []) if hasattr(s, "outline")]
    if tool_meshes:      # the meshes you can edit win over the Extruder Model solids
        hits = check_mesh_collisions(targets, flanges, extruding, tool_meshes, tool, EVERY)
        solids = tool_meshes
    else:
        hits = check_collisions(targets, flanges, extruding, solids, EVERY)
    Sim = Simulation(targets, joints, tool, base, extruding, layers, hits)
    # time at each target: segment length / speed of the target it moves to (10 mm/s if unknown)
    Sim.times = [0.0]
    for i in range(1, len(targets)):
        v = speeds[i] if i < len(speeds) and speeds[i] > 0 else 10.0
        Sim.times.append(Sim.times[-1] + targets[i - 1].Origin.DistanceTo(targets[i].Origin) / v)

    hit_layers = sorted(set(layers[i] + 1 for i in hits)) if layers else []
    first = min(hits) if hits else None
    Info = "\n".join([
        "robot: UR5 (CB3), base = {}".format("World XY" if base == rg.Plane.WorldXY else "custom plane"),
        "targets: {}{}".format(len(targets), "" if EVERY == 1 else "   (collision check on every {}th target)".format(EVERY)),
        "COLLISIONS: {}{}".format(len(hits), "" if not hits else "  first at index {} ({}){}, parts: {}".format(
            first, hits[first], ", layer {}".format(layers[first] + 1) if layers else "", sorted(set(hits.values())))),
        "  layers with collisions: {}".format(hit_layers[:40]) if hit_layers else ("  (no Collision solids connected)" if not solids else ""),
        "unreachable: {}{}".format(len(Sim.unreachable), " " + str(Sim.unreachable[:20]) if Sim.unreachable else ""),
        "joint flips > {} deg: {}{}".format(FLIP_DEG, len(Sim.flips), " " + str(Sim.flips[:20]) if Sim.flips else ""),
        "singular (wrist A5 / elbow A3 / shoulder): {}{}".format(len(Sim.singular), " " + str(Sim.singular[:20]) if Sim.singular else ""),
        "near limit (< {} deg from +-360): {}".format(NEAR_LIMIT_DEG, len(Sim.near)),
        "A6 range: {:.1f} to {:.1f} deg".format(min(q[5] for q in joints if q), max(q[5] for q in joints if q)) if any(joints) else "",
    ])
    if hits:
        ghenv.Component.AddRuntimeMessage(Grasshopper.Kernel.GH_RuntimeMessageLevel.Error,
                                          "{} collision(s), first at index {} ({})".format(len(hits), first, hits[first]))
    if Sim.unreachable:
        ghenv.Component.AddRuntimeMessage(Grasshopper.Kernel.GH_RuntimeMessageLevel.Warning,
                                          "{} target(s) unreachable".format(len(Sim.unreachable)))
    if Sim.flips or Sim.singular:
        ghenv.Component.AddRuntimeMessage(Grasshopper.Kernel.GH_RuntimeMessageLevel.Warning,
                                          "{} flip(s), {} singular target(s)".format(len(Sim.flips), len(Sim.singular)))
    Joints = th.list_to_tree([q if q is not None else [] for q in joints])
    Reach = [q is not None for q in joints]
    Path = polyline(Sim.points).ToPolylineCurve() if len(Sim.points) > 1 else None
    Collide = [i in hits for i in range(len(targets))]
    Analysis = not hits and not Sim.unreachable and not Sim.flips and not Sim.singular
# ---------- end ur5_path_solver_2 ----------
index_2 = Slider(858, range=0..1601)  # disabled
play_2 = BooleanToggle(False)  # disabled
timeline_2 = BooleanToggle(False)  # disabled
panel_17 = Panel(ur5_path_solver_2.Info)  # disabled
panel_18 = Panel(extruder_model.info)  # disabled
ur5_robot_pose_2 = Python3Script(Sim=ur5_path_solver_2.Sim, Index=index_2, ToolMesh=tool_mesh_edit_2, Play=play_2, Timeline=timeline_2)  # -> Robot, TCP, Axis, Status; inputs ToolMesh: list of Mesh, Play: Boolean, Timeline: Boolean; disabled
# ---------- ur5_robot_pose_2: Python ----------
#! python3
"""UR5 Robot Pose - shows the UR5 Path Solver result at one target.
Only this component runs when the Index slider moves.

Inputs
    Sim      : UR5 Path Solver > Sim
    Index    : target to display (connect a Number Slider)
    Play     : Boolean Toggle: True plays the path (moves the Index slider), False pauses
    Timeline : Boolean Toggle: False hides the timeline bar at the top of the viewport (not connected = shown)
    ToolMesh : Extruder Model > tool_mesh (in the flange frame)
Outputs
    Robot  : UR5 meshes posed at Index, coloured by joint status (extruder red on a collision)
    TCP    : TCP plane at Index
    Axis   : 6 joint values at Index (deg)
    Status : joint states at Index

Viewport timeline (top left): play / pause symbol, the line shows where Index is on the path.
Red ticks on the line = collisions, magenta = flips, yellow = singular.
This component draws the robot only (robot, extruder, table). The printed shape is drawn by the
extrusion preview component (connect the same Index slider to both).
"""
import Grasshopper
import Rhino
import Rhino.Geometry as rg
import scriptcontext as sc
import System
import System.Drawing as sd

# UR5 shape close to the real robot (mm). The arm tubes sit beside the DH axis lines like on the robot:
# upper arm SHOULDER_OFFSET along the shoulder axis, forearm FOREARM_OFFSET, wrist 1 at d4.
SHOULDER_OFFSET = 135.85
FOREARM_OFFSET = 16.15          # 135.85 - 119.70
D1, D4, D5, D6 = 89.159, 109.15, 94.65, 82.3
R_BASE, R_SHOULDER, R_ELBOW, R_WRIST = 45.0, 45.0, 38.0, 32.0
R_UPPER, R_FORE = 31.0, 26.0    # arm tubes
TOOL_R = 14

# colours of the real parts
ALU = sd.Color.FromArgb(200, 202, 206)        # aluminium arm tubes
JOINT = sd.Color.FromArgb(92, 92, 98)         # dark grey joint bodies
CAP = sd.Color.FromArgb(150, 196, 200)        # light blue-green joint caps
BED = sd.Color.FromArgb(178, 180, 182)        # aluminium table
PLATE_COL = sd.Color.FromArgb(150, 152, 156)  # adapter plate under the robot
# Tool Mesh order: ring, nozzle, plate, heater, extruder, motor, housing
TOOL_COLS = [sd.Color.FromArgb(25, 25, 25), sd.Color.FromArgb(200, 150, 60), sd.Color.FromArgb(205, 165, 55),
             sd.Color.FromArgb(190, 140, 60), sd.Color.FromArgb(30, 30, 32), sd.Color.FromArgb(40, 40, 42),
             sd.Color.FromArgb(28, 28, 30)]
METALLIC = (ALU, CAP, TOOL_COLS[1], TOOL_COLS[2], TOOL_COLS[3])

BLUE = sd.Color.FromArgb(90, 110, 255)
PLAY_SECONDS = 40.0       # the whole path plays in about this time
# one set of keys per component, so several UR5 Robot Pose components do not share their state
STATE_KEY = "ur5_timeline_" + str(ghenv.Component.InstanceGuid)
PATH_KEY = "ur5_print_cache_" + str(ghenv.Component.InstanceGuid)


def cylinder(origin, axis, r, h, centred=True):
    axis = rg.Vector3d(axis)
    if not axis.Unitize() or h <= 0:
        return None
    start = origin - axis * (h / 2.0) if centred else rg.Point3d(origin)
    c = rg.Cylinder(rg.Circle(rg.Plane(start, axis), r), h)
    return rg.Mesh.CreateFromCylinder(c, 1, 32)


def along(pl, a, b, r):
    """Cylinder on the z axis of plane pl, from a to b (mm along z)."""
    return cylinder(pl.Origin + pl.ZAxis * a, pl.ZAxis, r, b - a, centred=False)


def tube(a, b, r):
    v = b - a
    return cylinder(a, v, r, v.Length, centred=False) if r > 0 and v.Length > 1 else None


def material(c):
    m = Rhino.Display.DisplayMaterial(c)
    if c in METALLIC:
        m.Shine = 0.8
        m.Specular = sd.Color.White
    return m


def robot_parts(pl):
    """(mesh, colour key, joint) for the UR5 in pose pl (base, frame 1..6, TCP).
    colour key: 'alu', 'joint' or 'cap'; joint = index used for the status colour."""
    p = []
    base, f1, f2, f3, f4, f5, f6 = pl[:7]
    so, fo = SHOULDER_OFFSET, FOREARM_OFFSET
    # base: flange ring + joint 1 column up to the shoulder
    p.append((along(base, 0, 12, 75), "joint", 0))
    p.append((along(base, 12, D1 + 25, R_BASE), "joint", 0))
    p.append((along(base, D1 + 25, D1 + 33, R_BASE - 2), "cap", 0))
    # shoulder (joint 2): housing along the shoulder axis, cap outside
    p.append((along(f1, -R_SHOULDER, so + 30, R_SHOULDER), "joint", 1))
    p.append((along(f1, so + 30, so + 38, R_SHOULDER - 2), "cap", 1))
    # upper arm
    p.append((tube(f1.Origin + f1.ZAxis * so, f2.Origin + f2.ZAxis * so, R_UPPER), "alu", 1))
    # elbow (joint 3)
    p.append((along(f2, fo - 28, so + 28, R_ELBOW), "joint", 2))
    p.append((along(f2, so + 28, so + 35, R_ELBOW - 2), "cap", 2))
    # forearm
    p.append((tube(f2.Origin + f2.ZAxis * fo, f3.Origin + f3.ZAxis * fo, R_FORE), "alu", 2))
    # wrist 1 (joint 4) on the forearm end, up to the wrist 2 axis
    p.append((along(f3, fo - 26, D4 + R_WRIST, R_WRIST), "joint", 3))
    p.append((along(f3, fo - 33, fo - 26, R_WRIST - 2), "cap", 3))
    # wrist 2 (joint 5)
    p.append((along(f4, -R_WRIST, D5 - 5, R_WRIST), "joint", 4))
    p.append((along(f4, -R_WRIST - 7, -R_WRIST, R_WRIST - 2), "cap", 4))
    # wrist 3 (joint 6) up to the tool flange
    p.append((along(f5, -R_WRIST, D6 - 8, R_WRIST), "joint", 5))
    p.append((along(f5, -R_WRIST - 7, -R_WRIST, R_WRIST - 2), "cap", 5))
    p.append((along(f5, D6 - 8, D6, 31.5), "alu", 5))           # tool flange
    return p


def polyline(points):
    """rg.Polyline from a python list (the list constructor is not picked reliably)."""
    pl = rg.Polyline()
    for p in points:
        pl.Add(p)
    return pl


def print_cache(Sim):
    """Table height and size from the path, made once per Sim."""
    cache = sc.sticky.get(PATH_KEY)
    if cache and cache[0] is Sim:
        return cache[1]
    pts, on = Sim.points, Sim.extruding or [True] * len(Sim.points)
    lows = [pts[i].Z for i in range(len(pts)) if on[i]] or [p.Z for p in pts]
    bed_z = min(lows) - 1.0                     # nozzle prints about one layer above the table
    xs = [p.X for p in pts] + [0.0]
    ys = [p.Y for p in pts] + [0.0]
    table = rg.Box(rg.Plane.WorldXY, rg.Interval(min(xs) - 250, max(xs) + 250),
                   rg.Interval(min(ys) - 250, max(ys) + 250), rg.Interval(bed_z - 30, bed_z))
    data = {"bed_z": bed_z, "table": rg.Mesh.CreateFromBox(table, 1, 1, 1)}
    sc.sticky[PATH_KEY] = (Sim, data)
    return data


def as_int(value):
    """Slider values are System.Decimal: int() does not take them and Convert.ToDouble picks the
    SByte overload (overflow above 127), so go through the text."""
    return int(round(float(str(value).replace(",", "."))))


def as_decimal(value):
    return System.Decimal.Parse(str(int(value)))


def clock(seconds):
    s = int(round(seconds))
    return "{:d}:{:02d}".format(s // 60, s % 60)


# ---------- timeline (driven by the Index slider and the Play toggle, no mouse hooks) ----------
state = sc.sticky.setdefault(STATE_KEY, {"n": 1, "comp": None, "play": False})


def index_slider():
    comp = state.get("comp")
    if comp is None or comp.Params.Input.Count < 2:
        return None
    for s in comp.Params.Input[1].Sources:
        if isinstance(s, Grasshopper.Kernel.Special.GH_NumberSlider):
            return s
    return None


def _advance(doc):
    s = index_slider()
    if s is None or not state["play"]:
        return
    step = max(1, int(round(state["n"] / (PLAY_SECONDS * 25.0))))
    value = as_int(s.CurrentValue) + step
    if value >= state["n"] - 1:
        value, state["play"] = state["n"] - 1, False
    s.SetSliderValue(as_decimal(value))
    s.ExpireSolution(False)


def _fit_slider(doc):
    s = index_slider()
    if s is not None:
        s.Slider.Minimum = as_decimal(0)
        s.Slider.Maximum = as_decimal(max(state["n"] - 1, 1))
        s.Slider.DecimalPlaces = 0
        s.ExpireSolution(False)


class Script_Instance(Grasshopper.Kernel.GH_ScriptInstance):
    def __init__(self):
        self._draw, self._marks, self._hud = [], [], []
        self._bbox = rg.BoundingBox.Empty
        self._bar = None

    def RunScript(self, Sim, Index, ToolMesh: list[Rhino.Geometry.Mesh], Play: bool, Timeline: bool):
        self._show_bar = Timeline is not False      # not connected = shown
        try:
            return self._run(Sim, Index, ToolMesh, bool(Play))
        except Exception:
            import traceback
            ghenv.Component.AddRuntimeMessage(Grasshopper.Kernel.GH_RuntimeMessageLevel.Error, traceback.format_exc()[-600:])
            return None, None, None, None

    def _run(self, Sim, Index, ToolMesh, play):
        self._draw, self._marks, self._hud = [], [], []
        self._bbox = rg.BoundingBox.Empty
        self._bar = None
        if Sim is None:
            return None, None, None, None
        colors = Sim.colors
        state["comp"] = ghenv.Component
        state["n"] = len(Sim)
        doc = ghenv.Component.OnPingDocument()
        s = index_slider()
        if s is not None and as_int(s.Slider.Maximum) != len(Sim) - 1:
            doc.ScheduleSolution(1, Grasshopper.Kernel.GH_Document.GH_ScheduleDelegate(_fit_slider))
        state["play"] = play
        if play and s is not None and as_int(s.CurrentValue) < len(Sim) - 1:
            doc.ScheduleSolution(40, Grasshopper.Kernel.GH_Document.GH_ScheduleDelegate(_advance))

        idx, shown, q, status, reachable = Sim.pose(int(round(float(Index or 0))))
        collisions = getattr(Sim, "collisions", {})
        robot, tcp = [], None
        cache = print_cache(Sim)
        hit = collisions.get(idx)
        hit_part = None               # index in Tool Mesh of the part that hits
        if hit and "tool mesh" in str(hit):
            try:
                hit_part = int(str(hit).split("tool mesh")[1].split()[0])
            except ValueError:
                hit_part = None
        if q is not None:
            pl = Sim.link_planes(q)   # base, frame 1..6, TCP
            parts = []                # (mesh, colour)
            look = {"alu": ALU, "joint": JOINT, "cap": CAP}
            for m, key, j in robot_parts(pl):
                st = status[j] if reachable else "limit"
                # natural colours; a joint with a problem shows its status colour
                c = look[key] if st == "ok" or key == "alu" else colors[st]
                parts.append((m, c))
            if ToolMesh:
                to_flange = rg.Transform.PlaneToPlane(rg.Plane.WorldXY, pl[6])
                for k, tm in enumerate(ToolMesh):
                    if tm is None:
                        continue
                    dup = tm.DuplicateMesh()
                    dup.Transform(to_flange)
                    c = TOOL_COLS[k] if k < len(TOOL_COLS) else JOINT
                    if hit and (hit_part is None or hit_part == k):
                        c = colors["collision"]
                    parts.append((dup, c))
            else:
                parts.append((tube(pl[6].Origin, pl[7].Origin, TOOL_R), JOINT))
            # adapter plate between the table and the robot base
            parts.append((cylinder(rg.Point3d(0, 0, cache["bed_z"]), rg.Vector3d.ZAxis, 90,
                                   max(-cache["bed_z"], 1), False), PLATE_COL))
            for m, c in parts:
                if m is None:
                    continue
                m.VertexColors.CreateMonotoneMesh(c)
                robot.append(m)
                self._draw.append((m, c))
                self._bbox = rg.BoundingBox.Union(self._bbox, m.GetBoundingBox(False))
            tcp = pl[7]
        self._draw.insert(0, (cache["table"], BED))
        self._bbox = rg.BoundingBox.Union(self._bbox, cache["table"].GetBoundingBox(False))

        # the printed shape is not drawn here: use the extrusion preview component for it
        self._marks = Sim.marks + [(Sim.points[idx], sd.Color.Black)]
        self._bbox = rg.BoundingBox.Union(self._bbox, Sim.bbox)

        # ----- text -----
        on = Sim.extruding[idx] if idx < len(Sim.extruding) else None
        layers = getattr(Sim, "layers", [])
        layer = "   height {:.1f} mm".format(Sim.points[idx].Z - cache["bed_z"])
        if idx < len(layers) and layers[-1] + 1 < len(Sim) / 5:   # real layers (not one per point)
            layer = "   layer {} / {}".format(layers[idx] + 1, layers[-1] + 1) + layer
        # several pose components: each gets its own place on the screen (top one first)
        poses = sorted([o for o in doc.Objects if o.NickName == "UR5 Robot Pose" and hasattr(o, "Params")],
                       key=lambda o: (o.Attributes.Pivot.Y, o.Attributes.Pivot.X))
        self._rank = next((k for k, o in enumerate(poses) if o.InstanceGuid == ghenv.Component.InstanceGuid), 0)
        tag = "SIM {}  ".format(self._rank + 1) if len(poses) > 1 else ""
        self._hud.append((tag + "PATH SIM  " + Sim.name + layer + ("" if on is None else ("   extruder ON" if on else "   travel")),
                          sd.Color.FromArgb(0, 70, 200)))
        if idx in collisions:
            self._hud.append(("COLLISION: {}".format(collisions[idx]), colors["collision"]))
        if not reachable:
            self._hud.append(("UNREACHABLE  (showing index {})".format(shown), colors["limit"]))
        else:
            for j, (a, st) in enumerate(zip(q, status)):
                self._hud.append(("A{} {:9.2f}  {}".format(j + 1, a, "" if st == "ok" else st),
                                  sd.Color.Black if st == "ok" else colors[st]))
        bad = Sim.unreachable or Sim.flips or Sim.singular or collisions
        self._hud.append((Sim.summary(), colors["limit"] if bad else sd.Color.DimGray))

        # ----- timeline -----
        n = max(len(Sim) - 1, 1)
        marks = []
        for name, items in (("singular", Sim.singular), ("flip", Sim.flips), ("limit", Sim.unreachable),
                            ("collision", sorted(collisions))):
            marks += [(i / float(n), colors[name]) for i in items]
        times = getattr(Sim, "times", None)
        sub = "/ {}".format(n)
        if times:
            sub += "   ({} / {})".format(clock(times[idx]), clock(times[-1]))
        self._bar = (idx / float(n), idx, sub, marks, idx in collisions)

        worst = "limit" if not reachable else max(status, key=Sim.severity.index)
        if idx in collisions:
            worst = "collision"
        if worst != "ok":
            ghenv.Component.AddRuntimeMessage(Grasshopper.Kernel.GH_RuntimeMessageLevel.Remark,
                                              "index {}: {}".format(idx, worst))
        return robot, tcp, (q if reachable else []), ["A{} {}".format(j + 1, st) for j, st in enumerate(status)]

    # ---------- preview ----------
    def get_ClippingBox(self):
        return self._bbox

    def DrawViewportMeshes(self, args):
        for m, c in self._draw:
            args.Display.DrawMeshShaded(m, material(c))

    def DrawViewportWires(self, args):
        d = args.Display
        for p, c in self._marks:
            d.DrawPoint(p, Rhino.Display.PointStyle.RoundSimple, 3, c)
        if self._bar and getattr(self, "_show_bar", True):
            self._draw_timeline(args)
        rank = getattr(self, "_rank", 0)
        y = 100 + 70 * rank
        for text, c in self._hud:
            d.Draw2dText(text, c, rg.Point2d(20 + 470 * rank, y), False, 15, "Consolas")
            y += 20

    def _draw_timeline(self, args):
        d = args.Display
        fraction, idx, sub, marks, hit = self._bar
        width = args.Viewport.Bounds.Width
        bx, by, bs = 20, 30 + 70 * getattr(self, "_rank", 0), 30   # play button
        x0, x1, y = bx + bs + 14, max(bx + bs + 200, width - 170), by + bs // 2

        # play / pause button
        d.Draw2dRectangle(sd.Rectangle(bx, by, bs, bs), BLUE, 2, sd.Color.FromArgb(40, 90, 110, 255))
        if state["play"]:
            for xx in (bx + 10, bx + 18):
                d.Draw2dLine(sd.PointF(xx, by + 8), sd.PointF(xx, by + bs - 8), BLUE, 4)
        else:
            for k in range(0, 13):                         # filled triangle from vertical lines
                h = 14 - k * 14.0 / 13
                d.Draw2dLine(sd.PointF(bx + 10 + k, y - h / 2), sd.PointF(bx + 10 + k, y + h / 2), BLUE, 1.5)
        # track, done part, problem ticks
        d.Draw2dLine(sd.PointF(x0, y), sd.PointF(x1, y), sd.Color.FromArgb(150, 90, 110, 255), 2)
        xi = x0 + (x1 - x0) * fraction
        d.Draw2dLine(sd.PointF(x0, y), sd.PointF(xi, y), BLUE, 4)
        for f, c in marks:
            xm = x0 + (x1 - x0) * f
            d.Draw2dLine(sd.PointF(xm, y + 5), sd.PointF(xm, y + 12), c, 1)
        # handle
        handle = sd.Color.FromArgb(255, 0, 0) if hit else BLUE
        d.Draw2dRectangle(sd.Rectangle(int(xi) - 5, y - 11, 10, 22), handle, 1, handle)
        # index and time
        d.Draw2dText(str(idx), handle, rg.Point2d(x1 + 14, by - 4), False, 26, "Arial")
        d.Draw2dText(sub, BLUE, rg.Point2d(x1 + 14, by + 24), False, 12, "Arial")
# ---------- end ur5_robot_pose_2 ----------

# ---- group: EXPORT
# export: preview and save
# PrintPath= PrintPoint Combination
# (
# 1_compas frame,
# 2_layer_index,
# 3_speed(mm/s),
# 4_blend_radius(mm),
# 5_extruder_IO
# )
panel_19 = Panel("data/out_printpoints_weijiun.json")  # disabled
save_5 = Button()  # disabled
preview_3 = Preview(printpath=place_on_bed_2.printpath_on_bed)  # -> path, travel, planes; disabled
# ---------- preview_3: Python ----------
# r: compas
# venv: mas-2627
"""
Draw the printpath: path = the whole polyline, travel = extruder-off segments,
safety = extruder-off points, axes = small x and y axis of each frame.
"""
import Rhino.Geometry as rg
from compas_rhino.conversions import frame_to_rhino_plane, point_to_rhino

AXIS_LENGTH = 5.0  # mm

points = printpath.printpoints
planes = [frame_to_rhino_plane(printpoint.frame) for printpoint in points]

# ===== Whole path =====
polyline = rg.Polyline()
for plane in planes:
    polyline.Add(plane.Origin.X, plane.Origin.Y, plane.Origin.Z)
path = polyline.ToPolylineCurve()

# ===== Extruder off: a segment prints only if both of its points have the extruder on =====
safety = [point_to_rhino(printpoint.frame.point) for printpoint in points if not printpoint.is_extruder_on]
travel = []
for i in range(len(points) - 1):
    if not (points[i].is_extruder_on and points[i + 1].is_extruder_on):
        travel.append(rg.Line(planes[i].Origin, planes[i + 1].Origin))
# ---------- end preview_3 ----------
save_6 = Save(printpath=place_on_bed_2.printpath_on_bed, save=save_5, out_path=panel_19)  # -> status; disabled; same code as save_2
number_slider_8 = Slider(1, range=0..10)  # disabled
plane_2 = Plane(preview_3.planes)  # disabled
curve_2 = Curve(preview_3.travel)  # disabled
curve_3 = Curve(preview_3.path)  # disabled
panel_20 = Panel(save_6)  # disabled
swatch = ColourSwatch(SwatchColor=RGB(230, 40, 40))  # disabled
swatch_2 = ColourSwatch(SwatchColor=RGB(0, 170, 80))  # disabled
point_list = PointList(Points=plane_2, Size=number_slider_8)  # disabled
preview_4 = CustomPreview(Geometry=curve_3, Material=swatch_2)  # disabled
preview_5 = CustomPreview(Geometry=curve_2, Material=swatch)  # disabled
polyline_3 = PolyLine(Vertices=plane_2, Closed=False)  # disabled

# ==== cluster Cluster
first_layer_lift = Panel("1.3")
S = ClusterInput()
uv = ClusterInput()
first_layer_lift_2 = ClusterInput()
evalsrf = EvaluateSurface(Surface=reparameterize(S), Point=uv)  # -> Point, Normal, UDirection, VDirection, Frame
A = ClusterInput()
prot = RotatePlane(Plane=evalsrf.Frame, Angle=degrees(A))
deplane = DeconstructPlane(Plane=prot)  # -> Origin, XAxis, YAxis, ZAxis
Z = UnitZ(Factor=1)
dprod = DotProduct(VectorA=Z, VectorB=deplane.ZAxis, Unitize=False)
expression = Expression(x=dprod, Expression="if(x<0,True,False)")
pflip = FlipPlane(Plane=prot, ReverseX=False, ReverseY=False, SwapAxes=True)
filter = StreamFilter(Gate=expression, Stream0=prot, Stream1=pflip)
deplane_2 = DeconstructPlane(Plane=filter)  # -> Origin, XAxis, YAxis, ZAxis
amp = Amplitude(Vector=deplane_2.ZAxis, First_layer_lift=first_layer_lift_2)
move = Move(Geometry=filter, Motion=amp)  # -> Geometry, Transform
G = ClusterOutput(move.Geometry)

# ==== cluster Cluster_2
A = ClusterInput()
B = ClusterInput()
B_2 = ClusterInput()
B_3 = ClusterInput()

# ---- group: ③ 一圈的角度: 2pi*R/spacing 點, angles 0~2pi
_2_pi = Pi(Factor=2)
multiplication = Multiplication(A=_2_pi, B=B_2)
division = Division(A=multiplication, B=B_3)
round = Round(Number=division)  # -> Nearest, Floor, Ceiling
angles = Range(Domain=_2_pi, Steps=round.Nearest)

# ----
B_4 = ClusterInput()
B_5 = ClusterInput()

# ---- group: ② 層數 + 每層波幅: layer index, base z = i*h, layer amp = wave_amp*i/last
division_2 = Division(A=A, B=B)
round_2 = Round(Number=division_2)  # -> Nearest, Floor, Ceiling
layer_index = Series(Start=0, Step=1, Count=round_2.Floor)
last_layer = Subtraction(A=round_2.Floor, B=1)
base_z = Multiplication(A=layer_index, B=B_4)
multiplication_2 = Multiplication(A=layer_index, B=B_5)
layer_amp = Division(A=multiplication_2, B=last_layer)

# ----
B_6 = ClusterInput()
B_7 = ClusterInput()
B_8 = ClusterInput()
B_9 = ClusterInput()
B_10 = ClusterInput()

# ---- group: ⑤ 圓周位置: x = R cos + cx, y = R sin + cy
cos = Cosine(Value=angles)
sin = Sine(Value=angles)
multiplication_3 = Multiplication(A=cos, B=B_7)
multiplication_4 = Multiplication(A=sin, B=B_8)
x = Addition(A=multiplication_3, B=B_9)
y = Addition(A=multiplication_4, B=B_10)

# ----
B_11 = ClusterInput()

# ---- group: ④ 波浪高度: z = base z + layer amp*sin(freq*angle) + fine z
multiplication_5 = Multiplication(A=angles, B=B_6)
sin_2 = Sine(Value=multiplication_5)
wave = Multiplication(A=graft(layer_amp), B=sin_2)
z = Addition(A=graft(base_z), B=wave)
addition = Addition(A=z, B=B_11)

# ----
B_12 = ClusterInput()

# ---- group: ⑥ 點 + 每層曲線 (layers)
points = ConstructPoint(XCoordinate=x, YCoordinate=y, ZCoordinate=addition)
layers = PolyLine(Vertices=points, Closed=False)  # -> flatten(Polyline)

# ---- group: ⑦ 傾斜平面: nozzle axis = 垂直層面的法線 (tilt factor 混合), X 對齊 -X
tilt_factor_0_flat_1_normal = Slider(1, range=0..1)
cos_2 = Cosine(Value=multiplication_5)
multiplication_6 = Multiplication(A=cos_2, B=B_12)
slope_z = Multiplication(A=graft(layer_amp), B=multiplication_6)
neg = Negative(Value=multiplication_4)
_1_tilt = Subtraction(A=1, B=tilt_factor_0_flat_1_normal)
tangent = VectorXYZ(XComponent=neg, YComponent=multiplication_3, ZComponent=slope_z)  # -> Vector, Length
radial = VectorXYZ(XComponent=cos, YComponent=sin, ZComponent=0)  # -> Vector, Length
Z = UnitZ(Factor=-1)
layer_normal_down = CrossProduct(VectorA=tangent.Vector, VectorB=radial.Vector, Unitize=True)  # -> Vector, Length
multiplication_7 = Multiplication(A=Z, B=_1_tilt)
multiplication_8 = Multiplication(A=layer_normal_down.Vector, B=tilt_factor_0_flat_1_normal)
nozzle_axis = Addition(A=multiplication_8, B=multiplication_7)
pl = PlaneNormal(Origin=points, ZAxis=nozzle_axis)
X = UnitX(Factor=-1)
print_planes = AlignPlane(Plane=pl, Direction=X)  # -> Plane, Angle

# ----
P = ClusterOutput(print_planes.Plane)

# ==== cluster Cluster_3
S = ClusterInput()
uv = ClusterInput()
A = ClusterInput()
evalsrf = EvaluateSurface(Surface=reparameterize(S), Point=uv)  # -> Point, Normal, UDirection, VDirection, Frame
prot = RotatePlane(Plane=evalsrf.Frame, Angle=degrees(A))
Z = UnitZ(Factor=1)
deplane = DeconstructPlane(Plane=prot)  # -> Origin, XAxis, YAxis, ZAxis
dprod = DotProduct(VectorA=Z, VectorB=deplane.ZAxis, Unitize=False)
pflip = FlipPlane(Plane=prot, ReverseX=False, ReverseY=False, SwapAxes=True)
expression = Expression(x=dprod, Expression="if(x<0,True,False)")
filter = StreamFilter(Gate=expression, Stream0=prot, Stream1=pflip)
s_0 = ClusterOutput(filter)

# ==== cluster Add_tail_info
list = ClusterInput()
F = ClusterInput()
list_2 = ClusterInput()
item = ClusterInput()
Y = UnitY(Factor=expr("-x", F))
item_2 = ListItem(List=list, Index=0, Wrap=True)
move = Move(Geometry=item_2, Motion=Y)  # -> Geometry, Transform
insert_items = InsertItems(List=list, Item=move.Geometry, Indices="0", Wrap=True)  # -> simplify(List)
insert_items_2 = InsertItems(List=list_2, Item=item, Indices="0", Wrap=True)  # -> simplify(List)
python_3_script = Python3Script(layers=insert_items)  # -> out, cg; inputs layers: list
# ---------- python_3_script: Python ----------
from compas_rhino.conversions import point_to_compas

cg = []
for p in layers:
    cg.append(point_to_compas(p))
# ---------- end python_3_script ----------
list_3 = ClusterOutput(insert_items_2)
cg = ClusterOutput(python_3_script.cg)
