# Grasshopper definition sin code.gh (Grasshopper 1.0.8)

pts = Slider(4, range=1..12)
length = Panel("1400")
n_curves = Slider(8, range=2..12)
height = Slider(40, range=1..350)
thickness = Slider(10, range=1..350)
division = Division(A=length, B=2)
negative = Negative(Value=division)
construct_domain = ConstructDomain(DomainStart=Slider(0, range=0..1400), DomainEnd=length)
construct_domain_2 = ConstructDomain(DomainStart=negative, DomainEnd=division)
multiplication = Multiplication(A=pts, B=12)
range = Range(Domain=construct_domain, Steps=multiplication)
range_2 = Range(Domain=construct_domain_2, Steps=multiplication)
expression = Expression(
    x=range,
    height=height,
    domain=length,
    thickness=thickness,
    n_curves=n_curves,
    Expression="height * -Cos(n_curves * pi * x / domain) + height + thickness")
expression_2 = Expression(
    x=range_2,
    height=height,
    domain=length,
    thickness=thickness,
    n_curves=n_curves,
    Expression="height * Cos(n_curves * pi * x / domain) - height - thickness")
division_2 = Division(A=length, B=2)
addition = Addition(A=range_2, B=division_2)
construct_point = ConstructPoint(XCoordinate=range, YCoordinate=expression, ZCoordinate=0)
construct_point_2 = ConstructPoint(XCoordinate=addition, YCoordinate=expression_2, ZCoordinate=0)
interpolate = Interpolate(Vertices=construct_point, Degree=3, Periodic=False, KnotStyle=1)  # -> Curve, Length, Domain
interpolate_2 = Interpolate(Vertices=construct_point_2, Degree=3, Periodic=False, KnotStyle=1)  # -> Curve, Length, Domain
unit_y = UnitY(Factor=thickness)
move = Move(Geometry=interpolate.Curve, Motion=expr("-x", unit_y))  # -> Geometry, Transform
move_2 = Move(Geometry=interpolate_2.Curve, Motion=unit_y)  # -> Geometry, Transform
